# Grasshopper definition 20200428 GOOD MORNING.gh (Grasshopper 1.0.5)

# ---- group: Main Outer Circle
circle = Circle(Plane=PlaneXY(0, 0, 0), Radius=Slider(60, range=0..100))

# ----
divide_curve = DivideCurve(Curve=circle, Count="2", Kinks=False)  # -> Points, Tangents, Parameters
number_slider = Slider(13, range=11..31)
polyline = PolyLine(Vertices=divide_curve.Points, Closed=False)
divide_curve_2 = DivideCurve(Curve=polyline, Count=number_slider, Kinks=False)  # -> Points, Tangents, Parameters
point_list = PointList(Points=divide_curve_2.Points, Size=Slider(5, range=0..8))

# ---- group: Large Inner Circles
evaluate = Evaluate(Expression="(X-3)/2", X=number_slider)
evaluate_2 = Evaluate(Expression="X-(X-3)/2", X=number_slider)
panel = Panel(evaluate)
panel_2 = Panel(evaluate_2)
list_item = ListItem(List=divide_curve_2.Points, Index=evaluate, Wrap=True)
list_item_2 = ListItem(List=divide_curve_2.Points, Index=Slider(0, range=0..30), Wrap=True)
list_item_3 = ListItem(List=divide_curve_2.Points, Index=evaluate_2, Wrap=True)
distance = Distance(PointA=list_item, PointB=list_item_2)
circle_cnr = CircleCNR(Center=list_item, Normal=Vector(0, 0, 1), Radius=distance)
circle_cnr_2 = CircleCNR(Center=list_item_3, Normal=Vector(0, 0, 1), Radius=distance)

# ---- group: Medium Inner Circle
evaluate_3 = Evaluate(Expression="(X-5)/2", X=number_slider)
evaluate_4 = Evaluate(Expression="y-x", X=evaluate_3, y=number_slider)
panel_3 = Panel(evaluate_3)
panel_4 = Panel(evaluate_4)
list_item_4 = ListItem(List=divide_curve_2.Points, Index=evaluate_3, Wrap=True)
list_item_5 = ListItem(List=divide_curve_2.Points, Index=Slider(0, range=0..30), Wrap=True)
list_item_6 = ListItem(List=divide_curve_2.Points, Index=evaluate_4, Wrap=True)
distance_2 = Distance(PointA=list_item_4, PointB=list_item_5)
circle_cnr_3 = CircleCNR(Center=list_item_4, Normal=Vector(0, 0, 1), Radius=distance_2)
circle_cnr_4 = CircleCNR(Center=list_item_6, Normal=Vector(0, 0, 1), Radius=distance_2)

# ---- group: Large Inner Circles
evaluate_5 = Evaluate(Expression="X+Y", X=evaluate, y=evaluate_3)
evaluate_6 = Evaluate(Expression="(X-Y)*4", X=evaluate, y=evaluate_3)
panel_5 = Panel(evaluate_5)
list_item_7 = ListItem(List=divide_curve_2.Points, Index=evaluate_5, Wrap=True)
list_item_8 = ListItem(List=divide_curve_2.Points, Index=evaluate_6, Wrap=True)
distance_3 = Distance(PointA=list_item, PointB=list_item_4)
circle_cnr_5 = CircleCNR(Center=list_item_7, Normal=Vector(0, 0, 1), Radius=distance_3)
circle_cnr_6 = CircleCNR(Center=list_item_8, Normal=Vector(0, 0, 1), Radius=distance_3)

# ---- group: Surface for Trimming
unit_z = UnitZ(Factor=1)
extrude = Extrude(Base=polyline, Direction=unit_z)

# ---- group: Guideline for Plan
split_with_brep = SplitWithBrep(Curve=circle, Brep=extrude)  # -> Curve, Points
split_with_brep_2 = SplitWithBrep(Curve=circle_cnr, Brep=extrude)  # -> Curve, Points
split_with_brep_3 = SplitWithBrep(Curve=circle_cnr_2, Brep=extrude)  # -> Curve, Points
split_with_brep_4 = SplitWithBrep(Curve=circle_cnr_3, Brep=extrude)  # -> Curve, Points
split_with_brep_5 = SplitWithBrep(Curve=circle_cnr_4, Brep=extrude)  # -> Curve, Points
split_with_brep_6 = SplitWithBrep(Curve=circle_cnr_5, Brep=extrude)  # -> Curve, Points
split_with_brep_7 = SplitWithBrep(Curve=circle_cnr_6, Brep=extrude)  # -> Curve, Points
list_item_9 = ListItem(List=split_with_brep.Curve, Index=0, Wrap=True)  # -> Item, Item1
list_item_10 = ListItem(List=split_with_brep_2.Curve, Index=0, Wrap=True)  # -> Item, Item1
list_item_11 = ListItem(List=split_with_brep_3.Curve, Index=0, Wrap=True)  # -> Item, Item1
list_item_12 = ListItem(List=split_with_brep_4.Curve, Index=0, Wrap=True)  # -> Item, Item1
list_item_13 = ListItem(List=split_with_brep_5.Curve, Index=0, Wrap=True)  # -> Item, Item1
list_item_14 = ListItem(List=split_with_brep_6.Curve, Index=0, Wrap=True)  # -> Item, Item1
list_item_15 = ListItem(List=split_with_brep_7.Curve, Index=0, Wrap=True)  # -> Item, Item1
curve = Curve(list_item_9.Item)
curve_2 = Curve(list_item_10.Item)
curve_3 = Curve(list_item_13.Item1)
curve_4 = Curve(list_item_14.Item1)
curve_5 = Curve(list_item_9.Item1)  # disabled
curve_6 = Curve(list_item_11.Item1)  # disabled
curve_7 = Curve(list_item_12.Item)  # disabled
curve_8 = Curve(list_item_15.Item)  # disabled

# ----
number_slider_2 = Slider(10, range=0..10)
evaluate_7 = Evaluate(Expression="2*X+Y", X=number_slider_2, Y=Slider(5, range=0..20))
divide_curve_3 = DivideCurve(Curve=curve, Count=expr("2*X", number_slider_2), Kinks=False)  # -> reverse(Points), Tangents, Parameters
divide_curve_4 = DivideCurve(Curve=curve_2, Count=evaluate_7, Kinks=False)  # -> reverse(Points), Tangents, Parameters
unit_z_2 = UnitZ(Factor=1)
divide_curve_5 = DivideCurve(Curve=curve_3, Count=number_slider_2, Kinks=False)  # -> Points, Tangents, Parameters
divide_curve_6 = DivideCurve(Curve=curve_4, Count=number_slider_2, Kinks=False)  # -> Points, Tangents, Parameters

shortest_list = ShortestList(ListListA=divide_curve_3.Points, ListListB=divide_curve_4.Points, TrimMode=2)  # -> ListListA, ListListB
arc_sed = ArcSED(Start=shortest_list.ListListA, End=shortest_list.ListListB, Direction=unit_z_2)  # -> Arc, Plane, Radius
length = Length(Curve=arc_sed.Arc)
sort_list = SortList(Keys=length, ValuesValuesA=arc_sed.Arc)  # -> Keys, ValuesValuesA
list_item_16 = ListItem(List=sort_list.ValuesValuesA, Index=0, Wrap=True)
item_index = ItemIndex(List=arc_sed.Arc, Item=list_item_16)
split_list = SplitList(List=arc_sed.Arc, Index=item_index)  # -> ListA, ListB
curve_9 = Curve(split_list.ListA)

arc_sed_2 = ArcSED(Start=divide_curve_5.Points, End=divide_curve_6.Points, Direction=unit_z_2)  # -> Arc, Plane, Radius

# ---- group: Guideline for Columns
item = ListItem(List=reverse(divide_curve_2.Points), Index=0, Wrap=True)
item_2 = ListItem(List=divide_curve_2.Points, Index=expr("X-1", evaluate_5), Wrap=True)
item_3 = ListItem(List=divide_curve_2.Points, Index=expr("X-1", evaluate_2), Wrap=True)
尾巴大小 = Slider(0.91, range=0.5..1)
distance_4 = Distance(PointA=item, PointB=item_2)
distance_5 = Distance(PointA=item_2, PointB=item_3)
multiplication = Multiplication(A=distance_4, B=尾巴大小)
addition = Addition(A=multiplication, B=distance_5)
Z = UnitZ(Factor=expr("1.1*X", arc_sed_2.Radius))
circle_2 = CircleCNR(Center=item_2, Normal=Vector(0, 0, 1), Radius=multiplication)
circle_3 = CircleCNR(Center=item_3, Normal=Vector(0, 0, 1), Radius=addition)
extr = Extrude(Base=circle_2, Direction=Z)
extr_2 = Extrude(Base=circle_3, Direction=Z)
cap = CapHoles(Brep=extr)
cap_2 = CapHoles(Brep=extr_2)
trim_with_brep = TrimWithBrep(Curve=arc_sed_2.Arc, Brep=cap)  # -> Inside, Outside
trim_with_brep_2 = TrimWithBrep(Curve=curve_9, Brep=cap_2)  # -> Inside, Outside

# ----
curve_10 = Curve(simplify(trim_with_brep.Inside))
curve_11 = Curve(simplify(trim_with_brep_2.Inside))
split_tree = SplitTree(Data=curve_11, Masks=flatten("{0}"))  # -> Positive, simplify(Negative)
merge = Merge(Data1=curve_10, Data2=split_tree.Negative)

flatten_tree = FlattenTree(Tree=merge, Path="{0}")
graft_tree = GraftTree(Tree=merge, IncludeEmptyLists=True, IncludeNullItems=True)

perp_frames = PerpFrames(Curve=graft_tree, Count=1, Align=True)  # -> Frames, Parameters
拱高 = Slider(0.5, range=0..1)
拱宽 = Slider(0.3, range=0..1)
negative = Negative(Value=拱高)
negative_2 = Negative(Value=拱宽)
construct_domain = ConstructDomain(DomainStart=negative, DomainEnd=拱高)
construct_domain_2 = ConstructDomain(DomainStart=negative_2, DomainEnd=拱宽)
list_item_17 = ListItem(List=reverse(perp_frames.Frames), Index=0, Wrap=True)
rectangle = Rectangle(Plane=list_item_17, XSize=construct_domain, YSize=construct_domain_2, Radius=0)  # -> Rectangle, Length

join_curves = JoinCurves(Curves=[curve_4, curve_2], Preserve=False)
divide_curve_7 = DivideCurve(Curve=flatten_tree, Count=Slider(10, range=10..20), Kinks=False)  # -> Points, Tangents, Parameters
flip_matrix = FlipMatrix(Data=divide_curve_7.Points)
sort_along_curve = SortAlongCurve(Points=flip_matrix, Curve=join_curves)  # -> Points, Indices
point_list_2 = PointList(Points=sort_along_curve.Points)
polyline_2 = PolyLine(Vertices=sort_along_curve.Points, Closed=False)  # -> simplify(Polyline)
deconstruct_arc = DeconstructArc(Arc=flatten(curve_10))  # -> BasePlane, Radius, Angle
negative_3 = Negative(Value=拱高)
negative_4 = Negative(Value=拱宽)
list_item_18 = ListItem(List=reverse(deconstruct_arc.BasePlane), Index=0, Wrap=True)
construct_domain_3 = ConstructDomain(DomainStart=expr("0.8*X", negative_3), DomainEnd=expr("0.8*X", 拱高))
construct_domain_4 = ConstructDomain(DomainStart=expr("0.6*X", negative_4), DomainEnd=expr("0.6*X", 拱宽))
perp_frames_2 = PerpFrames(Curve=polyline_2, Count=1, Align=True)  # -> Frames, Parameters
point = Point(list_item_18)
list_item_19 = ListItem(List=reverse(polyline_2), Index=0, Wrap=True)
evaluate_curve = EvaluateCurve(Curve=reparameterize(list_item_19), Parameter="1")  # -> Point, Tangent, Angle
vector_2pt = Vector2Pt(PointA=evaluate_curve.Point, PointB=point, Unitize=False)  # -> Vector, Length
list_item_20 = ListItem(List=reverse(perp_frames_2.Frames), Index=0, Wrap=True)
align_plane = AlignPlane(Plane=list_item_20, Direction=vector_2pt.Vector)  # -> Plane, Angle
rectangle_2 = Rectangle(Plane=align_plane.Plane, XSize=construct_domain_3, YSize=construct_domain_4, Radius=0)  # -> simplify(Rectangle), Length

end_points = EndPoints(Curve=graft_tree)  # -> Start, End
deconstruct = Deconstruct(Point=end_points.Start)  # -> XComponent, YComponent, ZComponent
equality = Equality(FirstNumber=deconstruct.ZComponent, SecondNumber="0")  # -> Equality, Inequality
dispatch = Dispatch(List=end_points.Start, DispatchPattern=equality.Inequality)  # -> simplify(ListA), ListB
negative_5 = Negative(Value=拱宽)
negative_6 = Negative(Value=拱高)
construct_domain_5 = ConstructDomain(DomainStart=expr("0.4*X", negative_6), DomainEnd=expr("0.4*X", 拱高))
construct_domain_6 = ConstructDomain(DomainStart=expr("0.3*X", negative_5), DomainEnd=expr("0.3*X", 拱宽))
deconstruct_vector = DeconstructVector(Vector=dispatch.ListA)  # -> XComponent, YComponent, ZComponent
larger_than = LargerThan(FirstNumber=deconstruct_vector.ZComponent, SecondNumber="0")  # -> LargerThan, OrEqualTo
dispatch_2 = Dispatch(List=dispatch.ListA, DispatchPattern=larger_than.LargerThan)  # -> ListA, ListB
project = Project(Geometry=dispatch_2.ListA, Plane=PlaneXY(0, 0, 0))  # -> Geometry, Transform
sort_along_curve_2 = SortAlongCurve(Points=flatten(project.Geometry), Curve=join_curves)  # -> Points, Indices
sort_along_curve_3 = SortAlongCurve(Points=flatten(dispatch_2.ListA), Curve=join_curves)  # -> Points, Indices
polyline_3 = PolyLine(Vertices=sort_along_curve_2.Points, Closed=False)
graft_tree_2 = GraftTree(Tree=sort_along_curve_3.Points, IncludeEmptyLists=True, IncludeNullItems=True)  # -> simplify(Tree)
offset_curve = OffsetCurve(Curve=polyline_3, Distance=Slider(4, range=0..10), Plane=PlaneXY(0, 0, 0), Corners=1)
explode = Explode(Curve=offset_curve, Recursive=True)  # -> Segments, Vertices
end_points_2 = EndPoints(Curve=explode.Segments)  # -> Start, End
list_item_21 = ListItem(List=reverse(end_points_2.End), Index=0, Wrap=True)
merge_2 = Merge(Data1=end_points_2.Start, Data2=list_item_21)  # -> simplify(graft(Result))
line = Line(StartPoint=graft_tree_2, EndPoint=merge_2)
vector_2pt_2 = Vector2Pt(PointA=merge_2, PointB=graft_tree_2, Unitize=False)  # -> Vector, Length
align_plane_2 = AlignPlane(Plane=graft_tree_2, Direction=vector_2pt_2.Vector)  # -> Plane, Angle
vector_display = VectorDisplay(Anchor=graft_tree_2, Vector=vector_2pt_2.Vector)
rectangle_3 = Rectangle(Plane=align_plane_2.Plane, XSize=construct_domain_5, YSize=construct_domain_6, Radius=0)  # -> simplify(Rectangle), Length
sweep1 = Sweep1(Rail=line, Sections=rectangle_3.Rectangle, Miter=1)
cap_holes = CapHoles(Brep=sweep1)

sweep1_2 = Sweep1(Rail=graft_tree, Sections=rectangle.Rectangle, Miter=1)
sweep1_3 = Sweep1(Rail=polyline_2, Sections=rectangle_2.Rectangle, Miter=1)
cap_holes_2 = CapHoles(Brep=sweep1_2)  # -> flatten(Brep)
cap_holes_3 = CapHoles(Brep=sweep1_3)  # -> flatten(Brep)
solid_difference = SolidDifference(BrepsA=cap_holes_3, BrepsB=cap_holes_2)

explode_2 = Explode(Curve=polyline_2, Recursive=True)  # -> Segments, Vertices
flip_matrix_2 = FlipMatrix(Data=explode_2.Segments)
loft = Loft(Curves=flip_matrix_2, Options={Adjust=False, Closed=False, LoftEnds=0, LoftSimp=0, LoftType=0, Rebuild=10, Refit=0.01})
negative_7 = Negative(Value=拱高)
offset_surface = OffsetSurface(Surface=loft, Distance=expr("1.2*X", negative_7), Retrim=True)  # -> simplify(Surface)

flip_matrix_3 = FlipMatrix(Data=explode_2.Segments)  # disabled
stack_data = StackData(Data=flip_matrix_3, Stack=2)  # disabled
panel_6 = Panel("0")  # disabled
cull_index = CullIndex(List=stack_data, Indices=panel_6, Wrap=True)  # disabled
panel_7 = Panel("0")  # disabled
cull_index_2 = CullIndex(List=reverse(cull_index), Indices=panel_7, Wrap=True)  # disabled
panel_8 = Panel("2")  # disabled
partition_list = PartitionList(List=cull_index_2, Size=panel_8)  # disabled
loft_2 = Loft(Curves=partition_list, Options={Adjust=False, Closed=False, LoftEnds=0, LoftSimp=0, LoftType=0, Rebuild=10, Refit=0.01})  # -> simplify(Loft); disabled

brep = Brep(cap_holes)
surface = Surface(offset_surface)
brep_2 = Brep(cap_holes_2)
brep_3 = Brep(solid_difference)
group = Group(Objects=[surface, brep_2, brep_3, brep])
pi = Pi(Factor=1)
rotate = Rotate(Geometry=group, Angle=pi, Plane=PlaneXY(0, 0, 0))  # -> Geometry, Transform
