# Grasshopper definition dome_sharp.gh (Grasshopper 1.0.8)

number_slider = Slider(5, range=0..10)
polygon = Polygon(Plane=PlaneXY(0, 0, 0), Radius=Slider(2.5, range=0..5), Segments=number_slider, FilletRadius=0)  # -> Polygon, Length
offset = OffsetCurve(Curve=polygon.Polygon, Thinkness=Slider(0.5, range=0..2), Corners=1)
explode = Explode(Curve=offset, Recursive=True)  # -> Segments, Vertices
explode_2 = Explode(Curve=polygon.Polygon, Recursive=True)  # -> Segments, Vertices
cir = Circle(Plane=PlaneXY(0, 0, 0), Radius=Slider(4, range=-10..10))
vec = VectorXYZ(XComponent=0, YComponent=Slider(2.9, range=-10..10), ZComponent=Slider(1.1, range=-10..10))  # -> Vector, Length
area = Area(Geometry=polygon.Polygon)  # -> Area, Centroid
Z = UnitZ(Factor=1)

explode_3 = Explode(Curve=polygon.Polygon, Recursive=True)  # -> graft(Segments), Vertices
eval = EvaluateCurve(Curve=reparameterize(explode_3.Segments), Parameter=".5")  # -> Point, Tangent, Angle
number_slider_2 = Slider(1.3, range=0..5)
len = Length(Curve=explode_3.Segments)
pl = ConstructPlane(Origin=eval.Point, XAxis=explode_3.Segments, YAxis=Z)
division = Division(A=len, B="2")
arc = Arc(Plane=pl, Radius=division, Angle=Domain(0, 3.141592654))  # -> Arc, Length
pln = Plane(pl)
neg = Negative(Value=number_slider_2)
line = LineSDL(Start=pln, Direction=pln, Length=number_slider_2)
line_2 = LineSDL(Start=pln, Direction=pln, Length=neg)
merge = Merge(Data1=line, Data2=line_2)
merge_2 = Merge(Data1=arc.Arc, Data2=explode_3.Segments)
boundary = BoundarySurfaces(Edges=merge_2)
extr = Extrude(Base=boundary, Direction=merge)  # -> flatten(Extrusion)

move = Move(Geometry=cir, Motion=vec.Vector)  # -> Geometry, Transform
merge_3 = Merge(Data1=explode_2.Vertices, Data2=explode.Vertices)
duppt = RemoveDuplicatePts(Points=merge_3, Tolerance=0.01)
pipe = Pipe(Curve=move.Geometry, Radius=Slider(1.5, range=-10..10), Caps=0, FitRail=False)
dist = Distance(PointA=area.Centroid, PointB=duppt)
vec2pt = Vector2Pt(PointA=area.Centroid, PointB=duppt, Unitize=False)  # -> Vector, Length
pt = ConstructPoint(XCoordinate=0, YCoordinate=0, ZCoordinate=Slider(2.5, range=1..8))
Z_2 = UnitZ(Factor=1)
division_2 = Division(A="360", B=number_slider)
pl_2 = ConstructPlane(Origin=area.Centroid, XAxis=vec2pt.Vector, YAxis=Z_2)
arc_2 = ArcSED(Start=duppt, End=pt, Direction=Z_2)  # -> Arc, Plane, Radius
rotate = Rotate(Geometry=arc_2.Arc, Angle=degrees(division_2), Plane=PlaneXY(0, 0, 0))  # -> Geometry, Transform
rulesrf = RuledSurface(CurveA=arc_2.Arc, CurveB=rotate.Geometry)
sdiff = SolidDifference(BrepsB=pipe)
join = BrepJoin(Breps=flatten(rulesrf))  # -> Breps, Closed
outer_srf = ListItem(List=join.Breps, Index="0", Wrap=True)  # -> Item, Item1; disabled
cap = CapHoles(Brep=join.Breps)
dispatch = Dispatch(List=cap, DispatchPattern=[True, False])  # -> ListA, ListB
sdiff_2 = SolidDifference(BrepsA=dispatch.ListB, BrepsB=dispatch.ListA)
