# Grasshopper definition dome_form1_sort_31.01.gh (Grasshopper 1.0.8)
# plug-ins: Pufferfish

# Mesh has been stored here don't need to run the BouncySolver each time.
mesh = Mesh(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)

# ---- group: Planarization
qrsettings = QuadRemeshSettings(
    TargetCount=1000,
    AdaptiveSize=0,
    AdaptiveCount=False,
    TargetEdgeLength=Slider(0.5, range=0..1),
    HardEdges=False,
    SeamEdges=0,
    Symmetry=2,
    GuideCurves=0)
qrmesh = QuadRemesh(Geometry=mesh, Settings=qrsettings)
msmooth = SmoothMesh(Mesh=qrmesh, Strength=Slider(0.5, range=0..1), SkipNaked=invert(True), Iterations=1)
planarize = Planarize(M=msmooth, Strength=1)
show = Show(G=msmooth)
zombiesolver = ZombieSolver(GoalObjects=[show, planarize], Threshold=1e-10, Tolerance=0.0001, MaxIterations=50000)  # -> I, V, O
item = ListItem(List=zombiesolver.O, Index=0, Wrap=True)
pa = PlanarityAnalysis(Mesh=item, Max=0.01)  # -> M, P

# ----
polygon = Polygon(Plane=PlaneXY(0, 0, 0), Radius=Slider(2.5, range=0..5), Segments=Slider(6, range=0..10), FilletRadius=0)  # -> Polygon, Length
debrep = DeconstructBrep(Brep=polygon.Polygon)  # -> Faces, Edges, Vertices
qrsettings_2 = QuadRemeshSettings(
    TargetCount=1000,
    AdaptiveSize=0,
    AdaptiveCount=False,
    TargetEdgeLength=Slider(0.3, range=0..1),
    HardEdges=False,
    SeamEdges=0,
    Symmetry=2,
    GuideCurves=0)
panel = Panel("""0
1""")
qrmesh_2 = QuadRemesh(Geometry=debrep.Faces, Settings=qrsettings_2)
dispatch = Dispatch(List=debrep.Vertices, DispatchPattern=panel)  # -> ListA, ListB
medges = MeshEdges(Mesh=qrmesh_2)  # -> NakedEdges, InteriorEdges, NonManifoldEdges
demesh = DeconstructMesh(Mesh=qrmesh_2)  # -> Vertices, Faces, Colours, Normals
Z = UnitZ(Factor=1)
shift = ShiftList(List=dispatch.ListB, Shift=1, Wrap=True)
Z_2 = UnitZ(Factor=1)
end = EndPoints(Curve=medges.NakedEdges)  # -> Start, End
ln = Line(StartPoint=dispatch.ListA, EndPoint=shift)
cat = Catenary(PointA=dispatch.ListA, PointB=dispatch.ListB, Length=Slider(7, range=0..10), Gravity=Z)
neg = Negative(Value=Z_2)
move = Move(Geometry=[end.End, end.Start], Motion=neg)  # -> Geometry, Transform
merge = Merge(Data1=ln, Data2=cat)
Z_3 = UnitZ(Factor=1)
project = ProjectPoint(Point=move.Geometry, Direction=Z_3, Geometry=merge)  # -> Point, Index
Z_4 = UnitZ(Factor=Slider(1.3, range=0..10))
multiplication = Multiplication(A=[medges.InteriorEdges, medges.NakedEdges], B=Slider(0.3, range=0..10))
length_line = LengthLine(Line=[medges.InteriorEdges, medges.NakedEdges], Length=multiplication, Strength=10)
anchor = Anchor(Point=project.Point, Strength=10000)
load = Load(Point=demesh.Vertices, ForceVector=Z_4, Weighting=1)
show_2 = Show(G=qrmesh_2)
bouncysolver = BouncySolver(
    GoalObjects=flatten([load, show_2, length_line, anchor]),
    Reset=Toggle(False),
    Threshold=1e-15,
    Tolerance=0.0001,
    Damping=0.99,
    Iterations=10,
    On=invert(True))  # -> I, V, O
item_2 = ListItem(List=bouncysolver.O, Index=0, Wrap=True)
bbox = BoundingBox(Content=item, Plane=PlaneXY(0, 0, 0))  # -> Box, Box_2
debox = DeconstructBox(Box=bbox.Box_2)  # -> Plane, X, Y, Z

md_slider = MDSlider(SliderMode=0, slider_value=Point(0.5, 0.5, 0.5), x_domain=Domain(0, 1), y_domain=Domain(0, 1), z_domain=Domain(0, 1))

# ---- group: bottom surface
demesh_2 = DeconstructMesh(Mesh=item)  # -> Vertices, Faces, Colours, Normals
deface = DeconstructFace(Face=demesh_2.Faces)  # -> CornerA, CornerB, CornerC, CornerD
item_3 = ListItem(List=demesh_2.Vertices, Index=deface.CornerA, Wrap=True)
item_4 = ListItem(List=demesh_2.Vertices, Index=deface.CornerB, Wrap=True)
item_5 = ListItem(List=demesh_2.Vertices, Index=deface.CornerC, Wrap=True)
# Surface experiments
# Surface experiments
# Surface experiments
item_6 = ListItem(List=demesh_2.Vertices, Index=deface.CornerD, Wrap=True)
srf4pt = _4PointSurface(CornerA=item_3, CornerB=item_4, CornerC=item_5, CornerD=item_6)  # -> reparameterize(Surface)
evalsrf = EvaluateSurface(Surface=srf4pt, Point=md_slider)  # -> Point, Normal, UDirection, VDirection, Frame

# ---- group: top surface
offmsh = OffsetMesh(Mesh=item, Distance=Slider(0.08, range=0..0.1), BothSides=0, CreateSolid=invert(True))
demesh_3 = DeconstructMesh(Mesh=offmsh)  # -> Vertices, Faces, Colours, Normals
deface_2 = DeconstructFace(Face=demesh_3.Faces)  # -> CornerA, CornerB, CornerC, CornerD
item_7 = ListItem(List=demesh_3.Vertices, Index=deface_2.CornerA, Wrap=True)
item_8 = ListItem(List=demesh_3.Vertices, Index=deface_2.CornerB, Wrap=True)
item_9 = ListItem(List=demesh_3.Vertices, Index=deface_2.CornerC, Wrap=True)
item_10 = ListItem(List=demesh_3.Vertices, Index=deface_2.CornerD, Wrap=True)
srf4pt_2 = _4PointSurface(CornerA=item_7, CornerB=item_8, CornerC=item_9, CornerD=item_10)  # -> reparameterize(Surface)
evalsrf_2 = EvaluateSurface(Surface=srf4pt_2, Point=md_slider)  # -> Point, Normal, UDirection, VDirection, Frame

# ---- group: offset for seam
number_slider = Slider(0.98, range=0..1)
scale = Scale(Geometry=srf4pt_2, Center=evalsrf_2.Point, Factor=number_slider)  # -> graft(Geometry), Transform
scale_2 = Scale(Geometry=srf4pt, Center=evalsrf.Point, Factor=number_slider)  # -> graft(Geometry), Transform

# ---- group: panels
edges = BrepEdges(Brep=scale.Geometry)  # -> Naked, Interior, NonManifold
edges_2 = BrepEdges(Brep=scale_2.Geometry)  # -> Naked, Interior, NonManifold
join = JoinCurves(Curves=edges.Naked, Preserve=False)  # -> simplify(Curves)
join_2 = JoinCurves(Curves=edges_2.Naked, Preserve=False)  # -> simplify(Curves)
merge_2 = Merge(Data1=join, Data2=join_2)  # -> simplify(Result)
loft = Loft(
    Curves=reparameterize(merge_2),
    Options={Adjust=False, Closed=False, LoftEnds=0, LoftSimp=0, LoftType=0, Rebuild=10, Refit=0.01})
merge_3 = Merge(Data1=simplify(scale.Geometry), Data2=simplify(loft), Data3=simplify(scale_2.Geometry))

# ---- group: holes in panels
number_slider_2 = Slider(0.1, range=0..0.1)
number_slider_3 = Slider(0.5, range=0..1)
scale_3 = Scale(Geometry=srf4pt_2, Center=evalsrf_2.Point, Factor=number_slider_3)  # -> graft(Geometry), Transform
scale_4 = Scale(Geometry=srf4pt, Center=evalsrf.Point, Factor=number_slider_3)  # -> graft(Geometry), Transform
amp = Amplitude(Vector=evalsrf.Normal, Amplitude=number_slider_2)  # -> expr("-x", Vector)
amp_2 = Amplitude(Vector=evalsrf_2.Normal, Amplitude=number_slider_2)
move_2 = Move(Geometry=scale_3.Geometry, Motion=graft(amp_2))  # -> Geometry, Transform
move_3 = Move(Geometry=scale_4.Geometry, Motion=graft(amp))  # -> Geometry, Transform
edges_3 = BrepEdges(Brep=move_2.Geometry)  # -> Naked, Interior, NonManifold
edges_4 = BrepEdges(Brep=move_3.Geometry)  # -> Naked, Interior, NonManifold
join_3 = JoinCurves(Curves=edges_3.Naked, Preserve=False)  # -> simplify(Curves)
join_4 = JoinCurves(Curves=edges_4.Naked, Preserve=False)  # -> simplify(Curves)
merge_4 = Merge(Data1=join_3, Data2=join_4)  # -> simplify(Result)
loft_2 = Loft(
    Curves=reparameterize(merge_4),
    Options={Adjust=False, Closed=False, LoftEnds=0, LoftSimp=0, LoftType=0, Rebuild=10, Refit=0.01})
merge_5 = Merge(Data1=simplify(move_2.Geometry), Data2=simplify(loft_2), Data3=simplify(move_3.Geometry))

# ---- group: panels woth holes
join_5 = BrepJoin(Breps=merge_3)  # -> Breps, Closed
join_6 = BrepJoin(Breps=merge_5)  # -> Breps, Closed
sdiff = SolidDifference(BrepsA=simplify(join_5.Breps), BrepsB=simplify(join_6.Breps))  # -> flatten(Result)

# ---- group: elements on a plane
number_slider_4 = Slider(3, range=0..10)
number_slider_5 = Slider(10, range=0..10)
number_slider_6 = Slider(13, range=0..100)
pt = ConstructPoint(XCoordinate=number_slider_4, YCoordinate=number_slider_4, ZCoordinate=0)
dom² = ConstructDomain²(DomainU=number_slider_5, DomainV=number_slider_6)
multiplication_2 = Multiplication(A=number_slider_5, B=number_slider_6)
xy = XYPlane(Origin=pt)
range = Range(Domain=dom², Steps=multiplication_2)
planesrf = PlaneSurface(Plane=xy, XSize=Slider(10, range=0..100), YSize=Slider(17, range=0..100))
divide = DivideDomain²(Domain=planesrf, UCount=number_slider_5, VCount=number_slider_6)
md_slider_2 = MDSlider(SliderMode=0, slider_value=Point(0.5, 0.5, 0.5), x_domain=Domain(0, 1), y_domain=Domain(0, 1), z_domain=Domain(0, 1))
subsrf = Isotrim(Surface=planesrf, Domain=divide)  # -> flatten(Surface)
evalsrf_3 = EvaluateSurface(Surface=reparameterize(subsrf), Point=md_slider_2)  # -> Point, Normal, UDirection, VDirection, Frame
orient = Orient(Geometry=sdiff, Source=evalsrf_2.Frame, Target=evalsrf_3.Point)  # -> Geometry, Transform
lng = ListLength(List=sdiff)
partition = PartitionList(List=orient.Geometry, Size=lng)
tstat = TreeStatistics(Tree=partition)  # -> Paths, Length, Count
item_11 = ListItem(List=tstat.Paths, Index=0, Wrap=True)
branch = TreeBranch(Tree=partition, Path=item_11, MaintainPaths=True)
item_12 = ListItem(List=branch, Index=0, Wrap=True)

# ----
sorting = Python3Script(breps=sdiff, tolerance=Slider(0.1, range=0..1))  # -> sorted_breps, labels, centers; inputs breps: list of Brep, tolerance: Double
# ---------- sorting: Python ----------
import Rhino.Geometry as rg
import math

# Input: breps (List of Brep, List Access), tolerance (float, Item Access)

print("=== DEBUG START ===")
print("Input breps count: " + str(len(breps)))
print("Tolerance: " + str(tolerance))

brep_data = []
for i, brep in enumerate(breps):
    vol = rg.VolumeMassProperties.Compute(brep)
    if vol:
        c = vol.Centroid
        brep_data.append([brep, c, c.Z])
        if i < 5:
            print("Brep " + str(i) + " centroid Z: " + str(c.Z))
    else:
        print("Brep " + str(i) + " failed to compute volume")

print("Valid breps: " + str(len(brep_data)))

if len(brep_data) == 0:
    print("ERROR: No valid breps!")
    sorted_breps = []
    labels = []
    centers = []
else:
    brep_data.sort(key=lambda x: x[2])
    
    layers = []
    current = [brep_data[0]]
    
    for item in brep_data[1:]:
        if abs(item[2] - current[-1][2]) < tolerance:
            current.append(item)
        else:
            layers.append(current)
            current = [item]
    layers.append(current)
    
    print("Number of layers: " + str(len(layers)))
    for i, layer in enumerate(layers):
        print("Layer " + str(i+1) + " has " + str(len(layer)) + " pieces")
    
    out_breps = []
    out_centers = []
    out_labels = []
    
    for layer_idx, layer in enumerate(layers):
        layer.sort(key=lambda item: math.atan2(item[1].Y, item[1].X))
        for elem_idx, item in enumerate(layer):
            out_breps.append(item[0])
            out_centers.append(item[1])
            # Format: layer_element, e.g. 1_01, 1_02, ... 2_01, 2_02
            label = str(layer_idx + 1) + "_" + str(elem_idx + 1).zfill(2)
            out_labels.append(label)
    
    print("Output breps count: " + str(len(out_breps)))
    print("Output labels count: " + str(len(out_labels)))
    print("Sample labels: " + str(out_labels[:5]))
    print("=== DEBUG END ===")
    
    sorted_breps = out_breps
    labels = out_labels
    centers = out_centers
# ---------- end sorting ----------
col = Colour(RGB(49, 49, 133))
tag = TextTag(Location=sorting.centers, Text=sorting.labels, Colour=col)
orient_2 = Python3Script(
    sorted_breps=sorting.sorted_breps,
    labels=sorting.labels,
    spacing=Slider(0.1, range=0..1),
    columns=Slider(12, range=0..100))  # -> out_breps; inputs sorted_breps: list of Brep, labels: list
# ---------- orient_2: Python ----------
import Rhino.Geometry as rg
import math

# Input: 
#   sorted_breps (List of Brep, List Access)
#   labels (List of str, List Access)
#   spacing (float, Item Access, e.g. 50.0)
#   columns (int, Item Access, e.g. 10)

# Output:
#   a = arranged_breps
#   b = labels (unchanged, pass through)
#   c = surfaces (for Text On Surface S input)
#   d = baselines (for Text On Surface B input)

out_breps = []
out_surfaces = []
out_baselines = []
bboxes = []
bb_edges = []

max_width = 0
max_depth = 0
for brep in sorted_breps:
    bbox = brep.GetBoundingBox(True)
    w = bbox.Max.X - bbox.Min.X
    d = bbox.Max.Y - bbox.Min.Y
    if w > max_width:
        max_width = w
    if d > max_depth:
        max_depth = d

cell_width = max_width + spacing
cell_depth = max_depth + spacing

for i, brep in enumerate(sorted_breps):
    row = i // columns
    col = i % columns
    
    target_x = col * cell_width
    target_y = row * cell_depth
    
    largest_face = None
    largest_area = 0
    for face in brep.Faces:
        amp = rg.AreaMassProperties.Compute(face)
        if amp and amp.Area > largest_area:
            largest_area = amp.Area
            largest_face = face
    
    u_dom = largest_face.Domain(0)
    v_dom = largest_face.Domain(1)
    u_mid = (u_dom.T0 + u_dom.T1) / 2
    v_mid = (v_dom.T0 + v_dom.T1) / 2
    result, source_frame = largest_face.FrameAt(u_mid, v_mid)
    source_plane = rg.Plane(source_frame.Origin, source_frame.XAxis, source_frame.YAxis)
    
    target_plane = rg.Plane(rg.Point3d(target_x, target_y, 0), rg.Vector3d.XAxis, rg.Vector3d.YAxis)
    
    xform = rg.Transform.PlaneToPlane(source_plane, target_plane)
    new_brep = brep.DuplicateBrep()
    new_brep.Transform(xform)
    
    new_bbox = new_brep.GetBoundingBox(True)
    move_vec = rg.Vector3d(0, 0, -new_bbox.Min.Z)
    new_brep.Translate(move_vec)
    
    out_breps.append(new_brep)
# ---------- end orient_2 ----------
debrep_2 = DeconstructBrep(Brep=flatten(orient_2))  # -> simplify(Faces), Edges, Vertices
area = Area(Geometry=debrep_2.Faces)  # -> Area, Centroid
sort = SortList(Keys=area.Area, ValuesA=debrep_2.Faces)  # -> Keys, reverse(ValuesA)
item_13 = ListItem(List=sort.ValuesA, Index=0, Wrap=True)  # -> flatten(Item)
edges_5 = BrepEdges(Brep=item_13)  # -> Naked, Interior, NonManifold
item_14 = ListItem(List=edges_5.Naked, Index=0, Wrap=True)  # -> flatten(Item)
len = Length(Curve=item_14)
X = UnitX(Factor=len)
multiplication_3 = Multiplication(A=X, B="-0.3")
Y = UnitY(Factor=Slider(0.05, range=0..0.1))
move_4 = Move(Geometry=item_14, Motion=multiplication_3)  # -> Geometry, Transform
move_5 = Move(Geometry=move_4.Geometry, Motion=Y)  # -> Geometry, Transform
textsrf = TextOnSurface(
    Text=sorting.labels,
    Font="Sans Bold:no Italic:no",
    Height=Slider(0.05, range=0..0.05),
    Depth=0.01,
    BaseLine=move_5.Geometry,
    BaseSurface=item_13)  # -> flatten(Symbols)

# ---- group: sorting (unsuccessful)
bbox_2 = BoundingBox(Plane=PlaneXY(0, 0, 0))  # -> flatten(Box), Box_2
debox_2 = DeconstructBox(Box=bbox_2.Box)  # -> Plane, X, Y, Z
# Nice order, we can work with it
# Nice order, we can work with it
# Nice order, we can work with it
pt_2 = ConstructPoint(XCoordinate=0, YCoordinate=0, ZCoordinate=0)
boxprop = BoxProperties(Box=bbox_2.Box)  # -> flatten(Center), Diagonal, Area, Volume, Degeneracy
dedomain = DeconstructDomain(Domain=debox_2.Z)  # -> Start, End
Z_5 = UnitZ(Factor=1)
vec2pt = Vector2Pt(PointA=pt_2, PointB=boxprop.Center, Unitize=False)  # -> Vector, Length
xy_2 = XYPlane(Origin=Point(0, 0, 0))
points = PointList(Points=boxprop.Center)
yz = YZPlane(Origin=Point(0, 0, 0))
angle = Angle(VectorA=yz, VectorB=vec2pt.Vector)  # -> Angle, Reflex
round = Round(Number=angle.Angle)  # -> Nearest, Floor, Ceiling
sort_2 = SortList(Keys=round.Nearest)  # -> Keys, ValuesA
bbox_3 = BoundingBox(Content=sort_2.ValuesA, Plane=PlaneXY(0, 0, 0))  # -> Box, Box_2
boxprop_2 = BoxProperties(Box=bbox_3.Box)  # -> flatten(Center), Diagonal, Area, Volume, Degeneracy
points_2 = PointList(Points=boxprop_2.Center, Size=Slider(0.1, range=0..1))

# ----
panels_to_bake = Brep(orient_2)

# ---- group: 3dprint
number_slider_7 = Slider(0.006, range=0..0.1)
number_slider_8 = Slider(0.06, range=0..0.1)
srf = Surface(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)
number_slider_9 = Slider(30, range=0..100)
contour = Contour(Shape=srf, Point=Point(0, 0, 0), Direction=Vector(0, 0, 1), Distance=Slider(2, range=0..100))
contour_2 = Contour(Shape=item_12, Point=Point(0, 0, 0), Direction=Vector(0, 0, 1), Distance=number_slider_7)
facen = FaceNormals()  # -> Centers, Normals
amp_3 = Amplitude(Vector=facen.Normals, Amplitude=Slider(50, range=0..100))
dispatch_2 = Dispatch(List=flatten(contour), DispatchPattern=[True, True, True, False])  # -> ListA, ListB
divide_2 = DivideCurve(Curve=contour_2, Count=number_slider_9, Kinks=False)  # -> Points, Tangents, Parameters
vdis = VectorDisplay(Anchor=facen.Centers, Vector=amp_3)
points_3 = PointList(Points=divide_2.Points)
divide_3 = DivideCurve(Curve=dispatch_2.ListB, Count=Slider(100, range=0..100), Kinks=False)  # -> Points, Tangents, Parameters
dispatch_3 = Dispatch(List=divide_3.Points, DispatchPattern=[True, False])  # -> ListA, ListB
brep_cp = BrepClosestPoint(Point=dispatch_3.ListB, Brep=srf)  # -> Point, Normal, Distance
amp_4 = Amplitude(Vector=brep_cp.Normal, Amplitude=Slider(3, range=0..100))
move_6 = Move(Geometry=dispatch_3.ListB, Motion=amp_4)  # -> Geometry, Transform
vdis_2 = VectorDisplay(Anchor=divide_2.Points)
weave = Weave(Pattern=[0, 1], Stream0=dispatch_3.ListA, Stream1=move_6.Geometry, NullGaps=False)
pline = PolyLine(Vertices=weave, Closed=False)
pline_2 = PolyLine(Vertices=flatten(divide_2.Points), Closed=False)
weave_2 = Weave(Pattern=[0, 1], Stream0=dispatch_2.ListA, Stream1=pline, NullGaps=False)
division = Division(A=number_slider_7, B=2)
number_slider_10 = Slider(2, range=0..10)
subtraction = Subtraction(A=number_slider_7, B=4)
pipe = Pipe(Curve=pline_2, Radius=division, Caps=0)
assembly = Python3Script(points=divide_2.Points, distance=number_slider_7, count=number_slider_9)  # -> out, assembly, trigger; inputs points: list of Point3d, distance: Int32, count: Int32
# ---------- assembly: Python ----------
import Rhino.Geometry as rg
from scriptcontext import sticky as st

# ---------------------------------------------------------
# Initialize structures
# ---------------------------------------------------------
assembly = {}
key = 0   # unique ID for each brick instance

for p in points:
    assembly[key] = {
        "id": key,
        "row": distance,
        "col": count,
        #"object_plane": plane,
    }
    key += 1

st["assembly"] = assembly

print("Assembly generated with " + str(len(assembly)) + " bricks")
# ---------- end assembly ----------

# ----
number_to_bake = Brep(textsrf)
