# Grasshopper definition dome_multi.gh (Grasshopper 1.0.8)

number_slider = Slider(7, range=0..10)
polygon = Polygon(Plane=PlaneXY(0, 0, 0), Radius=Slider(3.1, range=0..5), Segments=number_slider, FilletRadius=0)  # -> Polygon, Length
offset = OffsetCurve(Curve=polygon.Polygon, Thinkness=Slider(-0.2, range=-1..1), Corners=1)
Z = UnitZ(Factor=Slider(5.66, range=1..8))
Z_2 = UnitZ(Factor=Slider(0, range=0..8))
explode = Explode(Curve=polygon.Polygon, Recursive=True)  # -> Segments, Vertices
explode_2 = Explode(Curve=offset, Recursive=True)  # -> Segments, Vertices
area = Area(Geometry=polygon.Polygon)  # -> Area, Centroid

# ----
# structural support
number_slider_2 = Slider(2.63, range=0..8)
number_slider_3 = Slider(0.78, range=-0.1..0.9)
rdiff = RegionDifference(CurvesA=polygon.Polygon, CurvesB=offset)
explode_3 = Explode(Curve=polygon.Polygon, Recursive=True)  # -> graft(Segments), Vertices
boundary = BoundarySurfaces(Edges=rdiff)
midpt = CurveMiddle(Curve=explode_3.Segments)
len = Length(Curve=explode_3.Segments)
multiplication = Multiplication(A=len, B=Slider(0.34, range=0..0.5))
multiplication_2 = Multiplication(A=number_slider_2, B=Slider(0.83, range=0..1))
Z_3 = UnitZ(Factor=1)
neg = Negative(Value=multiplication_2)
neg_2 = Negative(Value=multiplication)
scale_nu = ScaleNU(Geometry=boundary, Plane=PlaneXY(0, 0, 0), ScaleX=number_slider_3, ScaleY=number_slider_3, ScaleZ=1)  # -> Geometry, Transform
vec2pt = Vector2Pt(PointA=midpt, PointB=area.Centroid, Unitize=False)  # -> Vector, Length
pl = ConstructPlane(Origin=midpt, XAxis=explode_3.Segments, YAxis=Z_3)
dom = ConstructDomain(DomainStart=multiplication, DomainEnd=neg_2)
dom_2 = ConstructDomain(DomainStart=multiplication_2, DomainEnd=neg)
Z_4 = UnitZ(Factor=number_slider_2)
rectangle = Rectangle(Plane=pl, XSize=dom, YSize=dom_2, Radius=0)  # -> Rectangle, Length
line = LineSDL(Start=midpt, Direction=vec2pt.Vector, Length=Slider(1.2, range=0..2))
extr = Extrude(Base=rectangle.Rectangle, Direction=line)  # -> flatten(Extrusion)
extr_2 = Extrude(Base=scale_nu.Geometry, Direction=Z_4)
sdiff = SolidDifference(BrepsA=extr_2, BrepsB=extr)
preview = CustomPreview(Geometry=sdiff, Material=ColourSwatch(SwatchColor=RGB(69, 69, 69)))

move = Move(Geometry=explode_2.Vertices, Motion=Z_2)  # -> Geometry, Transform
move_2 = Move(Geometry=explode.Vertices, Motion=Z_2)  # -> Geometry, Transform
ln = Line(StartPoint=explode_2.Vertices, EndPoint=move.Geometry)
move_3 = Move(Geometry=offset, Motion=Z_2)  # -> Geometry, Transform
move_4 = Move(Geometry=area.Centroid, Motion=Z)  # -> Geometry, Transform
move_5 = Move(Geometry=area.Centroid, Motion=Z_2)  # -> Geometry, Transform

# ----
# Distorted vaulted ceiling surface
pcen = PolygonCenter(Polyline=move_3.Geometry)  # -> CenterV, CenterE, CenterA
Z_5 = UnitZ(Factor=1)
vec2pt_2 = Vector2Pt(PointA=move.Geometry, PointB=pcen.CenterV, Unitize=False)  # -> Vector, Length
pl_2 = ConstructPlane(Origin=pcen.CenterV, XAxis=Z_5, YAxis=vec2pt_2.Vector)
rad = Radians(Degrees="-90")
arc = ArcSED(Start=move.Geometry, End=move_4.Geometry, Direction=pl_2)  # -> Arc, Plane, Radius
division = Division(A="360", B=number_slider)
rotate = Rotate(Geometry=arc.Arc, Angle=degrees(division), Plane=PlaneXY(0, 0, 0))  # -> Geometry, Transform
rulesrf = RuledSurface(CurveA=arc.Arc, CurveB=rotate.Geometry)

ln_2 = Line(StartPoint=move.Geometry, EndPoint=move_4.Geometry)
division_2 = Division(A="360", B=number_slider)
rotate_2 = Rotate(Geometry=ln_2, Angle=degrees(division_2), Plane=PlaneXY(0, 0, 0))  # -> Geometry, Transform
rotate_3 = Rotate(Geometry=rotate_2.Geometry, Angle=degrees(Slider(201, range=0..360)), Plane=PlaneXY(0, 0, 0))  # -> Geometry, Transform
rulesrf_2 = RuledSurface(CurveA=ln_2, CurveB=rotate_2.Geometry)

midpt_2 = CurveMiddle(Curve=arc.Arc)

# ----
# for strange faces
arc_2 = ArcSED(Start=move.Geometry, End=move_4.Geometry, Direction=Z)  # -> Arc, Plane, Radius
division_3 = Division(A="360", B=number_slider)
rotate_4 = Rotate(Geometry=arc_2.Arc, Angle=degrees(division_3), Plane=PlaneXY(0, 0, 0))  # -> Geometry, Transform
rotate_5 = Rotate(Geometry=rotate_4.Geometry, Angle=degrees(Slider(182, range=0..360)), Plane=PlaneXY(0, 0, 0))  # -> Geometry, Transform
rulesrf_3 = RuledSurface(CurveA=arc_2.Arc, CurveB=rotate_5.Geometry)

# ----
# for strange faces
arc_3 = ArcSED(Start=move_2.Geometry, End=move_4.Geometry, Direction=Z)  # -> Arc, Plane, Radius
division_4 = Division(A="360", B=number_slider)
rotate_6 = Rotate(Geometry=arc_3.Arc, Angle=degrees(division_4), Plane=PlaneXY(0, 0, 0))  # -> Geometry, Transform
rotate_7 = Rotate(Geometry=rotate_6.Geometry, Angle=degrees(Slider(122, range=0..360)), Plane=PlaneXY(0, 0, 0))  # -> Geometry, Transform
rulesrf_4 = RuledSurface(CurveA=arc_3.Arc, CurveB=rotate_7.Geometry)

# ----
# Lattice Representation
number_slider_4 = Slider(0.03, range=0.001..0.05)
meshsubd = MeshFromSubD(Density=3)
medges = MeshEdges(Mesh=meshsubd)  # -> NakedEdges, InteriorEdges, NonManifoldEdges
mp = MultiPipe(
    Curves=medges.InteriorEdges,
    NodeSize=number_slider_4,
    EndOffset=1,
    StrutSize=1,
    Segment=0,
    KinkAngle=0.6,
    CubeFit=0,
    Caps=0)
meshsubd_2 = MeshFromSubD(SubD=mp, Density="0")
unweld = UnweldMesh(Mesh=meshsubd_2, Angle=0)

# ----
# Lattice Representation
number_slider_5 = Slider(0.03, range=0.001..0.5)
mesh = MeshBrep(
    Brep=rulesrf_3,
    Settings={GridMaxCount=0, GridMinCount=16, JaggedSeams=False, MaxEdgeLength=0, MinEdgeLength=0.0001, MinTolerance=0, Refine=True, RefineAngle=0, RelativeTolerance=0.65, SimplePlanes=True, Tolerance=0})
medges_2 = MeshEdges(Mesh=mesh)  # -> NakedEdges, InteriorEdges, NonManifoldEdges
mp_2 = MultiPipe(
    Curves=medges_2.InteriorEdges,
    NodeSize=number_slider_5,
    EndOffset=1,
    StrutSize=1,
    Segment=0,
    KinkAngle=0.6,
    CubeFit=0,
    Caps=0)
meshsubd_3 = MeshFromSubD(SubD=mp_2, Density="0")
unweld_2 = UnweldMesh(Mesh=meshsubd_3, Angle=0)

# ----
# Smooth dome surface
edges = BrepEdges(Brep=rulesrf_3)  # -> Naked, Interior, NonManifold
edges_2 = BrepEdges(Brep=rulesrf_4)  # -> Naked, Interior, NonManifold
rulesrf_5 = RuledSurface(CurveA=edges.Naked, CurveB=edges_2.Naked)

scale = Scale(Geometry=rulesrf, Center=Point(0, 0, 0), Factor=Slider(0.96, range=0.5..1.5))  # -> Geometry, Transform
edges_3 = BrepEdges(Brep=scale.Geometry)  # -> Naked, Interior, NonManifold
edges_4 = BrepEdges(Brep=rulesrf)  # -> Naked, Interior, NonManifold
merge = Merge(Data1=rulesrf_3, Data2=rulesrf_4, Data3=rulesrf_5)
rulesrf_6 = RuledSurface(CurveA=edges_4.Naked, CurveB=edges_3.Naked)
preview_2 = CustomPreview(Geometry=merge, Material=ColourSwatch(SwatchColor=RGB(186, 186, 186)))
preview_3 = CustomPreview(Geometry=unweld_2, Material=ColourSwatch(SwatchColor=RGB(194, 194, 194)))
preview_4 = CustomPreview(Geometry=mp, Material=ColourSwatch(SwatchColor=RGB(186, 186, 186)))
