# Grasshopper definition dome_multi_29_1_kang.gh (Grasshopper 1.0.8)
# plug-ins: Pufferfish, LunchBox, Weaverbird

polygon = Polygon(Plane=PlaneXY(0, 0, 0), Radius=Slider(2.5, range=0..5), Segments=Slider(6, range=0..10), FilletRadius=0)  # -> Polygon, Length

area = Area(Geometry=polygon.Polygon)  # -> Area, Centroid
Z = UnitZ(Factor=Slider(3, range=1..8))
move = Move(Geometry=area.Centroid, Motion=Z)  # -> Geometry, Transform

boundary = BoundarySurfaces(Edges=polygon.Polygon)
explode = Explode(Curve=polygon.Polygon, Recursive=True)  # -> Segments, Vertices
triremesh = TriRemesh(Geometry=boundary, Length=Slider(0.3, range=0..1), Iterations=25)  # -> Triangulation, Dual, Creases
disc = Discontinuity(Curve=polygon.Polygon, Level=1)  # -> Points, Parameters
cull_i = CullIndex(List=explode.Vertices, Indices="-1", Wrap=True)
bottom_vertex = Point(cull_i)
top_point = Point(move.Geometry)
mesh = Mesh(triremesh.Triangulation)
fix_verpt = Point(disc.Points)
medges = MeshEdges(Mesh=graft(mesh))  # -> NakedEdges, InteriorEdges, NonManifoldEdges
demesh = DeconstructMesh(Mesh=mesh)  # -> Vertices, Faces, Colours, Normals
medges_2 = MeshEdges(Mesh=mesh)  # -> NakedEdges, InteriorEdges, NonManifoldEdges
item = ListItem(List=medges.NakedEdges, Index=0, Wrap=True)  # -> Item, Item1, Item2, Item3, Item4, Item5
cps = ClosestPoints(Point=fix_verpt, Cloud=demesh.Vertices, Count=Slider(5, range=0..10))  # -> ClosestPoint, CPIndex, Distance
end = EndPoints(Curve=medges_2.NakedEdges)  # -> Start, End
item_2 = ListItem(List=demesh.Vertices, Index=cps.CPIndex, Wrap=True)
genes = GenePool(Decimals=2, Maximum=5, Minimum=0, Value=[0, 0, 1.57, 0])
edgelengths = EdgeLengths(Mesh=mesh, LengthFactor=Slider(1.51, range=0..2), Strength=1)
Z_2 = UnitZ(Factor=genes)
load = Load(Point=demesh.Vertices, ForceVector=Vector(0, 0, 1), Weighting=Slider(0.143, range=0..0.3))
show = Show(G=mesh)
move_2 = Move(Geometry=item_2, Motion=Z_2)  # -> Geometry, Transform
anchorxyz = AnchorXYZ(X=False, Y=False, Z=False, Strength=1000)
anchor = Anchor(Point=item_2, Target=move_2.Geometry, Strength=10000)
merge = Merge(Data1=flatten(show), Data2=flatten(anchor), Data3=flatten(edgelengths), Data5=flatten(load))
bouncysolver = BouncySolver(GoalObjects=merge, Reset=Button(), Threshold=1e-15, Tolerance=0.0001, Damping=0.99, Iterations=10, On=Toggle(True))  # -> I, V, O
# Which faces we need
# Which faces we need
dome_srf = Surface()
relay = Relay()
relay_2 = Relay()
join = BrepJoin()  # -> Breps, Closed
mesh_2 = Mesh(bouncysolver.O)

item_3 = ListItem(List=relay_2, Index="0", Wrap=True)  # -> simplify(Item)
# Surface experiments
sunion = SolidUnion(Breps=item_3)
number_slider = Slider(0, range=0..100)
number_slider_2 = Slider(4, range=0..10)
md_slider = MDSlider(SliderMode=0, slider_value=Point(0.5, 0.5, 0.5), x_domain=Domain(0, 1), y_domain=Domain(0, 1), z_domain=Domain(0, 1))

bbox = BoundingBox(Content=item_3, Plane=PlaneXY(0, 0, 0))  # -> Box, Box_2
debox = DeconstructBox(Box=bbox.Box)  # -> Plane, X, Y, Z
dedomain = DeconstructDomain(Domain=debox.Z)  # -> Start, End
rebuildsrf = RebuildSurface(Surface=item_3, UDegree=3, VDegree=3, UNumber=10, VNumber=number_slider_2)
dom = ConstructDomain(DomainStart=dedomain.Start, DomainEnd=dedomain.End)
range = Range(Domain=dom, Steps=Slider(5, range=0..10))

# ---- group: additional plane on top
item_4 = ListItem(List=range, Index=0, Wrap=True)  # -> Item2, Item1, Item
subtraction = Subtraction(A=item_4.Item1, B=item_4.Item2)
division = Division(A=subtraction, B=Slider(1.5, range=0..10))
addition = Addition(A=item_4.Item2, B=division)
merge_2 = Merge(Data1=range, Data2=addition)
# Order is all over the place
# Impossible to do assembly
sort = SortList(Keys=merge_2, ValuesA=merge_2)  # -> Keys, ValuesA

# ----
pt = ConstructPoint(XCoordinate=0, YCoordinate=0, ZCoordinate=sort.ValuesA)
xy = XYPlane(Origin=pt)
sec = BrepPlane(Brep=item_3, Plane=xy)  # -> flatten(Curves), Points
srfsplit = SurfaceSplit(Surface=item_3, Curves=flatten(sec.Curves))  # -> reparameterize(Fragments)
shrinktrimsrf = ShrinkTrimmedSurface(Surface=srfsplit)  # -> Shrunken, reparameterize(Underlying), R
evalsrf = EvaluateSurface(Surface=simplify(shrinktrimsrf.Underlying), Point=md_slider)  # -> Point, Normal, UDirection, VDirection, Frame
pdecon = Deconstruct(Point=evalsrf.Point)  # -> XComponent, YComponent, ZComponent
sort_2 = SortList(Keys=flatten(pdecon.ZComponent), ValuesA=flatten(shrinktrimsrf.Shrunken))  # -> Keys, ValuesA

divide = DivideDomain²(Domain=sort_2.ValuesA, UCount=Slider(3, range=0..10), VCount=number_slider_2)  # -> simplify(Segments)
subsrf = Isotrim(Surface=simplify(graft(sort_2.ValuesA)), Domain=divide)  # -> reparameterize(Surface)
evalsrf_2 = EvaluateSurface(Surface=simplify(subsrf), Point=md_slider)  # -> Point, Normal, UDirection, VDirection, Frame

# ----
# Can make 3D objects as meshes but need to somehow make seams between them
# Nice order, we can work with it
points = PointList(Points=evalsrf_2.Point)

item_5 = ListItem(List=relay, Index="2", Wrap=True)  # -> simplify(Item)
sunion_2 = SolidUnion(Breps=item_5)
number_slider_3 = Slider(0, range=0..100)
number_slider_4 = Slider(4, range=0..10)
md_slider_2 = MDSlider(SliderMode=0, slider_value=Point(0.5, 0.5, 0.5), x_domain=Domain(0, 1), y_domain=Domain(0, 1), z_domain=Domain(0, 1))

bbox_2 = BoundingBox(Content=item_5, Plane=PlaneXY(0, 0, 0))  # -> Box, Box_2
debox_2 = DeconstructBox(Box=bbox_2.Box)  # -> Plane, X, Y, Z
dedomain_2 = DeconstructDomain(Domain=debox_2.Z)  # -> Start, End
rebuildsrf_2 = RebuildSurface(Surface=item_5, UDegree=3, VDegree=3, UNumber=10, VNumber=number_slider_4)
dom_2 = ConstructDomain(DomainStart=dedomain_2.Start, DomainEnd=dedomain_2.End)
range_2 = Range(Domain=dom_2, Steps=Slider(5, range=0..10))

# ---- group: additional plane on top
item_6 = ListItem(List=range_2, Index=0, Wrap=True)  # -> Item2, Item1, Item
subtraction_2 = Subtraction(A=item_6.Item1, B=item_6.Item2)
division_2 = Division(A=subtraction_2, B=Slider(1.5, range=0..10))
addition_2 = Addition(A=item_6.Item2, B=division_2)
merge_3 = Merge(Data1=range_2, Data2=addition_2)
sort_3 = SortList(Keys=merge_3, ValuesA=merge_3)  # -> Keys, ValuesA

# ----
pt_2 = ConstructPoint(XCoordinate=0, YCoordinate=0, ZCoordinate=sort_3.ValuesA)
xy_2 = XYPlane(Origin=pt_2)
sec_2 = BrepPlane(Brep=item_5, Plane=xy_2)  # -> flatten(Curves), Points
srfsplit_2 = SurfaceSplit(Surface=item_5, Curves=flatten(sec_2.Curves))  # -> reparameterize(Fragments)
shrinktrimsrf_2 = ShrinkTrimmedSurface(Surface=srfsplit_2)  # -> Shrunken, reparameterize(Underlying), R
evalsrf_3 = EvaluateSurface(Surface=simplify(shrinktrimsrf_2.Underlying), Point=md_slider_2)  # -> Point, Normal, UDirection, VDirection, Frame
pdecon_2 = Deconstruct(Point=evalsrf_3.Point)  # -> XComponent, YComponent, ZComponent
sort_4 = SortList(Keys=flatten(pdecon_2.ZComponent), ValuesA=flatten(shrinktrimsrf_2.Shrunken))  # -> Keys, ValuesA

divide_2 = DivideDomain²(Domain=sort_4.ValuesA, UCount=Slider(3, range=0..10), VCount=number_slider_4)  # -> simplify(Segments)
subsrf_2 = Isotrim(Surface=simplify(graft(sort_4.ValuesA)), Domain=divide_2)  # -> reparameterize(Surface)
evalsrf_4 = EvaluateSurface(Surface=simplify(subsrf_2), Point=md_slider_2)  # -> Point, Normal, UDirection, VDirection, Frame

# ----
# Nice order, we can work with it
points_2 = PointList(Points=evalsrf_4.Point)

item_7 = ListItem(List=relay, Index="1", Wrap=True)  # -> simplify(Item)
sunion_3 = SolidUnion(Breps=item_7)
number_slider_5 = Slider(0, range=0..100)
number_slider_6 = Slider(4, range=0..10)
md_slider_3 = MDSlider(SliderMode=0, slider_value=Point(0.5, 0.5, 0.5), x_domain=Domain(0, 1), y_domain=Domain(0, 1), z_domain=Domain(0, 1))

bbox_3 = BoundingBox(Content=item_7, Plane=PlaneXY(0, 0, 0))  # -> Box, Box_2
debox_3 = DeconstructBox(Box=bbox_3.Box)  # -> Plane, X, Y, Z
dedomain_3 = DeconstructDomain(Domain=debox_3.Z)  # -> Start, End
rebuildsrf_3 = RebuildSurface(Surface=item_7, UDegree=3, VDegree=3, UNumber=10, VNumber=number_slider_6)
dom_3 = ConstructDomain(DomainStart=dedomain_3.Start, DomainEnd=dedomain_3.End)
range_3 = Range(Domain=dom_3, Steps=Slider(5, range=0..10))

# ---- group: additional plane on top
item_8 = ListItem(List=range_3, Index=0, Wrap=True)  # -> Item2, Item1, Item
subtraction_3 = Subtraction(A=item_8.Item1, B=item_8.Item2)
division_3 = Division(A=subtraction_3, B=Slider(1.5, range=0..10))
addition_3 = Addition(A=item_8.Item2, B=division_3)
merge_4 = Merge(Data1=range_3, Data2=addition_3)
sort_5 = SortList(Keys=merge_4, ValuesA=merge_4)  # -> Keys, ValuesA

# ----
pt_3 = ConstructPoint(XCoordinate=0, YCoordinate=0, ZCoordinate=sort_5.ValuesA)
xy_3 = XYPlane(Origin=pt_3)
sec_3 = BrepPlane(Brep=item_7, Plane=xy_3)  # -> flatten(Curves), Points
srfsplit_3 = SurfaceSplit(Surface=item_7, Curves=flatten(sec_3.Curves))  # -> reparameterize(Fragments)
shrinktrimsrf_3 = ShrinkTrimmedSurface(Surface=srfsplit_3)  # -> Shrunken, reparameterize(Underlying), R
evalsrf_5 = EvaluateSurface(Surface=simplify(shrinktrimsrf_3.Underlying), Point=md_slider_3)  # -> Point, Normal, UDirection, VDirection, Frame
pdecon_3 = Deconstruct(Point=evalsrf_5.Point)  # -> XComponent, YComponent, ZComponent
sort_6 = SortList(Keys=flatten(pdecon_3.ZComponent), ValuesA=flatten(shrinktrimsrf_3.Shrunken))  # -> Keys, ValuesA

divide_3 = DivideDomain²(Domain=sort_6.ValuesA, UCount=Slider(3, range=0..10), VCount=number_slider_6)  # -> simplify(Segments)
subsrf_3 = Isotrim(Surface=simplify(graft(sort_6.ValuesA)), Domain=divide_3)  # -> reparameterize(Surface)
evalsrf_6 = EvaluateSurface(Surface=simplify(subsrf_3), Point=md_slider_3)  # -> Point, Normal, UDirection, VDirection, Frame

# ----
# Nice order, we can work with it
points_3 = PointList(Points=evalsrf_6.Point)

item_9 = ListItem(List=dome_srf, Index="0", Wrap=True)  # -> simplify(Item)
sunion_4 = SolidUnion(Breps=item_9)
number_slider_7 = Slider(0, range=0..100)
number_slider_8 = Slider(4, range=0..10)
md_slider_4 = MDSlider(SliderMode=0, slider_value=Point(0.5, 0.5, 0.5), x_domain=Domain(0, 1), y_domain=Domain(0, 1), z_domain=Domain(0, 1))

item_10 = ListItem(List=relay, Index="0", Wrap=True)  # -> simplify(Item)
sunion_5 = SolidUnion(Breps=item_10)
# for strange faces
number_slider_9 = Slider(0, range=0..100)
number_slider_10 = Slider(4, range=0..10)
md_slider_5 = MDSlider(SliderMode=0, slider_value=Point(0.5, 0.5, 0.5), x_domain=Domain(0, 1), y_domain=Domain(0, 1), z_domain=Domain(0, 1))

item_11 = ListItem(List=relay_2, Index="2", Wrap=True)  # -> simplify(Item)
sunion_6 = SolidUnion(Breps=item_11)
number_slider_11 = Slider(0, range=0..100)
number_slider_12 = Slider(4, range=0..10)
md_slider_6 = MDSlider(SliderMode=0, slider_value=Point(0.5, 0.5, 0.5), x_domain=Domain(0, 1), y_domain=Domain(0, 1), z_domain=Domain(0, 1))

item_12 = ListItem(List=relay_2, Index="1", Wrap=True)  # -> simplify(Item)
number_slider_13 = Slider(4, range=0..10)
md_slider_7 = MDSlider(SliderMode=0, slider_value=Point(0.5, 0.5, 0.5), x_domain=Domain(0, 1), y_domain=Domain(0, 1), z_domain=Domain(0, 1))

item_13 = ListItem(List=dome_srf, Index="1", Wrap=True)  # -> simplify(Item)
sunion_7 = SolidUnion(Breps=item_13)
number_slider_14 = Slider(0, range=0..100)
number_slider_15 = Slider(4, range=0..10)
md_slider_8 = MDSlider(SliderMode=0, slider_value=Point(0.5, 0.5, 0.5), x_domain=Domain(0, 1), y_domain=Domain(0, 1), z_domain=Domain(0, 1))

item_14 = ListItem(List=dome_srf, Index="2", Wrap=True)  # -> simplify(Item)
sunion_8 = SolidUnion(Breps=item_14)
number_slider_16 = Slider(0, range=0..100)
number_slider_17 = Slider(4, range=0..10)
md_slider_9 = MDSlider(SliderMode=0, slider_value=Point(0.5, 0.5, 0.5), x_domain=Domain(0, 1), y_domain=Domain(0, 1), z_domain=Domain(0, 1))

bbox_4 = BoundingBox(Content=item_14, Plane=PlaneXY(0, 0, 0))  # -> Box, Box_2
debox_4 = DeconstructBox(Box=bbox_4.Box)  # -> Plane, X, Y, Z
dedomain_4 = DeconstructDomain(Domain=debox_4.Z)  # -> Start, End
rebuildsrf_4 = RebuildSurface(Surface=item_14, UDegree=3, VDegree=3, UNumber=10, VNumber=number_slider_17)
dom_4 = ConstructDomain(DomainStart=dedomain_4.Start, DomainEnd=dedomain_4.End)
range_4 = Range(Domain=dom_4, Steps=Slider(5, range=0..10))

# ---- group: additional plane on top
item_15 = ListItem(List=range_4, Index=0, Wrap=True)  # -> Item2, Item1, Item
subtraction_4 = Subtraction(A=item_15.Item1, B=item_15.Item2)
division_4 = Division(A=subtraction_4, B=Slider(1.5, range=0..10))
addition_4 = Addition(A=item_15.Item2, B=division_4)
merge_5 = Merge(Data1=range_4, Data2=addition_4)
sort_7 = SortList(Keys=merge_5, ValuesA=merge_5)  # -> Keys, ValuesA

# ----
pt_4 = ConstructPoint(XCoordinate=0, YCoordinate=0, ZCoordinate=sort_7.ValuesA)
xy_4 = XYPlane(Origin=pt_4)
sec_4 = BrepPlane(Brep=item_14, Plane=xy_4)  # -> flatten(Curves), Points
srfsplit_4 = SurfaceSplit(Surface=item_14, Curves=flatten(sec_4.Curves))  # -> reparameterize(Fragments)
shrinktrimsrf_4 = ShrinkTrimmedSurface(Surface=srfsplit_4)  # -> Shrunken, reparameterize(Underlying), R
evalsrf_7 = EvaluateSurface(Surface=simplify(shrinktrimsrf_4.Underlying), Point=md_slider_9)  # -> Point, Normal, UDirection, VDirection, Frame
pdecon_4 = Deconstruct(Point=evalsrf_7.Point)  # -> XComponent, YComponent, ZComponent
sort_8 = SortList(Keys=flatten(pdecon_4.ZComponent), ValuesA=flatten(shrinktrimsrf_4.Shrunken))  # -> Keys, ValuesA

divide_4 = DivideDomain²(Domain=sort_8.ValuesA, UCount=Slider(1, range=0..10), VCount=number_slider_17)  # -> simplify(Segments)
subsrf_4 = Isotrim(Surface=simplify(graft(sort_8.ValuesA)), Domain=divide_4)  # -> reparameterize(Surface)
evalsrf_8 = EvaluateSurface(Surface=simplify(subsrf_4), Point=md_slider_9)  # -> Point, Normal, UDirection, VDirection, Frame

# ----
# Nice order, we can work with it
points_4 = PointList(Points=evalsrf_8.Point)

# ----
# Surface experiments
bbox_5 = BoundingBox(Content=item_12, Plane=PlaneXY(0, 0, 0))  # -> Box, Box_2
debox_5 = DeconstructBox(Box=bbox_5.Box)  # -> Plane, X, Y, Z
dedomain_5 = DeconstructDomain(Domain=debox_5.Z)  # -> Start, End
rebuildsrf_5 = RebuildSurface(Surface=item_12, UDegree=3, VDegree=3, UNumber=10, VNumber=number_slider_13)
dom_5 = ConstructDomain(DomainStart=dedomain_5.Start, DomainEnd=dedomain_5.End)
range_5 = Range(Domain=dom_5, Steps=Slider(5, range=0..10))

# ---- group: additional plane on top
item_16 = ListItem(List=range_5, Index=0, Wrap=True)  # -> Item2, Item1, Item
subtraction_5 = Subtraction(A=item_16.Item1, B=item_16.Item2)
division_5 = Division(A=subtraction_5, B=Slider(1.5, range=0..10))
addition_5 = Addition(A=item_16.Item2, B=division_5)
merge_6 = Merge(Data1=range_5, Data2=addition_5)
sort_9 = SortList(Keys=merge_6, ValuesA=merge_6)  # -> Keys, ValuesA

# ----
pt_5 = ConstructPoint(XCoordinate=0, YCoordinate=0, ZCoordinate=sort_9.ValuesA)
xy_5 = XYPlane(Origin=pt_5)
sec_5 = BrepPlane(Brep=item_12, Plane=xy_5)  # -> flatten(Curves), Points
srfsplit_5 = SurfaceSplit(Surface=item_12, Curves=flatten(sec_5.Curves))  # -> reparameterize(Fragments)
shrinktrimsrf_5 = ShrinkTrimmedSurface(Surface=srfsplit_5)  # -> Shrunken, reparameterize(Underlying), R
evalsrf_9 = EvaluateSurface(Surface=simplify(shrinktrimsrf_5.Underlying), Point=md_slider_7)  # -> Point, Normal, UDirection, VDirection, Frame
pdecon_5 = Deconstruct(Point=evalsrf_9.Point)  # -> XComponent, YComponent, ZComponent
sort_10 = SortList(Keys=flatten(pdecon_5.ZComponent), ValuesA=flatten(shrinktrimsrf_5.Shrunken))  # -> Keys, ValuesA

divide_5 = DivideDomain²(Domain=sort_10.ValuesA, UCount=Slider(3, range=0..10), VCount=number_slider_13)  # -> simplify(Segments)
subsrf_5 = Isotrim(Surface=simplify(graft(sort_10.ValuesA)), Domain=divide_5)  # -> reparameterize(Surface)
evalsrf_10 = EvaluateSurface(Surface=simplify(subsrf_5), Point=md_slider_7)  # -> Point, Normal, UDirection, VDirection, Frame

# ----
# Nice order, we can work with it
points_5 = PointList(Points=evalsrf_10.Point)

# ----
# Surface experiments
bbox_6 = BoundingBox(Content=item_10, Plane=PlaneXY(0, 0, 0))  # -> Box, Box_2
debox_6 = DeconstructBox(Box=bbox_6.Box)  # -> Plane, X, Y, Z
dedomain_6 = DeconstructDomain(Domain=debox_6.Z)  # -> Start, End
rebuildsrf_6 = RebuildSurface(Surface=item_10, UDegree=3, VDegree=3, UNumber=10, VNumber=number_slider_10)
dom_6 = ConstructDomain(DomainStart=dedomain_6.Start, DomainEnd=dedomain_6.End)
range_6 = Range(Domain=dom_6, Steps=Slider(5, range=0..10))

# ---- group: additional plane on top
item_17 = ListItem(List=range_6, Index=0, Wrap=True)  # -> Item2, Item1, Item
subtraction_6 = Subtraction(A=item_17.Item1, B=item_17.Item2)
division_6 = Division(A=subtraction_6, B=Slider(1.5, range=0..10))
addition_6 = Addition(A=item_17.Item2, B=division_6)
merge_7 = Merge(Data1=range_6, Data2=addition_6)
sort_11 = SortList(Keys=merge_7, ValuesA=merge_7)  # -> Keys, ValuesA

# ----
pt_6 = ConstructPoint(XCoordinate=0, YCoordinate=0, ZCoordinate=sort_11.ValuesA)
xy_6 = XYPlane(Origin=pt_6)
sec_6 = BrepPlane(Brep=item_10, Plane=xy_6)  # -> flatten(Curves), Points
srfsplit_6 = SurfaceSplit(Surface=item_10, Curves=flatten(sec_6.Curves))  # -> reparameterize(Fragments)
shrinktrimsrf_6 = ShrinkTrimmedSurface(Surface=srfsplit_6)  # -> Shrunken, reparameterize(Underlying), R
evalsrf_11 = EvaluateSurface(Surface=simplify(shrinktrimsrf_6.Underlying), Point=md_slider_5)  # -> Point, Normal, UDirection, VDirection, Frame
pdecon_6 = Deconstruct(Point=evalsrf_11.Point)  # -> XComponent, YComponent, ZComponent
sort_12 = SortList(Keys=flatten(pdecon_6.ZComponent), ValuesA=flatten(shrinktrimsrf_6.Shrunken))  # -> Keys, ValuesA

divide_6 = DivideDomain²(Domain=sort_12.ValuesA, UCount=Slider(3, range=0..10), VCount=number_slider_10)  # -> simplify(Segments)
subsrf_6 = Isotrim(Surface=simplify(graft(sort_12.ValuesA)), Domain=divide_6)  # -> reparameterize(Surface)
evalsrf_12 = EvaluateSurface(Surface=simplify(subsrf_6), Point=md_slider_5)  # -> Point, Normal, UDirection, VDirection, Frame

# ----
# Nice order, we can work with it
points_6 = PointList(Points=evalsrf_12.Point)

# ----
# Surface experiments
bbox_7 = BoundingBox(Content=item_9, Plane=PlaneXY(0, 0, 0))  # -> Box, Box_2
debox_7 = DeconstructBox(Box=bbox_7.Box)  # -> Plane, X, Y, Z
dedomain_7 = DeconstructDomain(Domain=debox_7.Z)  # -> Start, End
rebuildsrf_7 = RebuildSurface(Surface=item_9, UDegree=3, VDegree=3, UNumber=10, VNumber=number_slider_8)
dom_7 = ConstructDomain(DomainStart=dedomain_7.Start, DomainEnd=dedomain_7.End)
range_7 = Range(Domain=dom_7, Steps=Slider(5, range=0..10))

# ---- group: additional plane on top
item_18 = ListItem(List=range_7, Index=0, Wrap=True)  # -> Item2, Item1, Item
subtraction_7 = Subtraction(A=item_18.Item1, B=item_18.Item2)
division_7 = Division(A=subtraction_7, B=Slider(1.5, range=0..10))
addition_7 = Addition(A=item_18.Item2, B=division_7)
merge_8 = Merge(Data1=range_7, Data2=addition_7)
sort_13 = SortList(Keys=merge_8, ValuesA=merge_8)  # -> Keys, ValuesA

# ----
pt_7 = ConstructPoint(XCoordinate=0, YCoordinate=0, ZCoordinate=sort_13.ValuesA)
xy_7 = XYPlane(Origin=pt_7)
sec_7 = BrepPlane(Brep=item_9, Plane=xy_7)  # -> flatten(Curves), Points
srfsplit_7 = SurfaceSplit(Surface=item_9, Curves=flatten(sec_7.Curves))  # -> reparameterize(Fragments)
shrinktrimsrf_7 = ShrinkTrimmedSurface(Surface=srfsplit_7)  # -> Shrunken, reparameterize(Underlying), R
evalsrf_13 = EvaluateSurface(Surface=simplify(shrinktrimsrf_7.Underlying), Point=md_slider_4)  # -> Point, Normal, UDirection, VDirection, Frame
pdecon_7 = Deconstruct(Point=evalsrf_13.Point)  # -> XComponent, YComponent, ZComponent
sort_14 = SortList(Keys=flatten(pdecon_7.ZComponent), ValuesA=flatten(shrinktrimsrf_7.Shrunken))  # -> Keys, ValuesA

divide_7 = DivideDomain²(Domain=sort_14.ValuesA, UCount=Slider(1, range=0..10), VCount=number_slider_8)  # -> simplify(Segments)
subsrf_7 = Isotrim(Surface=simplify(graft(sort_14.ValuesA)), Domain=divide_7)  # -> reparameterize(Surface)
evalsrf_14 = EvaluateSurface(Surface=simplify(subsrf_7), Point=md_slider_4)  # -> Point, Normal, UDirection, VDirection, Frame

# ----
# Nice order, we can work with it
points_7 = PointList(Points=evalsrf_14.Point)

# ----
# Surface experiments
bbox_8 = BoundingBox(Content=item_11, Plane=PlaneXY(0, 0, 0))  # -> Box, Box_2
debox_8 = DeconstructBox(Box=bbox_8.Box)  # -> Plane, X, Y, Z
dedomain_8 = DeconstructDomain(Domain=debox_8.Z)  # -> Start, End
# for strange faces
rebuildsrf_8 = RebuildSurface(Surface=item_11, UDegree=3, VDegree=3, UNumber=10, VNumber=number_slider_12)
dom_8 = ConstructDomain(DomainStart=dedomain_8.Start, DomainEnd=dedomain_8.End)
range_8 = Range(Domain=dom_8, Steps=Slider(5, range=0..10))

# ---- group: additional plane on top
item_19 = ListItem(List=range_8, Index=0, Wrap=True)  # -> Item2, Item1, Item
subtraction_8 = Subtraction(A=item_19.Item1, B=item_19.Item2)
division_8 = Division(A=subtraction_8, B=Slider(1.5, range=0..10))
addition_8 = Addition(A=item_19.Item2, B=division_8)
merge_9 = Merge(Data1=range_8, Data2=addition_8)
sort_15 = SortList(Keys=merge_9, ValuesA=merge_9)  # -> Keys, ValuesA

# ----
pt_8 = ConstructPoint(XCoordinate=0, YCoordinate=0, ZCoordinate=sort_15.ValuesA)
xy_8 = XYPlane(Origin=pt_8)
sec_8 = BrepPlane(Brep=item_11, Plane=xy_8)  # -> flatten(Curves), Points
srfsplit_8 = SurfaceSplit(Surface=item_11, Curves=flatten(sec_8.Curves))  # -> reparameterize(Fragments)
shrinktrimsrf_8 = ShrinkTrimmedSurface(Surface=srfsplit_8)  # -> Shrunken, reparameterize(Underlying), R
evalsrf_15 = EvaluateSurface(Surface=simplify(shrinktrimsrf_8.Underlying), Point=md_slider_6)  # -> Point, Normal, UDirection, VDirection, Frame
pdecon_8 = Deconstruct(Point=evalsrf_15.Point)  # -> XComponent, YComponent, ZComponent
sort_16 = SortList(Keys=flatten(pdecon_8.ZComponent), ValuesA=flatten(shrinktrimsrf_8.Shrunken))  # -> Keys, ValuesA

divide_8 = DivideDomain²(Domain=sort_16.ValuesA, UCount=Slider(3, range=0..10), VCount=number_slider_12)  # -> simplify(Segments)
subsrf_8 = Isotrim(Surface=simplify(graft(sort_16.ValuesA)), Domain=divide_8)  # -> reparameterize(Surface)
evalsrf_16 = EvaluateSurface(Surface=simplify(subsrf_8), Point=md_slider_6)  # -> Point, Normal, UDirection, VDirection, Frame

# ----
# Nice order, we can work with it
points_8 = PointList(Points=evalsrf_16.Point)

# ----
# Surface experiments
bbox_9 = BoundingBox(Content=item_13, Plane=PlaneXY(0, 0, 0))  # -> Box, Box_2
debox_9 = DeconstructBox(Box=bbox_9.Box)  # -> Plane, X, Y, Z
dedomain_9 = DeconstructDomain(Domain=debox_9.Z)  # -> Start, End
rebuildsrf_9 = RebuildSurface(Surface=item_13, UDegree=3, VDegree=3, UNumber=10, VNumber=number_slider_15)
dom_9 = ConstructDomain(DomainStart=dedomain_9.Start, DomainEnd=dedomain_9.End)
range_9 = Range(Domain=dom_9, Steps=Slider(5, range=0..10))

# ---- group: additional plane on top
item_20 = ListItem(List=range_9, Index=0, Wrap=True)  # -> Item2, Item1, Item
subtraction_9 = Subtraction(A=item_20.Item1, B=item_20.Item2)
division_9 = Division(A=subtraction_9, B=Slider(1.5, range=0..10))
addition_9 = Addition(A=item_20.Item2, B=division_9)
merge_10 = Merge(Data1=range_9, Data2=addition_9)
sort_17 = SortList(Keys=merge_10, ValuesA=merge_10)  # -> Keys, ValuesA

# ----
pt_9 = ConstructPoint(XCoordinate=0, YCoordinate=0, ZCoordinate=sort_17.ValuesA)
xy_9 = XYPlane(Origin=pt_9)
sec_9 = BrepPlane(Brep=item_13, Plane=xy_9)  # -> flatten(Curves), Points
srfsplit_9 = SurfaceSplit(Surface=item_13, Curves=flatten(sec_9.Curves))  # -> reparameterize(Fragments)
shrinktrimsrf_9 = ShrinkTrimmedSurface(Surface=srfsplit_9)  # -> Shrunken, reparameterize(Underlying), R
evalsrf_17 = EvaluateSurface(Surface=simplify(shrinktrimsrf_9.Underlying), Point=md_slider_8)  # -> Point, Normal, UDirection, VDirection, Frame
pdecon_9 = Deconstruct(Point=evalsrf_17.Point)  # -> XComponent, YComponent, ZComponent
sort_18 = SortList(Keys=flatten(pdecon_9.ZComponent), ValuesA=flatten(shrinktrimsrf_9.Shrunken))  # -> Keys, ValuesA

divide_9 = DivideDomain²(Domain=sort_18.ValuesA, UCount=Slider(1, range=0..10), VCount=number_slider_15)  # -> simplify(Segments)
subsrf_9 = Isotrim(Surface=simplify(graft(sort_18.ValuesA)), Domain=divide_9)  # -> reparameterize(Surface)
evalsrf_18 = EvaluateSurface(Surface=simplify(subsrf_9), Point=md_slider_8)  # -> Point, Normal, UDirection, VDirection, Frame

# ----
# Nice order, we can work with it
points_9 = PointList(Points=evalsrf_18.Point)

merge_11 = Merge(
    Data1=subsrf,
    Data2=subsrf_5,
    Data3=subsrf_8,
    Data4=subsrf_6,
    Data5=subsrf_3,
    Data6=subsrf_2,
    Data7=subsrf_7,
    Data8=subsrf_9,
    Data9=subsrf_4)

smesh = SimpleMesh(Brep=merge_11)

# ---- group: join the top mesh into two
tstat = TreeStatistics(Tree=smesh)  # -> Paths, Length, Count
lng = ListLength(List=tstat.Paths)  # -> expr("x-1", Length)
item_21 = ListItem(List=tstat.Paths, Index=0, Wrap=True)  # -> Item1, Item
split = SplitList(List=tstat.Paths, Index=lng)  # -> ListA, ListB
branch = TreeBranch(Tree=smesh, Path=item_21.Item1, MaintainPaths=True)
branch_2 = TreeBranch(Tree=smesh, Path=split.ListA, MaintainPaths=True)
mjoin = MeshJoin(Meshes=branch)
alignvert = AlignVertices(Mesh=mjoin, Tolerance=Slider(0.4, range=0..1))  # -> Result, Count

# ----
merge_12 = Merge(Data1=branch_2, Data2=alignvert.Result)
m_i_wp = IWP(G0=merge_12, T0=0.5, T1=0.5, D=Slider(0.1, range=0..0.1), C=True, R=False)  # -> out, A; inputs G0: GeometryBase, G1: GeometryBase, I: list, T0: list, T1: list, clr: list of Color
# ---------- m_i_wp: VB usings ----------
Imports System.IO
Imports System.Linq
Imports System.Data
Imports System.Drawing
Imports System.Reflection
Imports System.Windows.Forms
Imports System.Xml
Imports System.Xml.Linq
Imports Microsoft.VisualBasic
Imports System.Runtime.InteropServices

Imports Rhino.DocObjects
Imports Rhino.Collections
Imports GH_IO
Imports GH_IO.Serialization
# ---------- m_i_wp: VB ----------
    Component.Params.Input(0).Name = "Mesh or Curve"
    Component.Params.Input(0).Description = "Open or closed mesh or curve"
    Component.Params.Input(1).Name = "Mesh or Curve"
    Component.Params.Input(1).Description = "Optional open or closed mesh or curve whose type should correspond to G0."
    Component.Params.Input(2).Name = "Index [Face]"
    Component.Params.Input(2).Description = "An optional integer or list of integers which specify the faces to be modified if the input is a mesh. If no value is supplied then all faces will be modified"
    Component.Params.Input(3).Name = "To Volume [Vertex]"
    Component.Params.Input(3).Description = "Evaluates a new vertex between the input geometry's vertex and edge midpoint to the face center"
    Component.Params.Input(4).Name = "To Face [Vertex]"
    Component.Params.Input(4).Description = "Evaluates a new vertex between the input geometry's vertex and edge midpoint to the volumetric center"
    Component.Params.Input(5).Name = "Distance"
    Component.Params.Input(5).Description = "An optional number to add depth if no input is provided for G1"
    Component.Params.Input(6).Name = "Close"
    Component.Params.Input(6).Description = "If true then additional faces and if needed vertices will be added to the mesh, closing the solid"
    Component.Params.Input(7).Name = "Invert"
    Component.Params.Input(7).Description = "If true the faces the close the mesh are reversed, flipping the solid/ void relationship"
    Component.Params.Input(8).Name = "Color [Vertex]"
    Component.Params.Input(8).Description = "(If applied to a mesh a list of colors corresponding to each mesh face, if applied to a curve, a list of colors corresponding to each control point plus an additonal color value for the new averaged center"

    Component.Params.Output(1).Name = "Mesh"
    Component.Params.Output(1).Description = "If successful, a valid mesh"

    If G0 IsNot Nothing Then

      Dim bG,bM, bP,bmC,biC As Boolean

      bM = G0.ObjectType = ObjectType.Mesh
      bP = G0.ObjectType = ObjectType.Curve

      bG = (bM Or bP)
      If G1 IsNot Nothing Then
        If bM And G1.ObjectType <> ObjectType.Mesh Then bG = False
        If bP And G1.ObjectType <> ObjectType.Curve Then bG = False
      End If

      If bG Then
        Dim msh,msha,mshe As New mesh
        Dim crv,crva As curve
        Dim av(2) As point3d
        Dim ac(2),ax(1) As color
        Dim h,j,jj,k,u,v,ua,ub,va,vb,w As Integer
        Dim cv,cf,ce,dcv As Integer
        Dim x(),y() As Integer
        Dim bnk() As Boolean = Nothing

        Dim mv,fv,cfv,ep,tv,ecv,np As New list(Of Point3d)
        Dim mev,mvv As New dictionary(Of String, Integer)
        Dim mf As Rhino.Geometry.Collections.MeshFaceList = Nothing
        Dim mtv As Rhino.Geometry.Collections.MeshTopologyVertexList = Nothing
        Dim mte As Rhino.Geometry.Collections.MeshTopologyEdgeList = Nothing
        Dim ev As New list(Of vector3d)
        Dim ed As New list(Of Double)
        Dim en As New list(Of Boolean)
        Dim mc,ec,tc,cc,ccc,fc,ecc,nc As New list(Of color)
        Dim xf As New list(Of meshface)
        Dim o As Boolean = True

        If clr.count() = 0 Then clr.add(color.LightGray) Else biC = True

        If bm Then
          'Start Deconstruct if Mesh
          msh = G0

          mshe = msh.Duplicate()
          mte = mshe.TopologyEdges()
          mtv = mshe.TopologyVertices()
          mf = mshe.Faces()

          bnk = mshe.GetNakedEdgePointStatus()

          If G1 IsNot Nothing Then
            msha = G1
            If msh.Vertices.Count() <> msha.vertices.count() Then Exit Sub
          Else
            msha = msh.Offset(-d)
          End If

          msh.Append(msha)

          If i.count() = 0 Then I = Enumerable.Range(0, mf.Count()).ToList()
          mv = msh.Vertices().ToPoint3dArray().tolist()
          cf = I.Count()

          'Assign Colors
          If mshe.VertexColors.Count() < 1 Then
            mshe.VertexColors.CreateMonotoneMesh(color.LightGray)
            bmC = biC
          Else
            bmC = True
          End If

          If msha.VertexColors.Count() > 0 Then bmC = True
          mc = mshe.VertexColors().ToArray().ToList()
          If msha.VertexColors.count() < 1 Then mc.addrange(mc) Else mc.addrange(msha.VertexColors().ToArray().ToList())
        Else
          'Start Deconstruct if Curve
          crv = G0

          I.clear()
          I.add(0)
          Dim nbc As nurbscurve
          Dim pc As polyline
          Dim nps As Rhino.Geometry.Collections.NurbsCurvePointList

          nbc = crv.ToNurbsCurve()
          nps = nbc.Points
          pc = nbc.Points.ControlPolygon
          If (Not pc.IsClosed) Then pc.add(pc(0))
          av(0) = pc.CenterPoint

          msh.Vertices.AddVertices(pc.ToArray())
          msh.faces.addfaces(pc.TriangulateClosedPolyline())
          msh.Vertices.Remove(pc.count() - 1, True)

          mv = msh.Vertices.ToPoint3dArray().tolist()
          mte = msh.TopologyEdges()
          mtv = msh.TopologyVertices()

          ReDim bnk(mv.count() - 1)
          For j = 0 To mv.count() - 1 Step 1
            bnk(j) = True
          Next

          'Assign Colors
          If bic Then bmC = True

          If G1 IsNot Nothing Then
            crva = G1
            nbc = crva.ToNurbsCurve()
            nps = nbc.Points
            pc = nbc.Points.ControlPolygon
            If (Not pc.IsClosed) Then pc.add(pc(0))
            av(1) = pc.CenterPoint
            pc.RemoveAt(pc.count() - 1)

            If pc.count() <> mv.count() Then Exit Sub

            cf = 1
            mv.addrange(pc)
          Else
            Dim tcpt As point3d
            msh.Normals.ComputeNormals()
            msh.Normals.UnitizeNormals()
            k = mv.count()
            For j = 0 To k - 1 Step 1
              mv.add(mv.item(j) + msh.Normals(j) * d)
              tcpt += mv.item(j) + msh.Normals(j) * d
            Next

            If cv > 4 Then o = False
            cf = 1
            av(1) = tcpt / k
          End If

        End If
        ce = mte.count()
        cv = mv.count() / 2
        dcv = mv.count()

        x = appendprepend(cv - 1)
        'Match variables and colors to vertex count
        If (T0.count()) < cv Then T0 = dblDList(matchDbl(T0, cv)) Else If (T0.count()) = cv Then T0.addrange(T0) Else If (T0.count()) < dcv Then T0 = matchDbl(T0, dcv)
        If (T1.count()) < cv Then T1 = dblDList(matchDbl(T1, cv)) Else If (T1.count()) = cv Then T1.addrange(T1) Else If (T1.count()) < dcv Then T1 = matchDbl(T1, dcv)
        If (clr.count()) < cv Then clr = dblCList(matchClr(clr, cv)) Else If (clr.count()) = cv Then clr.addrange(clr)Else If (clr.count()) < dcv Then clr = matchClr(clr, dcv)

        If bp Then
          mc = clr
          ac = colorCap(mc)
        End If

        'Edge based vertices
        k = 0
        Dim cpt As point3d
        Dim ccl As color
        Dim bce As Boolean

        jj = 0
        For j = 0 To ce - 1 Step 1
          If (bm Or (bp And (mte.GetConnectedFaces(j).Count() < 2))) Then
            ua = mtv.MeshVertexIndices(mte.GetTopologyVertices(j).I)(0)
            va = mtv.MeshVertexIndices(mte.GetTopologyVertices(j).J)(0)

            ub = ua + cv
            vb = va + cv

            cpt = (mv(ua) + mv(va) + mv(ub) + mv(vb)) / 4
            ccl = avg4Clr(mc(ua), mc(va), mc(ub), mc(vb))
            bce = mte.GetConnectedFaces(j).count() <> 2

            If c Then
              If r Then
                ecv.add(evalP(mv(ua), mv(va), 0.5))
                ecc.add(evalC(mc(ua), mc(va), 0.5))
                mev.add(ua & "," & va & "," & 3, jj)
                mev.add(va & "," & ua & "," & 3, jj)

                ecv.add(evalP(mv(ub), mv(vb), 0.5))
                ecc.add(evalC(mc(ub), mc(vb), 0.5))
                mev.add(ub & "," & vb & "," & 3, jj + 1)
                mev.add(vb & "," & ub & "," & 3, jj + 1)
                jj += 2
              Else
                If bce Then
                  ecv.add(cpt)
                  ecc.add(ccl)
                  mev.add(ua & "," & va & "," & 3, jj)
                  mev.add(va & "," & ua & "," & 3, jj)
                  jj += 1
                End If
              End If
            End If

            'To the Face Center
            ep.add(evalP(mv(ua), cpt, t0(ua)))
            ec.add(evalC(mc(ua), ccl, t0(ua)))
            en.add(bce)
            mev.add(ua & "," & va & "," & 0, k)

            ep.add(evalP(mv(va), cpt, t0(va)))
            ec.add(evalC(mc(va), ccl, t0(va)))
            en.add(bce)
            mev.add(va & "," & ua & "," & 0, k + 1)

            ep.add(evalP(mv(ub), cpt, t0(ub)))
            ec.add(evalC(mc(ub), ccl, t0(ub)))
            en.add(bce)
            mev.add(ub & "," & vb & "," & 0, k + 2)

            ep.add(evalP(mv(vb), cpt, t0(vb)))
            ec.add(evalC(mc(vb), ccl, t0(vb)))
            en.add(bce)
            mev.add(vb & "," & ub & "," & 0, k + 3)

            'To the Edge Midpoint
            ep.add(evalP(mv(ua), mv(va), t0(ua) / 2))
            ec.add(evalC(mc(ua), mc(va), t0(ua) / 2))
            en.add(bce)
            mev.add(ua & "," & va & "," & 1, k + 4)

            ep.add(evalP(mv(va), mv(ua), t0(va) / 2))
            ec.add(evalC(mc(va), mc(ua), t0(va) / 2))
            en.add(bce)
            mev.add(va & "," & ua & "," & 1, k + 5)

            ep.add(evalP(mv(ub), mv(vb), t0(ub) / 2))
            ec.add(evalC(mc(ub), mc(vb), t0(ub) / 2))
            en.add(bce)
            mev.add(ub & "," & vb & "," & 1, k + 6)

            ep.add(evalP(mv(vb), mv(ub), t0(vb) / 2))
            ec.add(evalC(mc(vb), mc(ub), t0(vb) / 2))
            en.add(bce)
            mev.add(vb & "," & ub & "," & 1, k + 7)

            k += 8
          End If
        Next

        k = 0
        For j = 0 To (bnk.Length - 1) Step 1
          np.add(evalP(mv(j), mv(j + cv), t0(j) / 2))
          nc.add(evalC(mc(j), mc(j + cv), t0(j) / 2))
          mvv.add(j & "," & j + cv & "," & 0, k)

          np.add(evalP(mv(j + cv), mv(j), t0(j + cv) / 2))
          nc.add(evalC(mc(j + cv), mc(j), t0(j + cv) / 2))
          mvv.add(j + cv & "," & j & "," & 0, k + 1)

          k += 2
        Next

        'Face based vertices
        Dim xv(),mt(),ei(),xi() As Integer
        Dim xca(),xcb(),xta(),xtb() As color
        Dim xn(1) As Double
        ReDim ei(9)
        ReDim xi(1)
        u = 6
        v = ep.count() + np.count() + cf * 2

        If c Then
          If r Then
            If (Not o) Then v += cf * 2
          Else
            v += mv.count()
          End If
        End If

        For jj = 0 To I.count() - 1 Step 1
          Dim tcv As New point3d
          j = I(jj)
          w = v + tv.count()
          xn(0) = 0
          xn(1) = 0
          If bm Then
            If mf(j).isquad() Then h = 4 Else h = 3
            ReDim xv(h - 1)
            ReDim xca(h - 1)
            ReDim xcb(h - 1)
            ReDim xta(h - 1)
            ReDim xtb(h - 1)
            mt = mf.GetTopologicalVertices(j)
            For k = 0 To h - 1 Step 1
              xv(k) = mtv.MeshVertexIndices(mt(k))(0)
              xca(k) = mc(xv(k))
              xcb(k) = mc(xv(k) + cv)
              xta(k) = clr(xv(k))
              xtb(k) = clr(xv(k) + cv)
            Next
            av(0) = mf.GetFaceCenter(j)
            av(1) = msh.faces.GetFaceCenter(j + cf)
            ac(0) = avgClr(xca)
            ac(1) = avgClr(xcb)
            ax(0) = avgClr(xta)
            ax(1) = avgClr(xtb)
            If biC Then ac(2) = sumC(ax(0), ax(1)) Else ac(2) = sumC(ac(0), ac(1))
          Else
            h = cv
            xv = Enumerable.Range(0, h).ToArray()
          End If
          For k = 0 To h - 1 Step 1
            xn(0) += T1(xv(k))
            xn(1) += T1(xv(k) + cv)
          Next
          xn(0) /= h
          xn(1) /= h
          av(2) = (av(0) + av(1)) / 2
          y = appendprepend(h - 1)

          For k = 1 To h Step 1
            ei(0) = mev.item(xv(y(k)) & "," & xv(y(k + 1)) & "," & 0)
            ei(1) = mev.item(xv(y(k)) + cv & "," & xv(y(k + 1)) + cv & "," & 0)
            ei(2) = mev.item(xv(y(k + 1)) & "," & xv(y(k)) & "," & 0)
            ei(3) = mev.item(xv(y(k + 1)) + cv & "," & xv(y(k)) + cv & "," & 0)

            ei(4) = mev.item(xv(y(k)) & "," & xv(y(k + 1)) & "," & 1)
            ei(5) = mev.item(xv(y(k)) + cv & "," & xv(y(k + 1)) + cv & "," & 1)
            ei(6) = mev.item(xv(y(k + 1)) & "," & xv(y(k)) & "," & 1)
            ei(7) = mev.item(xv(y(k + 1)) + cv & "," & xv(y(k)) + cv & "," & 1)

            'Define new per face vertices
            tv.add(evalP(mv(xv(y(k))), av(0), t0(xv(y(k)))))
            tc.add(evalC(mc(xv(y(k))), ac(0), t0(xv(y(k)))))

            tv.add(evalP(mv(xv(y(k)) + cv), av(1), t0(xv(y(k)) + cv)))
            tc.add(evalC(mc(xv(y(k)) + cv), ac(1), t0(xv(y(k)) + cv)))

            tv.add(evalP(av(2), (mv(xv(y(k))) + mv(xv(y(k)) + cv)) / 2, (t1(xv(y(k))) + t1(xv(y(k)) + cv)) / 2))
            tc.add(evalC(ac(2), evalC(mc(xv(y(k))), mc(xv(y(k)) + cv), 0.5), (t1(xv(y(k))) + t1(xv(y(k)) + cv)) / 2))

            tv.add(evalP(av(2), (mv(xv(y(k))) + mv(xv(y(k + 1)))) / 2, (t1(xv(y(k))) + t1(xv(y(k + 1)))) / 2))
            tc.add(evalC(ac(2), evalC(mc(xv(y(k))), mc(xv(y(k + 1))), 0.5), (t1(xv(y(k))) + t1(xv(y(k + 1)))) / 2))

            tv.add(evalP(av(2), (mv(xv(y(k)) + cv) + mv(xv(y(k + 1)) + cv)) / 2, (t1(xv(y(k)) + cv) + t1(xv(y(k + 1)) + cv)) / 2))
            tc.add(evalC(ac(2), evalC(mc(xv(y(k)) + cv), mc(xv(y(k + 1)) + cv), 0.5), (t1(xv(y(k)) + cv) + t1(xv(y(k + 1)) + cv)) / 2))

            tv.add(evalP(av(2), (mv(xv(y(k)) + cv) + mv(xv(y(k + 1)) + cv) + mv(xv(y(k))) + mv(xv(y(k + 1)))) / 4, (t1(xv(y(k)) + cv) + t1(xv(y(k + 1)) + cv) + t1(xv(y(k))) + t1(xv(y(k + 1)))) / 4))
            tc.add(evalC(ac(2), avg4Clr(mc(xv(y(k))), mc(xv(y(k + 1))), mc(xv(y(k)) + cv), mc(xv(y(k + 1)) + cv)), (t1(xv(y(k)) + cv) + t1(xv(y(k + 1)) + cv) + t1(xv(y(k))) + t1(xv(y(k + 1)))) / 4))

            'Define new faces
            xf.add(New meshface(ei(0), ei(4), w + y(k) * u + 3, w + y(k) * u + 5))
            xf.add(New meshface(ei(6), ei(2), w + y(k) * u + 5, w + y(k) * u + 3))

            xf.add(New meshface(ei(4), w + y(k) * u + 0, ep.count() + np.count() + j * 2, w + y(k) * u + 3))
            xf.add(New meshface(w + y(k + 1) * u + 0, ei(6), w + y(k) * u + 3, ep.count() + np.count() + j * 2))

            xf.add(New meshface(ep.count() + xv(y(k)) * 2, ei(0), w + y(k) * u + 5, w + y(k) * u + 2))
            xf.add(New meshface(ei(2), ep.count() + xv(y(k + 1)) * 2, w + y(k + 1) * u + 2, w + y(k) * u + 5))

            xf.add(New meshface(ei(1), ep.count() + xv(y(k)) * 2 + 1, w + y(k) * u + 2, w + y(k) * u + 5))
            xf.add(New meshface(ep.count() + xv(y(k + 1)) * 2 + 1, ei(3), w + y(k) * u + 5, w + y(k + 1) * u + 2))

            xf.add(New meshface(ei(5), ei(1), w + y(k) * u + 5, w + y(k) * u + 4))
            xf.add(New meshface(ei(3), ei(7), w + y(k) * u + 4, w + y(k) * u + 5))

            xf.add(New meshface(ep.count() + np.count() + j * 2 + 1, w + y(k) * u + 1, ei(5), w + y(k) * u + 4))
            xf.add(New meshface(w + y(k + 1) * u + 1, ep.count() + np.count() + j * 2 + 1, w + y(k) * u + 4, ei(7)))

            If c Then
              If r Then
                xf.add(New meshface(ei(7), ei(5), w + y(k) * u + 1, w + y(k + 1) * u + 1))
                xf.add(New meshface(ei(4), ei(6), w + y(k + 1) * u, w + y(k) * u))

                If (Not o) Then
                  xf.add(New meshface(w + y(k) * u, w + y(k + 1) * u, v - cf * 2 + j * 2))
                  xf.add(New meshface(w + y(k + 1) * u + 1, w + y(k) * u + 1, v - cf * 2 + j * 2 + 1))
                End If

                If en.item(ei(0)) Then
                  xf.add(New meshface(ei(4), ei(0), ei(2), ei(6)))
                  xf.add(New meshface(ei(1), ei(5), ei(7), ei(3)))

                  xf.add(New meshface(ei(0), ei(1), ei(3), ei(2)))

                  xf.add(New meshface(ei(1), ei(0), ep.count() + xv(y(k)) * 2, ep.count() + xv(y(k)) * 2 + 1))
                  xf.add(New meshface(ei(2), ei(3), ep.count() + xv(y(k + 1)) * 2 + 1, ep.count() + xv(y(k + 1)) * 2))
                End If
              Else

                ei(8) = mev.item(xv(y(k)) & "," & xv(y(k - 1)) & "," & 1)
                ei(9) = mev.item(xv(y(k)) + cv & "," & xv(y(k - 1)) + cv & "," & 1)

                xf.add(New meshface(ei(8), w + y(k) * u + 0, ei(4), v - mv.count() + xv(y(k))))
                xf.add(New meshface(w + y(k) * u + 1, ei(9), v - mv.count() + xv(y(k)) + cv, ei(5)))

                If en.item(ei(0)) Then
                  xf.add(New meshface(ei(4), ei(0), ep.count() + xv(y(k)) * 2, v - mv.count() + xv(y(k))))
                  xf.add(New meshface(ei(2), ei(6), v - mv.count() + xv(y(k + 1)), ep.count() + xv(y(k + 1)) * 2))

                  xf.add(New meshface(ei(1), ei(5), v - mv.count() + xv(y(k)) + cv, ep.count() + xv(y(k)) * 2 + 1))
                  xf.add(New meshface(ep.count() + xv(y(k + 1)) * 2 + 1, v - mv.count() + xv(y(k + 1)) + cv, ei(7), ei(3)))
                End If
              End If
            End If
          Next
          fv.add(evalP(av(2), av(0), xn(0)))
          cc.add(evalC(ac(2), ac(0), xn(0)))

          fv.add(evalP(av(2), av(1), xn(1)))
          cc.add(evalC(ac(2), ac(1), xn(1)))

          If (c And r) Then

            If (Not o) Then
              cfv.add(av(0))
              ccc.add(ac(0))

              cfv.add(av(1))
              ccc.add(ac(1))
            Else
              If h = 3 Then
                xf.add(New meshface(w + 0 * u, w + 1 * u, w + 2 * u))
                xf.add(New meshface(w + 1 * u + 1, w + 0 * u + 1, w + 2 * u + 1))
              ElseIf h = 4 Then
                xf.add(New meshface(w + 0 * u, w + 1 * u, w + 2 * u, w + 3 * u))
                xf.add(New meshface(w + 1 * u + 1, w + 0 * u + 1, w + 3 * u + 1, w + 2 * u + 1))
              End If

            End If
          End If

        Next

        Dim om As New mesh
        om.Vertices.AddVertices(ep.toarray())
        If bmC Then om.VertexColors.AppendColors(ec.toarray())
        om.Vertices.AddVertices(np)
        If bmC Then om.VertexColors.AppendColors(nc.toarray())
        om.Vertices.AddVertices(fv)
        If bmC Then om.VertexColors.AppendColors(cc.toarray())

        If c Then
          If r Then
            om.Vertices.AddVertices(cfv)
            If bmC Then om.VertexColors.AppendColors(ccc.toarray())
          Else
            om.Vertices.AddVertices(mv)
            If bmC Then om.VertexColors.AppendColors(mc.toarray())
          End If
        End If

        om.Vertices.AddVertices(tv.toarray())
        If bmC Then om.VertexColors.AppendColors(tc.toarray())

        om.Faces.AddFaces(xf.toarray())

        If (c And r) Then om.Flip(True, True, True)

        'If i.count() > 0 Then om.Vertices.CullUnused()

        A = om
      End If
    End If
# ---------- m_i_wp: VB additional code ----------
  Private Function appendprepend(ByVal i As Integer)
    Dim srsEnum As IEnumerable(Of Integer) = Enumerable.Range(0, i + 1)
    Dim arrVal As New list(Of Integer)
    arrVal = srsEnum.tolist()
    arrVal.add(0)
    arrVal.insert(0, i)
    Return arrVal.toarray()
  End Function


  Private Function colorCap(ByVal c As list(Of color))
    Dim i,k As Integer
    k = c.count() / 2
    Dim r(2),g(2),b(2) As Integer
    For i = 0 To k - 1 Step 1
      r(0) += c.item(i).R
      r(1) += c.item(i + k).R
      g(0) += c.item(i).g
      g(1) += c.item(i + k).g
      b(0) += c.item(i).b
      b(1) += c.item(i + k).b
    Next

    r(0) = CInt(r(0) / k)
    r(1) = CInt(r(1) / k)
    g(0) = CInt(g(0) / k)
    g(1) = CInt(g(1) / k)
    b(0) = CInt(b(0) / k)
    b(1) = CInt(b(1) / k)

    r(2) = CInt((r(0) + r(1)) / 2)
    g(2) = CInt((g(0) + g(1)) / 2)
    b(2) = CInt((b(0) + b(1)) / 2)

    If r(0) > 255 Then r(0) = 255 Else If r(0) < 0 Then r(0) = 0
    If r(1) > 255 Then r(1) = 255 Else If r(1) < 0 Then r(1) = 0
    If g(0) > 255 Then g(0) = 255 Else If g(0) < 0 Then g(0) = 0
    If g(1) > 255 Then g(1) = 255 Else If g(1) < 0 Then g(1) = 0
    If b(0) > 255 Then b(0) = 255 Else If b(0) < 0 Then b(0) = 0
    If b(1) > 255 Then b(1) = 255 Else If b(1) < 0 Then b(1) = 0

    If r(2) > 255 Then r(2) = 255 Else If r(2) < 0 Then r(2) = 0
    If g(2) > 255 Then g(2) = 255 Else If g(2) < 0 Then g(2) = 0
    If b(2) > 255 Then b(2) = 255 Else If b(2) < 0 Then b(2) = 0

    Return {color.FromArgb(r(0), G(0), b(0)),color.FromArgb(r(1), G(1), b(1)),color.FromArgb(r(2), G(2), b(2))}
  End Function

  Private Function dblCList(ByVal a As list(Of color))
    a.addrange(a)
    Return a
  End Function

  Private Function dblDList(ByVal a As list(Of Double))
    a.addrange(a)
    Return a
  End Function

  Private Function matchDbl(ByVal a As list(Of Double), ByVal t As Integer)
    Dim i,k As Integer
    k = a.count()
    For i = 0 To ((t + 1) - k) - 1 Step 1
      a.add(a.item(k - 1))
    Next
    Return a
  End Function

  Private Function matchClr(ByVal a As list(Of Color), ByVal t As Integer)
    Dim i,k As Integer
    k = a.count()
    For i = 0 To ((t + 1) - k) - 1 Step 1
      a.add(a.item(k - 1))
    Next
    Return a
  End Function

  Private Function sumC(ByVal ca As Color, ByVal cb As Color)
    Dim r,g,b As Integer

    r = CInt((CInt(ca.R) + CInt(cb.R)) / 2)
    g = CInt((CInt(ca.g) + CInt(cb.g)) / 2)
    b = CInt((CInt(ca.b) + CInt(cb.b)) / 2)

    If r > 255 Then r = 255 Else If r < 0 Then r = 0
    If G > 255 Then G = 255 Else If G < 0 Then G = 0
    If b > 255 Then b = 255 Else If b < 0 Then b = 0

    Return color.FromArgb(r, G, b)
  End Function

  Private Function avg4Clr(ByVal ca As Color, ByVal cb As Color, ByVal cc As Color, ByVal cd As Color)
    Dim r,g,b As Integer

    r = CInt((CInt(ca.R) + CInt(cb.R) + CInt(cc.R) + CInt(cd.R)) / 4)
    g = CInt((CInt(ca.g) + CInt(cb.g) + CInt(cc.g) + CInt(cd.g)) / 4)
    b = CInt((CInt(ca.b) + CInt(cb.b) + CInt(cc.b) + CInt(cd.b)) / 4)

    If r > 255 Then r = 255 Else If r < 0 Then r = 0
    If G > 255 Then G = 255 Else If G < 0 Then G = 0
    If b > 255 Then b = 255 Else If b < 0 Then b = 0

    Return color.FromArgb(r, G, b)
  End Function

  Private Function evalP(ByVal op As point3d, ByVal tp As Point3d, ByVal t As Double)
    Return New point3d(op + (tp - op) * t)
  End Function

  Private Function evalV(ByVal ov As vector3d, ByVal tv As vector3d, ByVal t As Double)
    Return New vector3d(ov + (tv - ov) * t)
  End Function

  Private Function evalN(ByVal u As Double, ByVal v As Double, ByVal t As Double)
    Return u + (v - u) * t
  End Function

  Private Function avgVec(ByVal v() As vector3f)
    Dim i As Integer
    Dim tv As Vector3d

    For i = 0 To (v.Length - 1) Step 1
      tv += v(i)
    Next
    tv /= ((v.Length - 1) + 1)
    tv.Unitize()
    Return New vector3f(tv.X, tv.Y, tv.Z)
  End Function

  Private Function roundClr(ByVal r As Integer, ByVal G As Integer, ByVal b As Integer, ByVal i As Integer)
    r = CInt(r / i)
    G = CInt(G / i)
    b = CInt(b / i)

    If r > 255 Then r = 255 Else If r < 0 Then r = 0
    If G > 255 Then G = 255 Else If G < 0 Then G = 0
    If b > 255 Then b = 255 Else If b < 0 Then b = 0

    Return color.FromArgb(r, G, b)
  End Function

  Private Function avgClr(ByVal c() As color)
    Dim r,G,b As Integer
    Dim i,k As Integer

    k = (c.Length - 1) + 1

    For i = 0 To k - 1 Step 1
      r += CInt(c(i).R)
      G += CInt(c(i).G)
      b += CInt(c(i).B)
    Next

    r = CInt(r / k)
    G = CInt(G / k)
    b = CInt(b / k)

    If r > 255 Then r = 255 Else If r < 0 Then r = 0
    If G > 255 Then G = 255 Else If G < 0 Then G = 0
    If b > 255 Then b = 255 Else If b < 0 Then b = 0

    Return color.FromArgb(r, G, b)
  End Function

  Private Function evalC(ByVal oc As color, ByVal tc As color, ByVal t As Double)
    Dim r,G,b As Integer
    r = CInt(CInt(oc.R) + (CInt(tc.R) - CInt(oc.R)) * t)
    G = CInt(CInt(oc.G) + (CInt(tc.G) - CInt(oc.G)) * t)
    b = CInt(CInt(oc.B) + (CInt(tc.B) - CInt(oc.B)) * t)

    If r > 255 Then r = 255 Else If r < 0 Then r = 0
    If G > 255 Then G = 255 Else If G < 0 Then G = 0
    If b > 255 Then b = 255 Else If b < 0 Then b = 0

    Return color.FromArgb(r, G, b)
  End Function

  ''' <summary>
  ''' This method will be called once every solution, before any calls to RunScript.
  ''' </summary>
  Public Overrides Sub BeforeRunScript()
  End Sub
  ''' <summary>
  ''' This method will be called once every solution, after any calls to RunScript.
  ''' </summary>
  Public Overrides Sub AfterRunScript()
  End Sub
# ---------- end m_i_wp ----------
m_pinch = Pinch(G=merge_12, T0=0.25, T1=0.5, T2=1, T3=1, T4=0, D=Slider(0.2, range=0..1))  # -> out, A; inputs G: GeometryBase, I: list, T0: list, T1: list, T2: list, T3: list, T4: list, D: list, clr: list of Color
# ---------- m_pinch: VB ----------
    Component.Params.Input(0).Name = "Mesh or Curve"
    Component.Params.Input(0).Description = "Open or closed mesh or curve"
    Component.Params.Input(1).Name = "Index [Face]"
    Component.Params.Input(1).Description = "An optional integer or list of integers which specify the faces to be modified if the input is a mesh. If no value is supplied then all faces will be modified"
    Component.Params.Input(2).Name = "Vert to Face [Vertex]"
    Component.Params.Input(2).Description = "A unitized value which sets the evaluation distance from the vertex to the face center"
    Component.Params.Input(3).Name = "Edge to Face [Vertex]"
    Component.Params.Input(3).Description = "A unitized value which sets the evaluation distance from the edge midpoint to the face center"
    Component.Params.Input(4).Name = "Edge Depth [Vertex]"
    Component.Params.Input(4).Description = "A unitized value which sets the evaluation distance of the edge midpoint based depth"
    Component.Params.Input(5).Name = "Vert Depth [Vertex]"
    Component.Params.Input(5).Description = "A unitized value which sets the evaluation distance of the vertex based depth"
    Component.Params.Input(6).Name = "Closed Depth [Vertex]"
    Component.Params.Input(6).Description = "If C is true, then this unitized value will set the offset depth of the new center point relative to the face's relief depth"
    Component.Params.Input(7).Name = "Distance [Vertex]"
    Component.Params.Input(7).Description = "An optional number or list of numbers which specifies the depth of the relief from the mesh face"
    Component.Params.Input(8).Name = "Close"
    Component.Params.Input(8).Description = "If true, the relief will be closed with a new offset center vertex"
    Component.Params.Input(9).Name = "Color [Vertex]"
    Component.Params.Input(9).Description = "(If applied to a mesh a list of colors corresponding to each mesh face, if applied to a curve, a list of colors corresponding to each control point plus an additonal color value for the new averaged center"

    Component.Params.Output(1).Name = "Mesh"
    Component.Params.Output(1).Description = "If successful, a valid mesh"

    If G IsNot Nothing Then

      Dim bM, bP,bmC,biC As Boolean

      bM = g.ObjectType = ObjectType.Mesh
      bP = g.ObjectType = ObjectType.Curve

      If (bM Or bP) Then
        Dim msh As New mesh
        Dim crv As curve
        Dim av As point3d
        Dim ac As color
        Dim h,j,jj,k,u,v,w As Integer
        Dim cv,cf,ce As Integer
        Dim x(),y() As Integer

        Dim mv,fv,ep,tv As New list(Of Point3d)
        Dim mev As New dictionary(Of String, Integer)
        Dim mf As Rhino.Geometry.Collections.MeshFaceList = Nothing
        Dim mtv As Rhino.Geometry.Collections.MeshTopologyVertexList = Nothing
        Dim mte As Rhino.Geometry.Collections.MeshTopologyEdgeList = Nothing
        Dim mn As Rhino.Geometry.Collections.MeshVertexNormalList = Nothing
        Dim mfn As Rhino.Geometry.Collections.MeshFaceNormalList = Nothing
        Dim ev As New list(Of vector3d)
        Dim ed As New list(Of Double)
        Dim mc,ec,tc,cc,fc As New list(Of color)
        Dim xf As New list(Of meshface)

        If clr.count() = 0 Then clr.add(color.LightGray) Else biC = True

        If bm Then
          'Start Deconstruct if Mesh
          msh = g

          If msh.Normals.Count() = 0 Then msh.Normals.ComputeNormals()
          If msh.FaceNormals.Count() = 0 Then msh.FaceNormals.ComputeFaceNormals()

          If i.count() = 0 Then I = Enumerable.Range(0, msh.Faces.Count()).ToList()

          mv = msh.Vertices().ToPoint3dArray().tolist()
          mte = msh.TopologyEdges()
          mtv = msh.TopologyVertices()
          mf = msh.Faces()

          mn = msh.Normals()
          mn.UnitizeNormals()
          mfn = msh.FaceNormals()
          mfn.UnitizeFaceNormals()

          cf = I.Count() - 1
          ce = mte.count() - 1

          'Assign Colors
          If msh.VertexColors.Count() < 1 Then
            msh.VertexColors.CreateMonotoneMesh(color.LightGray)
            bmC = biC
          Else
            bmC = True
          End If
          'Assign fake edges
          mc = msh.VertexColors().ToArray().ToList()
        Else
          'Start Deconstruct if Curve
          crv = g

          I.clear()
          I.add(0)
          Dim nc As nurbscurve
          Dim pc As polyline
          Dim nps As Rhino.Geometry.Collections.NurbsCurvePointList

          nc = crv.ToNurbsCurve()
          nps = nc.Points
          pc = nc.Points.ControlPolygon
          If (Not pc.IsClosed) Then pc.add(pc(0))
          av = pc.CenterPoint

          msh.Vertices.AddVertices(pc.ToArray())
          msh.faces.addfaces(pc.TriangulateClosedPolyline())
          msh.Vertices.Remove(pc.count() - 1, True)
          msh.FaceNormals.ComputeFaceNormals()
          msh.Normals.ComputeNormals()
          msh.Normals.UnitizeNormals()

          mv = msh.Vertices.ToPoint3dArray().tolist()
          mte = msh.TopologyEdges()
          mtv = msh.TopologyVertices()
          mn = msh.Normals()
          mfn = msh.FaceNormals()

          mfn(0) = avgVec(mn.toarray())

          'Assign Colors
          If bic Then bmC = True
          mc = clr
          If (clr.count() - 1) < (mv.count() - 1) Then mc = matchClr(mc, mv.count() - 1)


          ac = avgClr(mc.toarray())
          cf = 0
        End If
        cv = mv.count() - 1
        ce = mte.count() - 1

        x = appendprepend(cv)
        'Match variables and colors to vertex count
        If (T0.count() - 1) < cv Then T0 = matchDbl(T0, cv)
        If (T1.count() - 1) < cv Then T1 = matchDbl(T1, cv)
        If (T2.count() - 1) < cv Then T2 = matchDbl(T2, cv)
        If (T3.count() - 1) < cv Then T3 = matchDbl(T3, cv)
        If (T4.count() - 1) < cv Then T4 = matchDbl(T4, cv)
        If (D.count() - 1) < cv Then D = matchDbl(D, cv)
        If (clr.count() - 1) < cv Then clr = matchClr(clr, cv)
        If biC Then fc = clr Else fc = mc

        'Edge based vertices
        k = 0
        For j = 0 To mte.count() - 1 Step 1
          If (bm Or (bp And (mte.GetConnectedFaces(j).Count() < 2))) Then
            u = mtv.MeshVertexIndices(mte.GetTopologyVertices(j).I)(0)
            v = mtv.MeshVertexIndices(mte.GetTopologyVertices(j).J)(0)

            ep.add(evalP(mv(u), mv(v), 0.5))
            ev.add(evalV(mn(u), mn(v), 0.5))
            ed.add(evalN(d(u), d(v), 0.5))
            ec.add(evalC(mc(u), mc(v), 0.5))
            mev.add(u & "," & v & "," & 0, k)
            mev.add(v & "," & u & "," & 0, k)

            k += 1
          End If
        Next

        'Face based vertices
        Dim xv(),mt(),ei() As Integer
        Dim xc() As color
        Dim xd,xn As Double
        ReDim ei(0)
        u = 2
        v = mv.count()
        If c Then v += cf + 1

        For jj = 0 To I.count() - 1 Step 1
          Dim tcv As New point3d
          j = I(jj)
          w = v + tv.count()
          xd = 0
          xn = 0
          If bm Then
            If mf(j).isquad() Then h = 4 Else h = 3
            ReDim xv(h - 1)
            ReDim xc(h - 1)
            mt = mf.GetTopologicalVertices(j)
            For k = 0 To h - 1 Step 1
              xv(k) = mtv.MeshVertexIndices(mt(k))(0)
              xc(k) = fc(xv(k))
            Next
            av = mf.GetFaceCenter(j)
            ac = avgClr(xc)
          Else
            h = mv.count()
            xv = Enumerable.Range(0, h).ToArray()
          End If
          For k = 0 To h - 1 Step 1
            xd += D(xv(k))
            xn += T4(xv(k))
          Next
          xd /= h
          xn /= h
          mfn(j) *= xd
          y = appendprepend(h - 1)

          For k = 1 To h Step 1
            ei(0) = mev.item(xv(y(k)) & "," & xv(y(k + 1)) & "," & 0)

            'Define new per face vertices
            tv.add(evalP(mv(xv(y(k))) + mN(xv(y(k))) * D(xv(y(k))) * t3(xv(y(k))), av + New vector3d(mfn(j)) * t3(xv(y(k))), t0(xv(y(k)))))
            tc.add(evalC(mc(xv(y(k))), ac, t0(xv(y(k)))))

            tv.add(evalP(ep(ei(0)) + ev(ei(0)) * eD(ei(0)) * (t2(xv(y(k))) + t2(xv(y(k + 1)))) / 2, av + New vector3d(mfn(j)) * (t2(xv(y(k))) + t2(xv(y(k + 1)))) / 2, (t1(xv(y(k))) + t1(xv(y(k + 1)))) / 2))
            tc.add(evalC(ec(ei(0)), ac, (t1(xv(y(k))) + t1(xv(y(k + 1)))) / 2))

            tcv += (tv.item(tv.count() - 1) + tv.item(tv.count() - 2)) / 2
            'Define new faces
            xf.add(New meshface(xv(y(k)), xv(y(k + 1)), w + y(k) * u + 1))
            xf.add(New meshface(w + y(k) * u, xv(y(k)), w + y(k) * u + 1))
            xf.add(New meshface(w + y(k) * u + 1, xv(y(k + 1)), w + y(k + 1) * u))

            If c Then
              xf.add(New meshface(w + y(k) * u, w + y(k) * u + 1, v + jj - cf - 1))
              xf.add(New meshface(w + y(k) * u + 1, w + y(k + 1) * u, v + jj - cf - 1))
            End If
          Next
          If c Then
            tcv /= h
            fv.add(evalP(tcv, av, xn))
            cc.add(ac)
          End If
        Next

        Dim om As New mesh
        om.Vertices.AddVertices(mv)
        If bmC Then om.VertexColors.AppendColors(mc.toarray())

        If c Then
          om.Vertices.AddVertices(fv)
          If bmC Then om.VertexColors.AppendColors(cc.toarray())
        End If

        om.Vertices.AddVertices(tv.toarray())
        If bmC Then om.VertexColors.AppendColors(tc.toarray())

        om.Faces.AddFaces(xf.toarray())

        If i.count() > 1 Then om.Vertices.CullUnused()

        A = om
      End If
    End If
# ---------- m_pinch: VB additional code ----------
  Private Function appendprepend(ByVal i As Integer)
    Dim srsEnum As IEnumerable(Of Integer) = Enumerable.Range(0, i + 1)
    Dim arrVal As New list(Of Integer)
    arrVal = srsEnum.tolist()
    arrVal.add(0)
    arrVal.insert(0, i)
    Return arrVal.toarray()
  End Function

  Private Function matchDbl(ByVal a As list(Of Double), ByVal t As Integer)
    Dim i,k As Integer
    k = a.count()
    For i = 0 To ((t + 1) - k) - 1 Step 1
      a.add(a.item(k - 1))
    Next
    Return a
  End Function

  Private Function matchClr(ByVal a As list(Of Color), ByVal t As Integer)
    Dim i,k As Integer
    k = a.count()
    For i = 0 To ((t + 1) - k) - 1 Step 1
      a.add(a.item(k - 1))
    Next
    Return a
  End Function

  Private Function evalP(ByVal op As point3d, ByVal tp As Point3d, ByVal t As Double)
    Return New point3d(op + (tp - op) * t)
  End Function

  Private Function evalV(ByVal ov As vector3d, ByVal tv As vector3d, ByVal t As Double)
    Return New vector3d(ov + (tv - ov) * t)
  End Function

  Private Function evalN(ByVal u As Double, ByVal v As Double, ByVal t As Double)
    Return u + (v - u) * t
  End Function

  Private Function avgVec(ByVal v() As vector3f)
    Dim i As Integer
    Dim tv As Vector3d

    For i = 0 To (v.Length - 1) Step 1
      tv += v(i)
    Next
    tv /= ((v.Length - 1) + 1)
    tv.Unitize()
    Return New vector3f(tv.X, tv.Y, tv.Z)
  End Function

  Private Function roundClr(ByVal r As Integer, ByVal g As Integer, ByVal b As Integer, ByVal i As Integer)
    r = CInt(r / i)
    g = CInt(g / i)
    b = CInt(b / i)

    If r > 255 Then r = 255 Else If r < 0 Then r = 0
    If g > 255 Then g = 255 Else If g < 0 Then g = 0
    If b > 255 Then b = 255 Else If b < 0 Then b = 0

    Return color.FromArgb(r, g, b)
  End Function

  Private Function avgClr(ByVal c() As color)
    Dim r,g,b As Integer
    Dim i,k As Integer

    k = (c.Length - 1) + 1

    For i = 0 To k - 1 Step 1
      r += CInt(c(i).R)
      g += CInt(c(i).G)
      b += CInt(c(i).B)
    Next

    r = CInt(r / k)
    g = CInt(g / k)
    b = CInt(b / k)

    If r > 255 Then r = 255 Else If r < 0 Then r = 0
    If g > 255 Then g = 255 Else If g < 0 Then g = 0
    If b > 255 Then b = 255 Else If b < 0 Then b = 0

    Return color.FromArgb(r, g, b)
  End Function

  Private Function evalC(ByVal oc As color, ByVal tc As color, ByVal t As Double)
    Dim r,g,b As Integer
    r = CInt(CInt(oc.R) + (CInt(tc.R) - CInt(oc.R)) * t)
    g = CInt(CInt(oc.G) + (CInt(tc.G) - CInt(oc.G)) * t)
    b = CInt(CInt(oc.B) + (CInt(tc.B) - CInt(oc.B)) * t)

    If r > 255 Then r = 255 Else If r < 0 Then r = 0
    If g > 255 Then g = 255 Else If g < 0 Then g = 0
    If b > 255 Then b = 255 Else If b < 0 Then b = 0

    Return color.FromArgb(r, g, b)
  End Function
# ---------- end m_pinch ----------
m_frame_0 = Frame0(G=merge_12, T0=0.5, D=0, N=1, S=1, O=True)  # -> out, A; inputs G: GeometryBase, I: list, T0: list, D: list, N: list, S: list, clr: list of Color
# ---------- m_frame_0: VB ----------
    Component.Params.Input(0).Name = "Mesh or Curve"
    Component.Params.Input(0).Description = "Open or closed mesh or curve"
    Component.Params.Input(1).Name = "Index [Face]"
    Component.Params.Input(1).Description = "An optional integer or list of integers which specify the faces to be modified if the input is a mesh. If no value is supplied then all faces will be modified"
    Component.Params.Input(2).Name = "Vert to Face"
    Component.Params.Input(2).Description = "Evaluates a new vertex between the input geometry's vertex to the face center"
    Component.Params.Input(3).Name = "Distance"
    Component.Params.Input(3).Description = "Sets the depth for the center point offset of each face"
    Component.Params.Input(4).Name = "Normalize"
    Component.Params.Input(4).Description = "If true averages the vertex values per face, if false each new vertices parameters are associated to its origin vertex"
    Component.Params.Input(5).Name = "Stellate"
    Component.Params.Input(5).Description = "A unitized per vertex number which shifts the offset vector from vertex = 0 to face = 1 normal"
    Component.Params.Input(6).Name = "Close"
    Component.Params.Input(6).Description = "If true then additional faces and if needed vertices will be added to the mesh, covering the complete areas of the existing mesh"
    Component.Params.Input(7).Name = "Optimize"
    Component.Params.Input(7).Description = "If true, when faces are quad or tri based, a single face will be used about the face center, if false or per face vertex count is greater than 4 then a new offset vertex is added"
    Component.Params.Input(8).Name = "Color [Vertex]"
    Component.Params.Input(8).Description = "(If applied to a mesh a list of colors corresponding to each mesh face, if applied to a curve, a list of colors corresponding to each control point plus an additonal color value for the new averaged center"

    Component.Params.Output(1).Name = "Mesh"
    Component.Params.Output(1).Description = "If successful, a valid mesh"

    If G IsNot Nothing Then

      Dim bM, bP,bmC,biC As Boolean

      bM = g.ObjectType = ObjectType.Mesh
      bP = g.ObjectType = ObjectType.Curve

      If (bM Or bP) Then
        Dim msh As New mesh
        Dim crv As curve
        Dim av As point3d
        Dim ac As color
        Dim h,j,jj,k,u,v,w As Integer
        Dim cv,cf As Integer
        Dim x(),y() As Integer

        Dim mv,fv,ev,tv As New list(Of Point3d)
        Dim mf As Rhino.Geometry.Collections.MeshFaceList = Nothing
        Dim mtv As Rhino.Geometry.Collections.MeshTopologyVertexList = Nothing
        Dim mte As Rhino.Geometry.Collections.MeshTopologyEdgeList = Nothing
        Dim mn As Rhino.Geometry.Collections.MeshVertexNormalList = Nothing
        Dim mfn As Rhino.Geometry.Collections.MeshFaceNormalList = Nothing
        Dim mc,tc,cc,fc As New list(Of color)
        Dim xf As New list(Of meshface)

        If clr.count() = 0 Then clr.add(color.LightGray) Else biC = True

        If bm Then
          'Start Deconstruct if Mesh
          msh = g

          If msh.Normals.Count() = 0 Then msh.Normals.ComputeNormals()
          If msh.FaceNormals.Count() = 0 Then msh.FaceNormals.ComputeFaceNormals()

          If i.count() = 0 Then I = Enumerable.Range(0, msh.Faces.Count()).ToList()

          mv = msh.Vertices().ToPoint3dArray().tolist()
          mtv = msh.TopologyVertices()
          mf = msh.Faces()

          mn = msh.Normals()
          mn.UnitizeNormals()
          mfn = msh.FaceNormals()
          mfn.UnitizeFaceNormals()

          cf = I.Count() - 1

          'Assign Colors
          If msh.VertexColors.Count() = 0 Then
            msh.VertexColors.CreateMonotoneMesh(color.LightGray)
            bmC = biC
          Else
            bmC = True
          End If
          'Assign fake edges
          mc = msh.VertexColors().ToArray().ToList()
        Else
          'Start Deconstruct if Curve
          crv = g

          I.clear()
          I.add(0)
          Dim nc As nurbscurve
          Dim pc As polyline
          Dim nps As Rhino.Geometry.Collections.NurbsCurvePointList

          nc = crv.ToNurbsCurve()
          nps = nc.Points
          pc = nc.Points.ControlPolygon
          If (Not pc.IsClosed) Then pc.add(pc(0))
          av = pc.CenterPoint

          msh.Vertices.AddVertices(pc.ToArray())
          msh.faces.addfaces(pc.TriangulateClosedPolyline())
          msh.Vertices.Remove(pc.count() - 1, True)
          msh.FaceNormals.ComputeFaceNormals()
          msh.Normals.ComputeNormals()
          msh.Normals.UnitizeNormals()

          mv = msh.Vertices.ToPoint3dArray().tolist()
          mtv = msh.TopologyVertices()
          mn = msh.Normals()
          mfn = msh.FaceNormals()

          mfn(0) = avgVec(mn.toarray())

          'Assign Colors
          If bic Then bmC = True
          mc = clr
          If (clr.count() - 1) < (mv.count() - 1) Then mc = matchClr(mc, mv.count() - 1)


          ac = avgClr(mc.toarray())
          If (mv.count() - 1) > 3 Then o = False
          cf = 0
        End If
        cv = mv.count() - 1

        x = appendprepend(cv)
        'Match variables and colors to vertex count
        If (T0.count() - 1) < cv Then T0 = matchDbl(T0, cv)
        If (D.count() - 1) < cv Then D = matchDbl(D, cv)
        If (N.count() - 1) < cv Then N = matchDbl(N, cv)
        If (S.count() - 1) < cv Then S = matchDbl(S, cv)
        If (clr.count() - 1) < cv Then clr = matchClr(clr, cv)
        If biC Then fc = clr Else fc = mc

        'Face based vertices
        Dim xv(),mt() As Integer
        Dim xc() As color
        Dim xd,xn As Double
        Dim txv(0) As vector3d
        u = 1
        v = mv.count()
        If (c And (o = False)) Then v += cf + 1

        For jj = 0 To I.count() - 1 Step 1
          Dim tcv As New point3d
          j = I(jj)
          w = v + tv.count()
          xd = 0
          xn = 0
          If bm Then
            If mf(j).isquad() Then h = 4 Else h = 3
            ReDim xv(h - 1)
            ReDim xc(h - 1)
            mt = mf.GetTopologicalVertices(j)
            For k = 0 To h - 1 Step 1
              xv(k) = mtv.MeshVertexIndices(mt(k))(0)
              xc(k) = fc(xv(k))
            Next
            av = mf.GetFaceCenter(j)
            ac = avgClr(xc)
          Else
            h = mv.count()
            xv = Enumerable.Range(0, h).ToArray()
          End If
          For k = 0 To h - 1 Step 1
            xd += D(xv(k))
            xn += T0(xv(k))
          Next
          xd /= h
          xn /= h
          mfn(j) *= xd
          y = appendprepend(h - 1)

          For k = 1 To h Step 1
            Dim td As Double = (evalN(D(xv(y(k))) * t0(xv(y(k))), xd * xn, N(xv(y(k)))))
            txv(0) = mN(xv(y(k))) * td
            'Define new per face vertices
            tv.add(evalP(mv(xv(y(k))) + txv(0), evalP(mv(xv(y(k))), av + evalV(txv(0), mfn(j), t0(xv(y(k)))), t0(xv(y(k)))), S(xv(y(k)))))
            tc.add(evalC(mc(xv(y(k))), ac, t0(xv(y(k)))))
            tcv += tv.item(tv.count() - 1)

            'Define new faces
            xf.add(New meshface(xv(y(k)), xv(y(k + 1)), w + y(k + 1) * u, w + y(k) * u))

            If (c And (o = False))Then
              xf.add(New meshface(w + y(k + 1) * u, v + jj - cf - 1, w + y(k) * u))
            End If
          Next
          If (c And o)Then
            If h = 3 Then
              xf.add(New meshface(w + 0 * u, w + 1 * u, w + 2 * u))
            ElseIf h = 4 Then
              xf.add(New meshface(w + 0 * u, w + 1 * u, w + 2 * u, w + 3 * u))
            End If
          Else
            tcv /= h
            fv.add(tcv)
            cc.add(ac)
          End If
        Next

        Dim om As New mesh
        om.Vertices.AddVertices(mv)
        If bmC Then om.VertexColors.AppendColors(mc.toarray())

        If c Then
          om.Vertices.AddVertices(fv)
          If bmC Then om.VertexColors.AppendColors(cc.toarray())
        End If

        om.Vertices.AddVertices(tv.toarray())
        If bmC Then om.VertexColors.AppendColors(tc.toarray())

        om.Faces.AddFaces(xf.toarray())
        If i.count() > 0 Then om.Vertices.CullUnused()

        If i.count() > 1 Then om.Vertices.CullUnused()

        A = om
      End If
    End If
# ---------- m_frame_0: VB additional code ----------
  Private Function appendprepend(ByVal i As Integer)
    Dim srsEnum As IEnumerable(Of Integer) = Enumerable.Range(0, i + 1)
    Dim arrVal As New list(Of Integer)
    arrVal = srsEnum.tolist()
    arrVal.add(0)
    arrVal.insert(0, i)
    Return arrVal.toarray()
  End Function

  Private Function matchDbl(ByVal a As list(Of Double), ByVal t As Integer)
    Dim i,k As Integer
    k = a.count()
    For i = 0 To ((t + 1) - k) - 1 Step 1
      a.add(a.item(k - 1))
    Next
    Return a
  End Function

  Private Function matchClr(ByVal a As list(Of Color), ByVal t As Integer)
    Dim i,k As Integer
    k = a.count()
    For i = 0 To ((t + 1) - k) - 1 Step 1
      a.add(a.item(k - 1))
    Next
    Return a
  End Function

  Private Function evalP(ByVal op As point3d, ByVal tp As Point3d, ByVal t As Double)
    Return New point3d(op + (tp - op) * t)
  End Function

  Private Function evalV(ByVal ov As vector3d, ByVal tv As vector3d, ByVal t As Double)
    Return New vector3d(ov + (tv - ov) * t)
  End Function

  Private Function evalN(ByVal u As Double, ByVal v As Double, ByVal t As Double)
    Return u + (v - u) * t
  End Function

  Private Function avgVec(ByVal v() As vector3f)
    Dim i As Integer
    Dim tv As Vector3d

    For i = 0 To (v.Length - 1) Step 1
      tv += v(i)
    Next
    tv /= ((v.Length - 1) + 1)
    tv.Unitize()
    Return New vector3f(tv.X, tv.Y, tv.Z)
  End Function

  Private Function roundClr(ByVal r As Integer, ByVal g As Integer, ByVal b As Integer, ByVal i As Integer)
    r = CInt(r / i)
    g = CInt(g / i)
    b = CInt(b / i)

    If r > 255 Then r = 255 Else If r < 0 Then r = 0
    If g > 255 Then g = 255 Else If g < 0 Then g = 0
    If b > 255 Then b = 255 Else If b < 0 Then b = 0

    Return color.FromArgb(r, g, b)
  End Function

  Private Function avgClr(ByVal c() As color)
    Dim r,g,b As Integer
    Dim i,k As Integer

    k = (c.Length - 1) + 1

    For i = 0 To k - 1 Step 1
      r += CInt(c(i).R)
      g += CInt(c(i).G)
      b += CInt(c(i).B)
    Next

    r = CInt(r / k)
    g = CInt(g / k)
    b = CInt(b / k)

    If r > 255 Then r = 255 Else If r < 0 Then r = 0
    If g > 255 Then g = 255 Else If g < 0 Then g = 0
    If b > 255 Then b = 255 Else If b < 0 Then b = 0

    Return color.FromArgb(r, g, b)
  End Function

  Private Function evalC(ByVal oc As color, ByVal tc As color, ByVal t As Double)
    Dim r,g,b As Integer
    r = CInt(CInt(oc.R) + (CInt(tc.R) - CInt(oc.R)) * t)
    g = CInt(CInt(oc.G) + (CInt(tc.G) - CInt(oc.G)) * t)
    b = CInt(CInt(oc.B) + (CInt(tc.B) - CInt(oc.B)) * t)

    If r > 255 Then r = 255 Else If r < 0 Then r = 0
    If g > 255 Then g = 255 Else If g < 0 Then g = 0
    If b > 255 Then b = 255 Else If b < 0 Then b = 0

    Return color.FromArgb(r, g, b)
  End Function
# ---------- end m_frame_0 ----------
item_22 = ListItem(List=m_i_wp.A, Index=0, Wrap=True)
flip = FlipMatrix(Data=item_22)
item_23 = ListItem(List=flip, Index=0, Wrap=True)

wbthicken = WeaverbirdsMeshThicken(MeshCurves=m_frame_0.A, Distance=Slider(0.1, range=0..1), OffsetType=0)
mesh_3 = Mesh(wbthicken)
