# Grasshopper definition dome_multi_29_1_notwist.gh (Grasshopper 1.0.8)
# plug-ins: Pufferfish, LunchBox, Weaverbird

pt = ConstructPoint(XCoordinate=Slider(4.75, range=0..10), YCoordinate=Slider(2.5, range=0..10), ZCoordinate=0)
pl = ConstructPlane(Origin=pt, XAxis=Vector(1, 0, 0), YAxis=Vector(0, 1, 0))
cir = Circle(Plane=pl, Radius=Slider(3.35, range=0..10))
offset = OffsetCurve(Curve=cir, Distance=Slider(2.5, range=0..3), Corners=1)
curvepoint = PointOnCurve(cir, parameter=0.5)
curvepoint_2 = PointOnCurve(offset, parameter=0.5)
Z = UnitZ(Factor=1)
arc = ArcSED(Start=curvepoint_2, End=curvepoint, Direction=Z)  # -> Arc, Plane, Radius
scale_nu = ScaleNU(Geometry=arc.Arc, Plane=PlaneXY(0, 0, 0), ScaleX=1, ScaleY=1, ScaleZ=Slider(3.5, range=0..5))  # -> Geometry, Transform
swp2 = Sweep2(Rail1=cir, Rail2=offset, Sections=scale_nu.Geometry, SameHeight=False)
rotate = Rotate(Geometry=swp2, Angle=degrees(Slider(117, range=0..360)), Plane=PlaneXY(0, 0, 0))  # -> Geometry, Transform
cap = CapHoles(Brep=rotate.Geometry)

number_slider = Slider(6, range=0..10)
polygon = Polygon(Plane=PlaneXY(0, 0, 0), Radius=Slider(2.5, range=0..5), Segments=number_slider, FilletRadius=0)  # -> Polygon, Length

# ----
# Trimmed Distorted vaulted ceiling surface
number_slider_2 = Slider(1, range=0..1)
number_slider_3 = Slider(5, range=0..10)
box = CenterBox(Base=PlaneXY(0, 0, 0), X=number_slider_3, Y=number_slider_3, Z=number_slider_2)  # -> flatten(Box)

area = Area(Geometry=polygon.Polygon)  # -> Area, Centroid
Z_2 = UnitZ(Factor=Slider(3, range=1..8))
move = Move(Geometry=area.Centroid, Motion=Z_2)  # -> Geometry, Transform

explode = Explode(Curve=polygon.Polygon, Recursive=True)  # -> Segments, Vertices

cull_i = CullIndex(List=explode.Vertices, Indices="-1", Wrap=True)
bottom_vertex = Point(cull_i)
top_point = Point(move.Geometry)

cap_2 = CapHoles(Brep=swp2)
Z_3 = UnitZ(Factor=1)

# ----
# Distorted vaulted ceiling surface
pcen = PolygonCenter(Polyline=polygon.Polygon)  # -> CenterV, CenterE, CenterA
Z_4 = UnitZ(Factor=1)
vec2pt = Vector2Pt(PointA=bottom_vertex, PointB=pcen.CenterV, Unitize=False)  # -> Vector, Length
pl_2 = ConstructPlane(Origin=pcen.CenterV, XAxis=Z_4, YAxis=vec2pt.Vector)
division = Division(A="360", B=number_slider)
arc_2 = ArcSED(Start=bottom_vertex, End=top_point, Direction=Z_3)  # -> Arc, Plane, Radius
rotate_2 = Rotate(Geometry=arc_2.Arc, Angle=degrees(division), Plane=PlaneXY(0, 0, 0))  # -> Geometry, Transform
rulesrf = RuledSurface(CurveA=arc_2.Arc, CurveB=rotate_2.Geometry)

offset_2 = OffsetCurve(Curve=polygon.Polygon, Thinkness=Slider(0.7, range=-1..3), Corners=1)
explode_2 = Explode(Curve=offset_2, Recursive=True)  # -> Segments, Vertices
cull_i_2 = CullIndex(List=explode_2.Vertices, Indices="-1", Wrap=True)
bottom_vertex_2 = Point(bottom_vertex)
outer_vertex = Point(cull_i_2)
item = ListItem(List=flatten(outer_vertex), Index=0, Wrap=True)  # -> Item, Item1, Item2, Item3, Item4, Item5
item_2 = ListItem(List=flatten(bottom_vertex_2), Index=0, Wrap=True)  # -> Item, Item1, Item2, Item3, Item4, Item5
item_3 = ListItem(List=flatten(explode_2.Segments), Index=0, Wrap=True)  # -> Item, Item1, Item2, Item3, Item4, Item5
item_4 = ListItem(List=flatten(outer_vertex), Index=0, Wrap=True)  # -> Item, Item1, Item2, Item3, Item4, Item5
item_5 = ListItem(List=flatten(bottom_vertex_2), Index=0, Wrap=True)  # -> Item, Item1, Item2, Item3, Item4, Item5
midpt = CurveMiddle(Curve=[item_3.Item, item_3.Item2, item_3.Item4])
Z_5 = UnitZ(Factor=Slider(2.5, range=0..3))
pta = Point([item.Item, item.Item2, item.Item4])
ln = Line(StartPoint=graft([item_4.Item1, item_4.Item3, item_4.Item5]), EndPoint=graft([item_5.Item1, item_5.Item3, item_5.Item5]))
move_2 = Move(Geometry=midpt, Motion=Z_5)  # -> Geometry, Transform
ln_2 = Line(StartPoint=graft([item.Item, item.Item2, item.Item4]), EndPoint=graft([item_2.Item, item_2.Item2, item_2.Item4]))
arc_3 = ArcSED(Start=pta, End=move_2.Geometry, Direction=Z_5)  # -> Arc, Plane, Radius
mirror = Mirror(Geometry=arc_3.Arc, Plane=PlaneYZ(0, 0, 0))  # -> Geometry, Transform
dome_crv = Curve(arc_2.Arc)
right = Curve(graft(mirror.Geometry))
left = Curve(graft(arc_3.Arc))
item_6 = ListItem(List=flatten(dome_crv), Index=0, Wrap=True)  # -> Item, Item1, Item2, Item3, Item4, Item5
dome_right = Curve(graft([item_6.Item3, item_6.Item1, item_6.Item5]))
dome_left = Curve(graft([item_6.Item, item_6.Item2, item_6.Item4]))

# ----
# Test Bones
number_slider_4 = Slider(1, range=-5..5)  # disabled
number_slider_5 = Slider(40, range=0..360)  # disabled
number_slider_6 = Slider(5, range=0..10)  # disabled
Z_6 = UnitZ(Factor=1)  # disabled
rotate_3 = Rotate(Geometry=pl_2, Angle=degrees(number_slider_5), Plane=PlaneXY(0, 0, 0))  # -> Geometry, Transform; disabled
Z_7 = UnitZ(Factor=number_slider_4)  # disabled
bzspan = BezierSpan(StartPoint=bottom_vertex, StartTangent=Z_6, EndPoint=top_point, EndTangent=rotate_3.Geometry)  # -> Curve, Length, Domain; disabled
cat = Catenary(PointA=bottom_vertex, PointB=top_point, Length=number_slider_6, Gravity=Z_7)  # disabled
cpoly = ControlPolygon(Curve=cat)  # -> Polygon, Points; disabled

dome_srf = Surface(rulesrf)
loft = Loft(
    Curves=reverse([right, dome_right]),
    Options={Adjust=False, Closed=False, LoftEnds=0, LoftSimp=0, LoftType=0, Rebuild=10, Refit=0.01})  # -> flatten(Loft)
item_7 = ListItem(List=dome_srf, Index=0, Wrap=True)  # -> Item, Item1, Item2, Item3, Item4, Item5
loft_2 = Loft(
    Curves=[left, dome_left],
    Options={Adjust=False, Closed=False, LoftEnds=0, LoftSimp=0, LoftType=0, Rebuild=10, Refit=0.01})  # -> flatten(Loft)
srf = Surface([item_7.Item1, item_7.Item3, item_7.Item5])
join = BrepJoin(Breps=flatten([loft_2, loft, srf]))  # -> Breps, Closed
join_2 = BrepJoin(Breps=rulesrf)  # -> Breps, Closed
cap_3 = CapHoles(Brep=join_2.Breps)
sdiff = SolidDifference(BrepsA=cap_3, BrepsB=box)
movetoplane = MoveToPlane(Geometry=sdiff, Plane=PlaneXY(0, 0, 0), Above=True, Below=True)  # -> Geometry, Transform
sdiff_2 = SolidDifference(BrepsA=movetoplane.Geometry, BrepsB=cap_2)
sdiff_3 = SolidDifference(BrepsA=sdiff_2, BrepsB=cap)
debrep = DeconstructBrep(Brep=sdiff_3)  # -> Faces, Edges, Vertices

# ----
# Which faces we need
number_slider_7 = Slider(9, range=0..14)
item_8 = ListItem(List=debrep.Faces, Index=number_slider_7, Wrap=True)  # -> Item, Item1
srf_2 = Surface(item_8.Item)

# ----
# Which faces we need
panel = Panel("1")
item_9 = ListItem(List=debrep.Faces, Index="5", Wrap=True)  # -> Item, Item1
item_10 = ListItem(List=debrep.Faces, Index=panel, Wrap=True)  # -> Item, Item1
item_11 = ListItem(List=debrep.Faces, Index="8", Wrap=True)  # -> Item, Item1
merge = Merge(Data1=item_10.Item, Data2=item_10.Item1, Data3=item_9.Item, Data4=item_9.Item1, Data5=item_11.Item, Data6=item_11.Item1)
srf_3 = Surface(merge)

srf_4 = Surface(srf_3)
dome_srf_2 = Surface(srf)

# ----
# Lattice Representation
meshsubd = MeshFromSubD(SubD=rulesrf, Density=3)  # disabled
number_slider_8 = Slider(0.03, range=0.001..0.05)  # disabled
medges = MeshEdges(Mesh=meshsubd)  # -> NakedEdges, InteriorEdges, NonManifoldEdges; disabled
mp = MultiPipe(
    Curves=medges.InteriorEdges,
    NodeSize=number_slider_8,
    EndOffset=1,
    StrutSize=1,
    Segment=0,
    KinkAngle=0.6,
    CubeFit=0,
    Caps=0)  # disabled
panel_2 = Panel("0")  # disabled
swatch = ColourSwatch(SwatchColor=RGB(186, 186, 186))  # disabled
meshsubd_2 = MeshFromSubD(SubD=mp, Density=panel_2)  # disabled
unweld = UnweldMesh(Mesh=meshsubd_2, Angle=0)  # disabled
preview = CustomPreview(Geometry=mp, Material=swatch)  # disabled

panel_3 = Panel("""1
2""")  # disabled
item_12 = ListItem(List=meshsubd, Index=panel_3, Wrap=True)  # disabled

number_slider_9 = Slider(50, range=0..1000)  # disabled
number_slider_10 = Slider(0.1, range=0..0.1)  # disabled
number_slider_11 = Slider(1, range=0..1)  # disabled
number_slider_12 = Slider(2, range=0..10)  # disabled
# Mesh experiments
number_slider_13 = Slider(5, range=0..10)  # disabled
number_slider_14 = Slider(10, range=0..10)  # disabled
triremesh = TriRemesh(Geometry=meshsubd, Length=Slider(1, range=0..1), Iterations=25)  # -> Triangulation, Dual, Creases; disabled
qrsettings = QuadRemeshSettings(
    TargetCount=number_slider_9,
    AdaptiveSize=number_slider_11,
    AdaptiveCount=invert(False),
    HardEdges=invert(False),
    SeamEdges=1,
    Symmetry=0,
    GuideCurves=0)  # disabled
m_rhombitrihexagonal = RhombitrihexagonalTiling(S=rulesrf, O=0, U=14, V=number_slider_12, F=False, T=0.366025)  # -> out, M; inputs S: Surface; disabled
# ---------- m_rhombitrihexagonal: VB ----------
    Component.Params.Input(0).Name = "Surface"
    Component.Params.Input(0).Description = "The base surface to mesh"
    Component.Params.Input(1).Name = "Polygon Types"
    Component.Params.Input(1).Description = "0=All, 1=Quad&Tri, 2=Quad Only"
    Component.Params.Input(2).Name = "U Count"
    Component.Params.Input(2).Description = "The number of quads in the U direction"
    Component.Params.Input(3).Name = "V Count"
    Component.Params.Input(3).Description = "The number of quads in the V direction"
    Component.Params.Input(4).Name = "Flip"
    Component.Params.Input(4).Description = "Flips the pattern sequence"
    Component.Params.Input(5).Name = "Evaluate"
    Component.Params.Input(5).Description = "A unitized value which symmetrically shifts the location of internal vertices within each new quad"
    Component.Params.Input(6).Name = "Close Edges"
    Component.Params.Input(6).Description = "If true, additional faces will be added, matching the original surface edge"

    Component.Params.Output(1).Name = "Mesh"
    Component.Params.Output(1).Description = "If successful, the resulting mesh"

    If s IsNot Nothing Then
      Dim i,j,k,x,q As Integer
      Dim ta As Double
      Dim wu,wv As New list(Of Integer)
      Dim bu, bv As Boolean
      Dim cu, cv,au,av,tv As Integer
      Dim arrPts As New list(Of point3d)
      Dim arrFaces As New list(Of MeshFace)
      Dim mo As New mesh
      Dim mv As New list(Of point3d)
      Dim mf As New list(Of meshface)
      Dim uva(,) As Integer
      Dim uvb(,) As Integer
      Dim uvc(,) As Integer
      Dim uvd(,) As Integer

      U += 1
      V += 1
      bu = s.IsClosed(0)
      bv = s.IsClosed(1)

      S.SetDomain(0, New interval(0, 1))
      S.SetDomain(1, New interval(0, 1))

      If (bu And (u Mod 2)) Then
        wu = appendprepend(U)
        cu = u - 1
        au = 1
      Else
        wu = series(U)
        cu = u
        au = 0
      end if

      If (bv And (v Mod 2)) Then
        wv = appendprepend(V)
        cv = v - 1
        av = 1
      Else
        wv = series(V)
        cV = v
        av = 0
      End If

      If F Then tv = 1 Else tv = 0

      ReDim uva(cu, cv)
      ReDim uvb(cu, cv - 1)
      ReDim uvc(cu - 1, cv - 1)
      ReDim uvd(cu - 1, cv - 1)

      ta = 0.5 / (math.cos(((30 / 180) * math.pi)) * 1 + 1.5)

      For i = 0 To cu - 1 Step 1
        q = 0
        For j = ((i + tv) Mod 2) To cv - 1 Step 2
          mv.add(S.PointAt(i * (1 / (U - 1)), j * (1 / (V - 1))))
          uva(i, q) = k
          uva(i, q + 1) = k
          k += 1
          q += 2
        Next
      Next

      For i = 0 To cu - 1 Step 1
        For j = 0 To v - 2 Step 1
          Dim pt(1) As point3d

          pt(0) = S.PointAt(i * (1 / (U - 1)), (j + ta) * (1 / (V - 1)))
          pt(1) = S.PointAt(i * (1 / (U - 1)), (j + 1 - ta) * (1 / (V - 1)))

          mv.add(evalP(pt((i + j + tv) Mod 2), pt((i + j + 1 + tv) Mod 2), t))
          uvb(i, j) = k
          k += 1
        Next
      Next

      For i = 0 To u - 2 Step 1
        For j = 0 To v - 2 Step 1
          Dim pta(1),ptb(1) As point3d

          pta(0) = S.PointAt(i * (1 / (U - 1)), (j + ta) * (1 / (V - 1)))
          pta(1) = S.PointAt((i + 1) * (1 / (U - 1)), (j + ta) * (1 / (V - 1)))
          ptb(0) = S.PointAt(i * (1 / (U - 1)), (j + 1 - ta) * (1 / (V - 1)))
          ptb(1) = S.PointAt((i + 1) * (1 / (U - 1)), (j + 1 - ta) * (1 / (V - 1)))

          mv.add(evalP(pta((i + j + 1 + tv) Mod 2), pta((i + j + tv) Mod 2), t))
          mv.add(evalP(ptb((i + j + tv) Mod 2), ptb((i + j + 1 + tv) Mod 2), t))
          uvc(i, j) = k
          uvd(i, j) = k + 1
          k += 2
        Next
      Next

      For i = 0 To u - 2 Step 1
        For j = 0 To v - 2 Step 1
          mf.add(New MeshFace(uvb(wu(i), j), uvc(i, j), uvb(wu(i + 1), j), uvd(i, j)))
          If (i + j + tv) Mod 2 Then
            If ((j < (v - 2)) And (i < (u - 2))) Then mf.add(New meshface(uvc(i, j + 1), uvd(i, j), uvd(i + 1, j), uvc(i + 1, j + 1)))
          End If
        Next
      Next

      If (O <> 2) Then
        For i = 0 To u - 2 Step 1
          For j = 0 To v - 2 Step 1
            If (i + j + 1 + tv) Mod 2 Then
              If i < (u - 2) Then
                mf.add(New meshface(uvb(wu(i + 1), j), uvc(i, j), uvc(i + 1, j)))
              End If
            Else
              If i < (u - 2) Then
                mf.add(New meshface(uvd(i, j), uvb(wu(i + 1), j), uvd(i + 1, j)))
              End If
            End If
          Next
        Next
      End If

      If ((O <> 1) And (O <> 2)) Then
        For i = 0 To u - 2 Step 1
          For j = 0 To v - 2 Step 1
            If (i + j + 1 + tv) Mod 2 Then
              If j < (v - 2) Then
                mf.add(New meshface(uvd(i, j), uva(wu(i + 1), wv(j + 1)), uvc(i, j + 1)))
              End If
              mf.add(New meshface(uvd(i, j), uvb(wu(i + 1), j), uva(wu(i + 1), wv(j + 1))))
              mf.add(New meshface(uvc(i, j), uvb(wu(i), j), uva(i, wv(j))))
            Else
              If j < (v - 2) Then
                mf.add(New meshface(uvd(i, j), uvc(i, j + 1), uva(i, wv(j + 1))))
              End If
              mf.add(New meshface(uvb(wu(i), j), uvd(i, j), uva(i, wv(j + 1))))
              mf.add(New meshface(uvb(wu(i + 1), j), uvc(i, j), uva(wu(i + 1), wv(j))))
            End If
          Next
        Next
      End If

      k = mv.count()
      If c Then
        Dim tk(3) As Integer

        If ((bu = False) Or ((u + 1) Mod 2)) Then
          If f Then x = 1 Else x = 0

          For j = x To v - 2 Step  2
            mv.add(S.PointAt(0, (j + 1 - ta) * (1 / (V - 1))))
            mf.add(New meshface(uvb(0, wv(j)), uvd(0, wv(j)), k))
            K += 1
            If j < v - 2 Then
              mv.add(S.PointAt(0, (j + 1 + ta) * (1 / (V - 1))))
              mf.add(New meshface(uvd(0, wv(j)), uvc(0, wv(j + 1)), k, k - 1))
              mf.add(New meshface(uvc(0, wv(j + 1)), uvb(0, wv(j + 1)), k))
              K += 1
            End If
          Next
          tk(1) = k - 1

          If ((f And (u Mod 2)) Or ((f = False) And ((u + 1) Mod 2))) Then x = 1 Else x = 0

          For j = x To v - 2 Step  2
            mv.add(S.PointAt(1, (j + 1 - ta) * (1 / (V - 1))))
            mf.add(New meshface(uvd(wu(u - 2), wv(j)), uvb(wu(u - 1), wv(j)), k))
            K += 1
            If j < v - 2 Then
              mv.add(S.PointAt(1, (j + 1 + ta) * (1 / (V - 1))))
              mf.add(New meshface(uvc(wu(u - 2), wv(j + 1)), uvd(wu(u - 2), wv(j)), k - 1, k))
              mf.add(New meshface(uvc(wu(u - 2), wv(j + 1)), k, uvb(wu(u - 1), wv(j + 1))))
              K += 1
            End If
          Next
          tk(3) = k - 1
        ElseIf u Mod 2 Then
          If f Then x = 1 Else x = 0
          For j = x To v - 2 Step  2
            mf.add(New meshface(uvd(wu(u - 2), wv(j)), uvb(wu(0), wv(j)), uvd(wu(0), wv(j))))
            If j < v - 2 Then
              mf.add(New meshface(uvd(wu(u - 2), wv(j)), uvd(wu(0), wv(j)), uvc(wu(0), wv(j + 1)), uvc(wu(u - 2), wv(j + 1))))
              mf.add(New meshface(uvc(wu(0), wv(j + 1)), uvb(wu(0), wv(j + 1)), uvc(wu(u - 2), wv(j + 1))))
            End If
          Next
        End If

        If ((bv = False) Or ((v + 1) Mod 2)) Then
          If f Then x = 1 Else x = 0

          For i = x To u - 2 Step  2
            mv.add(s.PointAt(i * (1 / (U - 1)) + (1 / (U - 1)) * (1 - t), 0))
            mf.add(New meshface(uva(wu(i), 0), k, uvc(wu(i), 0)))
            K += 1
            If i < u - 2 Then
              mv.add(s.PointAt((i + 2) * (1 / (U - 1)) - (1 / (U - 1)) * (1 - t), 0))
              mf.add(New meshface(uvc(wu(i + 1), 0), uvc(wu(i), 0), k - 1, k))
              mf.add(New meshface(uva(wu(i + 2), 0), uvc(wu(i + 1), 0), k))
              K += 1
            End If
          Next
          tk(0) = k - 1

          If ((f And (v Mod 2)) Or ((f = False) And ((v + 1) Mod 2))) Then x = 1 Else x = 0

          For i = x To u - 2 Step  2
            mv.add(s.PointAt(i * (1 / (U - 1)) + (1 / (U - 1)) * (1 - t), 1))
            mf.add(New meshface(uva(wu(i), wv(v - 1)), uvd(wu(i), wv(v - 2)), k))
            K += 1
            If i < u - 2 Then
              mv.add(s.PointAt((i + 2) * (1 / (U - 1)) - (1 / (U - 1)) * (1 - t), 1))
              mf.add(New meshface(uvd(wu(i), wv(v - 2)), uvd(wu(i + 1), wv(v - 2)), k, k - 1))
              mf.add(New meshface(uvd(wu(i + 1), wv(v - 2)), uva(wu(i + 2), wv(v - 1)), k))
              K += 1
            End If
          Next
          tk(2) = k - 1
        ElseIf v Mod 2 Then
          If f Then x = 1 Else x = 0
          For i = x To u - 2 Step  2
            mf.add(New meshface(uvc(wu(i), wv(0)), uva(wu(i), wv(0)), uvd(wu(i), wv(v - 2))))
            If i < u - 2 Then
              mf.add(New meshface(uvc(wu(i), wv(0)), uvd(wu(i), wv(v - 2)), uvd(wu(i + 1), wv(v - 2)), uvc(wu(i + 1), wv(0))))
              mf.add(New meshface(uvd(wu(i + 1), wv(v - 2)), uva(wu(i + 2), wv(0)), uvc(wu(i + 1), wv(0))))
            End If
          Next
        End If

        If f Then
          If (bv And (v Mod 2)) Then
            mv.add(S.PointAt(0, (1 / (V - 1)) * ta))
            If bu = False Then
              mf.add(New meshface(k, uvc(0, 0), uvd(0, wv(v - 2)), tk(1)))
              mf.add(New meshface(k, uvc(0, 0), uvb(0, 0)))
            End If
            mf.add(New meshface(uvc(0, 0), uvd(0, wv(v - 2)), uva(1, 0)))
            k += 1
          ElseIf  (bu And (u Mod 2)) Then
            mv.add(S.PointAt((1 / (U - 1)) * t, 0))
            mf.add(New meshface(k, uvc(0, 0), uva(1, 0)))
            mf.add(New meshface(k, uvc(0, 0), uvc(wu(u - 2), wv(0)), tk(0)))
            mf.add(New meshface(uvc(0, 0), uvc(wu(u - 2), wv(0)), uvb(0, 0)))
            k += 1
          Else
            mv.add(S.PointAt(0, (1 / (V - 1)) * ta))
            mv.add(s.PointAt(0, 0))
            mv.add(S.PointAt((1 / (U - 1)) * t, 0))
            mf.add(New meshface(k, uvc(0, 0), uvb(0, 0)))
            mf.add(New meshface(k, k + 1, k + 2, uvc(0, 0)))
            mf.add(New meshface(k + 2, uva(wu(1), 0), uvc(0, 0)))
            k += 3
          End If
        End If

        If (((f = False) And ((u + v) Mod 2)) Or (f And ((u + v + 1) Mod 2))) Then
          If (bv And (v Mod 2)) Then
          ElseIf  (bu And (u Mod 2)) Then
          Else
            mv.add(s.PointAt(1, 1))
            mf.add(New meshface(k, tk(2), uvd(wu(u - 2), wv(v - 2)), tk(3)))
            k += 1
          End If
        End If

        If ((f And (v Mod 2)) Or ((f = False) And ((v + 1) Mod 2))) Then
          If (bv And (v Mod 2)) Then
            If (((u + 1) Mod 2) And bu ) Then
              mv.add(S.PointAt(1, (1 / (V - 1)) * ta))
              mf.add(New meshface(uvc(wu(0), wv(v - 1)), k, tk(1), uvd(0, wv(v - 2))))
              mf.add(New meshface(k, uvc(wu(0), wv(v - 1)), uvb(wu(0), wv(v - 1))))
              k += 1
            End If
          ElseIf  (bu And (u Mod 2)) Then
            mv.add(s.PointAt((1 / (U - 1)) * t, 1))
            mf.add(New meshface(uva(wu(1), wv(v - 1)), k, uvd(0, wv(v - 2))))
            mf.add(New meshface(tk(2), k, uvd(0, wv(v - 2)), uvd(wu(u - 2), wv(v - 2))))
            k += 1
          Else
            mv.add(s.PointAt((1 / (U - 1)) * t, 1))
            mv.add(s.PointAt(0, 1))
            mf.add(New meshface(uva(1, wv(v - 1)), k, uvd(0, wv(v - 2))))
            mf.add(New meshface(k + 1, tk(1), uvd(0, wv(v - 2)), k))
            k += 2
          End If
        End If

        If ((f And (u Mod 2)) Or ((f = False) And ((u + 1) Mod 2))) Then
          If (bv And (bu = False) And (v Mod 2)) Then
            mv.add(S.PointAt(1, (1 / (V - 1)) * ta))
            mf.add(New meshface(uvc(wu(u - 2), 0), k, uvb(wu(u - 1), 0)))
            mf.add(New meshface(uvc(wu(u - 2), 0), k, tk(3), uvd(wu(u - 2), wv(v - 2))))
            k += 1
          ElseIf  (bu And (u Mod 2)) Then
          Else
            mv.add(S.PointAt(1, (1 / (V - 1)) * ta))
            mv.add(s.PointAt(1, 0))
            mf.add(New meshface(uvc(wu(u - 2), 0), k, uvb(wu(u - 1), 0)))
            If (bv And (v Mod 2)) Then
              mf.add(New meshface(k, uvc(wu(u - 2), 0), uvd(wu(u - 2), wv(v - 2)), tk(3)))
            ElseIf ((v + 1) Mod 2) Then
              mf.add(New meshface(tk(0), k + 1, k, uvc(wu(u - 2), 0)))
            Else
              mf.add(New meshface(tk(0), k + 1, k, uvc(wu(u - 2), 0)))
            End If
            k += 2
          End If
        End If

        If (f And bu And bv And (u Mod 2) And (v Mod 2)) Then
          mf.add(New meshface(uvc(wu(u - 2), 0), uvc(wu(0), wv(0)), uvb(0, 0)))
          mf.add(New meshface(uvc(wu(0), wv(0)), uvc(wu(u - 2), 0), uvd(wu(u - 2), wv(v - 2)), uvd(0, wv(v - 2))))
        End If
      End If

      mo.Vertices.AddVertices(mv.toarray())
      mo.Faces.AddFaces(mf.toarray())
      mo.FaceNormals.ComputeFaceNormals()
      mo.Normals.ComputeNormals()
      
      M = mo
    End If
# ---------- m_rhombitrihexagonal: VB additional code ----------
  Private Function appendprepend(ByVal i As Integer)
    Dim srsEnum As IEnumerable(Of Integer) = Enumerable.Range(0, i - 1)
    Dim arrVal As New list(Of Integer)
    arrVal = srsEnum.tolist()
    arrVal.add(0)
    Return arrVal
  End Function

  Private Function series(ByVal i As Integer)
    Dim srsEnum As IEnumerable(Of Integer) = Enumerable.Range(0, i)
    Dim arrVal As New list(Of Integer)
    arrVal = srsEnum.tolist()
    Return arrVal
  End Function

  Private Function evalP(ByVal op As point3d, ByVal tp As Point3d, ByVal t As Double)
    Return New point3d(op + (tp - op) * t)
  End Function
# ---------- end m_rhombitrihexagonal ----------
m_cairo = CairoTiling(S=rulesrf, U=number_slider_13, V=number_slider_14, T=0.211325)  # -> out, M; inputs S: Surface; disabled
# ---------- m_cairo: VB ----------
    Component.Params.Input(0).Name = "Surface"
    Component.Params.Input(0).Description = "The base surface to mesh"
    Component.Params.Input(1).Name = "U Count"
    Component.Params.Input(1).Description = "The number of quads in the U direction"
    Component.Params.Input(2).Name = "V Count"
    Component.Params.Input(2).Description = "The number of quads in the V direction"
    Component.Params.Input(3).Name = "Evaluate"
    Component.Params.Input(3).Description = "A unitized value which symmetrically shifts the location of internal vertices within each new quad"

    Component.Params.Output(1).Name = "Mesh"
    Component.Params.Output(1).Description = "If successful, the resulting mesh"

    If s IsNot Nothing Then
      Dim i,j,k As Integer
      Dim wu,wv As New list(Of Integer)
      Dim bu, bv As Boolean
      Dim cu, cv,au,av As Integer
      Dim arrPts As New list(Of point3d)
      Dim arrFaces As New list(Of MeshFace)
      Dim mo As New mesh
      Dim mv As New list(Of point3d)
      Dim mf As New list(Of meshface)
      Dim uva(,) As Integer
      Dim uvb(,) As Integer
      Dim uvc(,) As Integer

      U += 1
      V += 1
      bu = s.IsClosed(0)
      bv = s.IsClosed(1)

      S.SetDomain(0, New interval(0, 1))
      S.SetDomain(1, New interval(0, 1))

      If (bu And (u Mod 2)) Then
        wu = appendprepend(U)
        cu = u - 1
        au = 1
      Else
        wu = series(U)
        cu = u
        au = 0
      end if

      If (bv And (v Mod 2)) Then
        wv = appendprepend(V)
        cv = v - 1
        av = 1
      Else
        wv = series(V)
        cV = v
        av = 0
      End If

      ReDim uva(cu - 1, cv - 1)
      ReDim uvb(cu - 1, cv - 1)
      ReDim uvc(cu - 1, cv - 1)

      For i = 0 To cu - 1 Step 1
        For j = 0 To cv - 1 Step 1
          mv.add(S.PointAt(i * (1 / (U - 1)), j * (1 / (V - 1))))
          uva(i, j) = k
          k += 1
        Next
      Next

      For i = 0 To cu - 1 Step 1
        For j = 0 To cv - 1 Step 1
          Dim pt(1) As point3d

          pt(0) = S.PointAt(i * (1 / (U - 1)), j * (1 / (V - 1)))
          pt(1) = S.PointAt(i * (1 / (U - 1)), (j + 1) * (1 / (V - 1)))

          mv.add(evalP(pt((i + j) Mod 2), pt((i + j + 1) Mod 2), t))
          uvb(i, j) = k
          k += 1
        Next
      Next

      For i = 0 To u - 2 Step 1
        For j = 0 To cv - 1 Step 1
          Dim pt(1) As point3d

          pt(0) = S.PointAt((i + 1) * (1 / (U - 1)), j * (1 / (V - 1)))
          pt(1) = S.PointAt(i * (1 / (U - 1)), j * (1 / (V - 1)))

          mv.add(evalP(pt((i + j) Mod 2), pt((i + j + 1) Mod 2), t))
          uvc(i, j) = k
          k += 1
        Next
      Next

      For i = 0 To cu - 1 Step 1
        For j = 0 To v - 2 Step 1
          mv.add(S.PointAt((1 / (U - 1)) / 2 + i * (1 / (U - 1)), (1 / (V - 1)) / 2 + j * (1 / (V - 1))))
        Next
      Next

      For i = 0 To u - 2 Step 1
        For j = 0 To v - 2 Step 1
          mf.add(New MeshFace(uvc(i, j), k, uvb(wu(i), j), uva(wu(i), j)))
          mf.add(New MeshFace(uvb(wu(i), j), k, uvc(i, wv(j + 1)), uva(wu(i), wv(j + 1))))
          mf.add(New MeshFace(uvc(i, wv(j + 1)), k, uvb(wu(i + 1), j), uva(wu(i + 1), wv(j + 1))))
          mf.add(New MeshFace(uvb(wu(i + 1), j), k, uvc(i, j), uva(wu(i + 1), j)))
          k += 1
        Next
      Next
      mo.Vertices.AddVertices(mv.toarray())
      mo.Faces.AddFaces(mf.toarray())
      mo.FaceNormals.ComputeFaceNormals()
      mo.Normals.ComputeNormals()
      

      M = mo
    End If
# ---------- m_cairo: VB additional code ----------
  Private Function appendprepend(ByVal i As Integer)
    Dim srsEnum As IEnumerable(Of Integer) = Enumerable.Range(0, i - 1)
    Dim arrVal As New list(Of Integer)
    arrVal = srsEnum.tolist()
    arrVal.add(0)
    Return arrVal
  End Function

  Private Function series(ByVal i As Integer)
    Dim srsEnum As IEnumerable(Of Integer) = Enumerable.Range(0, i)
    Dim arrVal As New list(Of Integer)
    arrVal = srsEnum.tolist()
    Return arrVal
  End Function

  Private Function evalP(ByVal op As point3d, ByVal tp As Point3d, ByVal t As Double)
    Return New point3d(op + (tp - op) * t)
  End Function
# ---------- end m_cairo ----------
munion = MeshUnion(Meshes=item_12)  # disabled
qrmesh = QuadRemesh(Geometry=munion, Settings=qrsettings)  # disabled
toggle = BooleanToggle(True)  # disabled
m_box = Box(G0=qrmesh, T0=0.5, T1=0.5, D=number_slider_10, C=toggle, F=False)  # -> out, A; inputs G0: GeometryBase, G1: GeometryBase, I: list, T0: list, T1: list, clr: list of Color; disabled
# ---------- m_box: VB usings ----------
Imports System.IO
Imports System.Linq
Imports System.Data
Imports System.Drawing
Imports System.Reflection
Imports System.Windows.Forms
Imports System.Xml
Imports System.Xml.Linq
Imports Microsoft.VisualBasic
Imports System.Runtime.InteropServices

Imports Rhino.DocObjects
Imports Rhino.Collections
Imports GH_IO
Imports GH_IO.Serialization
# ---------- m_box: VB ----------
    Component.Params.Input(0).Name = "Mesh or Curve"
    Component.Params.Input(0).Description = "Open or closed mesh or curve"
    Component.Params.Input(1).Name = "Mesh or Curve"
    Component.Params.Input(1).Description = "Optional open or closed mesh or curve whose type should correspond to G0."
    Component.Params.Input(2).Name = "Index [Face]"
    Component.Params.Input(2).Description = "An optional integer or list of integers which specify the faces to be modified if the input is a mesh. If no value is supplied then all faces will be modified"
    Component.Params.Input(3).Name = "From Vert [Vertex]"
    Component.Params.Input(3).Description = "Evaluates a new vertex from the input geometry's vertex"
    Component.Params.Input(4).Name = "Transverse [Vertex]"
    Component.Params.Input(4).Description = "Evaluates a new vertex between G0 and G1"
    Component.Params.Input(5).Name = "Distance"
    Component.Params.Input(5).Description = "An optional number to add depth if no input is provided for G1"
    Component.Params.Input(6).Name = "Close"
    Component.Params.Input(6).Description = "If true then additional faces and if needed vertices will be added to the mesh, closing the solid"
    Component.Params.Input(7).Name = "Flip"
    Component.Params.Input(7).Description = "If true, flips the topology"
    Component.Params.Input(8).Name = "Color [Vertex]"
    Component.Params.Input(8).Description = "(If applied to a mesh a list of colors corresponding to each mesh face, if applied to a curve, a list of colors corresponding to each control point plus an additonal color value for the new averaged center"

    Component.Params.Output(1).Name = "Mesh"
    Component.Params.Output(1).Description = "If successful, a valid mesh"

    If G0 IsNot Nothing Then

      Dim bG,bM, bP,bmC,biC As Boolean

      bM = G0.ObjectType = ObjectType.Mesh
      bP = G0.ObjectType = ObjectType.Curve

      bG = (bM Or bP)
      If G1 IsNot Nothing Then
        If bM And G1.ObjectType <> ObjectType.Mesh Then bG = False
        If bP And G1.ObjectType <> ObjectType.Curve Then bG = False
      End If

      If bG Then
        Dim msh,msha,mshe As New mesh
        Dim crv,crva As curve
        Dim av(2) As point3d
        Dim ac(2),ax(1) As color
        Dim h,j,jj,k,u,v,ua,ub,va,vb,w As Integer
        Dim cv,cf,ce,dcv As Integer
        Dim x(),y() As Integer
        Dim bnk() As Boolean = Nothing

        Dim mv,fv,ep,tv,ecv,np As New list(Of Point3d)
        Dim mev,mvv As New dictionary(Of String, Integer)
        Dim mf As Rhino.Geometry.Collections.MeshFaceList = Nothing
        Dim mtv As Rhino.Geometry.Collections.MeshTopologyVertexList = Nothing
        Dim mte As Rhino.Geometry.Collections.MeshTopologyEdgeList = Nothing
        Dim ev As New list(Of vector3d)
        Dim ed As New list(Of Double)
        Dim en As New list(Of Boolean)
        Dim mc,ec,tc,cc,fc,ecc,nc As New list(Of color)
        Dim xf As New list(Of meshface)

        If clr.count() = 0 Then clr.add(color.LightGray) Else biC = True

        If bm Then
          'Start Deconstruct if Mesh
          msh = G0

          mshe = msh.Duplicate()
          mte = mshe.TopologyEdges()
          mtv = mshe.TopologyVertices()
          mf = mshe.Faces()

          bnk = mshe.GetNakedEdgePointStatus()

          If G1 IsNot Nothing Then
            msha = G1

            If msh.Vertices.Count() <> msha.vertices.count() Then Exit Sub
          Else
            msha = msh.Offset(-d)
          End If

          msh.Append(msha)

          If i.count() = 0 Then I = Enumerable.Range(0, mf.Count()).ToList()

          mv = msh.Vertices().ToPoint3dArray().tolist()

          cf = I.Count()

          'Assign Colors
          If mshe.VertexColors.Count() < 1 Then
            mshe.VertexColors.CreateMonotoneMesh(color.LightGray)
            bmC = biC
          Else
            bmC = True
          End If

          If msha.VertexColors.Count() > 0 Then bmC = True

          mc = mshe.VertexColors().ToArray().ToList()
          If msha.VertexColors.count() < 1 Then mc.addrange(mc) Else mc.addrange(msha.VertexColors().ToArray().ToList())
        Else
          'Start Deconstruct if Curve
          crv = G0

          I.clear()
          I.add(0)
          Dim nbc As nurbscurve
          Dim pc As polyline
          Dim nps As Rhino.Geometry.Collections.NurbsCurvePointList

          nbc = crv.ToNurbsCurve()
          nps = nbc.Points
          pc = nbc.Points.ControlPolygon
          If (Not pc.IsClosed) Then pc.add(pc(0))
          av(0) = pc.CenterPoint

          msh.Vertices.AddVertices(pc.ToArray())
          msh.faces.addfaces(pc.TriangulateClosedPolyline())
          msh.Vertices.Remove(pc.count() - 1, True)

          mv = msh.Vertices.ToPoint3dArray().tolist()
          mte = msh.TopologyEdges()
          mtv = msh.TopologyVertices()

          ReDim bnk(mv.count() - 1)
          For j = 0 To mv.count() - 1 Step 1
            bnk(j) = True
          Next

          'Assign Colors
          If bic Then bmC = True

          If G1 IsNot Nothing Then
            crva = G1
            nbc = crva.ToNurbsCurve()
            nps = nbc.Points
            pc = nbc.Points.ControlPolygon
            If (Not pc.IsClosed) Then pc.add(pc(0))
            av(1) = pc.CenterPoint
            pc.RemoveAt(pc.count() - 1)

            If pc.count() <> mv.count() Then Exit Sub

            cf = 1
            mv.addrange(pc)
          Else
            Dim tcpt As point3d
            msh.Normals.ComputeNormals()
            msh.Normals.UnitizeNormals()
            k = mv.count()
            For j = 0 To k - 1 Step 1
              mv.add(mv.item(j) + msh.Normals(j) * d)
              tcpt += mv.item(j) + msh.Normals(j) * d
            Next

            cf = 1
            av(1) = tcpt / k
          End If

        End If
        ce = mte.count()
        cv = mv.count() / 2
        dcv = mv.count()

        x = appendprepend(cv - 1)
        'Match variables and colors to vertex count
        If (T0.count()) < cv Then T0 = dblDList(matchDbl(T0, cv)) Else If (T0.count()) = cv Then T0.addrange(T0) Else If (T0.count()) < dcv Then T0 = matchDbl(T0, dcv)
        If (T1.count()) < cv Then T1 = dblDList(matchDbl(T1, cv)) Else If (T1.count()) = cv Then T1.addrange(T1) Else If (T1.count()) < dcv Then T1 = matchDbl(T1, dcv)
        If (clr.count()) < cv Then clr = dblCList(matchClr(clr, cv)) Else If (clr.count()) = cv Then clr.addrange(clr)Else If (clr.count()) < dcv Then clr = matchClr(clr, dcv)

        If bp Then
          mc = clr
          ac = colorCap(mc)
        End If

        'Edge based vertices
        k = 0
        Dim cpt As point3d
        Dim ccl As color
        Dim bce As Boolean

        Dim tpt(3) As point3d
        Dim tcl(3) As color
        jj = 0
        For j = 0 To ce - 1 Step 1
          If (bm Or (bp And (mte.GetConnectedFaces(j).Count() < 2))) Then
            ua = mtv.MeshVertexIndices(mte.GetTopologyVertices(j).I)(0)
            va = mtv.MeshVertexIndices(mte.GetTopologyVertices(j).J)(0)

            ub = ua + cv
            vb = va + cv

            cpt = (mv(ua) + mv(va) + mv(ub) + mv(vb)) / 4
            ccl = avg4Clr(mc(ua), mc(va), mc(ub), mc(vb))
            bce = mte.GetConnectedFaces(j).count() <> 2

            tpt(0) = evalP(mv(ua), mv(va), t0(ua) / 2)
            tcl(0) = evalC(mc(ua), mc(va), t0(ua) / 2)
            tpt(1) = evalP(mv(va), mv(ua), t0(va) / 2)
            tcl(1) = evalC(mc(va), mc(ua), t0(va) / 2)
            tpt(2) = evalP(mv(ub), mv(vb), t0(ub) / 2)
            tcl(2) = evalC(mc(ub), mc(vb), t0(ub) / 2)
            tpt(3) = evalP(mv(vb), mv(ub), t0(vb) / 2)
            tcl(3) = evalC(mc(vb), mc(ub), t0(vb) / 2)

            'To the Face Center
            ep.add(evalP(tpt(0), tpt(2), t1(ua) / 2))
            ec.add(evalC(tcl(0), tcl(2), t1(ua) / 2))
            en.add(bce)
            mev.add(ua & "," & va & "," & 0, k)

            ep.add(evalP(tpt(2), tpt(0), t1(ub) / 2))
            ec.add(evalC(tcl(2), tcl(0), t1(ub) / 2))
            en.add(bce)
            mev.add(ub & "," & vb & "," & 0, k + 1)

            ep.add(evalP(tpt(1), tpt(3), t1(va) / 2))
            ec.add(evalC(tcl(1), tcl(3), t1(va) / 2))
            en.add(bce)
            mev.add(va & "," & ua & "," & 0, k + 2)

            ep.add(evalP(tpt(3), tpt(1), t1(vb) / 2))
            ec.add(evalC(tcl(3), tcl(1), t1(vb) / 2))
            en.add(bce)
            mev.add(vb & "," & ub & "," & 0, k + 3)

            If (c And f) Then
              ecv.add(evalP((mv(ua) + mv(va)) / 2, (mv(ub) + mv(vb)) / 2, (t1(ua) + t1(va)) / 4))
              ecc.add(evalC(evalC(mc(ua), mc(va), 0.5), evalC(mc(ub), mc(vb), 0.5), (t1(ua) + t1(va)) / 4))
              mev.add(ua & "," & va & "," & 3, jj)
              mev.add(va & "," & ua & "," & 3, jj)

              ecv.add(evalP((mv(ub) + mv(vb)) / 2, (mv(ua) + mv(va)) / 2, (t1(ub) + t1(vb)) / 4))
              ecc.add(evalC(evalC(mc(ub), mc(vb), 0.5), evalC(mc(ua), mc(va), 0.5), (t1(ub) + t1(vb)) / 4))
              mev.add(ub & "," & vb & "," & 3, jj + 1)
              mev.add(vb & "," & ub & "," & 3, jj + 1)

              jj += 2
            End If

            If f Then
              ep.add(tpt(0))
              ec.add(tcl(0))
              en.add(bce)
              mev.add(ua & "," & va & "," & 1, k + 4)

              ep.add(tpt(1))
              ec.add(tcl(1))
              en.add(bce)
              mev.add(va & "," & ua & "," & 1, k + 5)

              ep.add(tpt(2))
              ec.add(tcl(2))
              en.add(bce)
              mev.add(ub & "," & vb & "," & 1, k + 6)

              ep.add(tpt(3))
              ec.add(tcl(3))
              en.add(bce)
              mev.add(vb & "," & ub & "," & 1, k + 7)

              ep.add((mv(ua) + mv(va)) / 2)
              ec.add(evalC(mc(ua), mc(va), 0.5))
              en.add(bce)
              mev.add(ua & "," & va & "," & 2, k + 8)
              mev.add(va & "," & ua & "," & 2, k + 8)

              ep.add((mv(ub) + mv(vb)) / 2)
              ec.add(evalC(mc(ub), mc(vb), 0.5))
              en.add(bce)
              mev.add(ub & "," & vb & "," & 2, k + 9)
              mev.add(vb & "," & ub & "," & 2, k + 9)

              k += 10
            Else
              k += 4
            End If
          End If
        Next

        k = 0
        For j = 0 To (bnk.Length - 1) Step 1
          np.add(mv(j))
          nc.add(mc(j))
          mvv.add(j & "," & j + cv & "," & 0, k)

          np.add(mv(j + cv))
          nc.add(mc(j + cv))
          mvv.add(j + cv & "," & j & "," & 0, k + 1)

          k += 2
        Next

        'Face based vertices
        Dim xv(),mt(),ei(),xi() As Integer
        Dim xca(),xcb(),xta(),xtb() As color
        Dim xn(1) As Double
        ReDim ei(17)
        ReDim xi(1)
        u = 4
        If f Then u += 4
        v += ep.count()
        If (Not f) Then v += np.count()
        If (c And f) Then v += ecv.count()

        For jj = 0 To I.count() - 1 Step 1
          Dim tcv As New point3d
          j = I(jj)
          w = v + tv.count()
          xn(0) = 0
          xn(1) = 0
          If bm Then
            If mf(j).isquad() Then h = 4 Else h = 3
            ReDim xv(h - 1)
            ReDim xca(h - 1)
            ReDim xcb(h - 1)
            ReDim xta(h - 1)
            ReDim xtb(h - 1)
            mt = mf.GetTopologicalVertices(j)
            For k = 0 To h - 1 Step 1
              xv(k) = mtv.MeshVertexIndices(mt(k))(0)
              xca(k) = mc(xv(k))
              xcb(k) = mc(xv(k) + cv)
              xta(k) = clr(xv(k))
              xtb(k) = clr(xv(k) + cv)
            Next
            av(0) = mf.GetFaceCenter(j)
            av(1) = msh.faces.GetFaceCenter(j + cf)
            ac(0) = avgClr(xca)
            ac(1) = avgClr(xcb)
            ax(0) = avgClr(xta)
            ax(1) = avgClr(xtb)
            If biC Then ac(2) = sumC(ax(0), ax(1)) Else ac(2) = sumC(ac(0), ac(1))
          Else
            h = cv
            xv = Enumerable.Range(0, h).ToArray()
          End If
          For k = 0 To h - 1 Step 1
            xn(0) += T0(xv(k))
            xn(1) += T0(xv(k) + cv)
          Next
          xn(0) /= h
          xn(1) /= h
          av(2) = (av(0) + av(1)) / 2
          y = appendprepend(h - 1)

          For k = 1 To h Step 1
            ei(0) = mev.item(xv(y(k)) & "," & xv(y(k + 1)) & "," & 0)
            ei(1) = mev.item(xv(y(k + 1)) & "," & xv(y(k)) & "," & 0)
            ei(2) = mev.item(xv(y(k)) + cv & "," & xv(y(k + 1)) + cv & "," & 0)
            ei(3) = mev.item(xv(y(k + 1)) + cv & "," & xv(y(k)) + cv & "," & 0)

            If f Then
              ei(4) = mev.item(xv(y(k)) & "," & xv(y(k - 1)) & "," & 0)
              ei(5) = mev.item(xv(y(k)) + cv & "," & xv(y(k - 1)) + cv & "," & 0)

              ei(6) = mev.item(xv(y(k)) & "," & xv(y(k + 1)) & "," & 1)
              ei(7) = mev.item(xv(y(k)) & "," & xv(y(k - 1)) & "," & 1)

              ei(8) = mev.item(xv(y(k)) + cv & "," & xv(y(k + 1)) + cv & "," & 1)
              ei(9) = mev.item(xv(y(k)) + cv & "," & xv(y(k - 1)) + cv & "," & 1)

              ei(10) = mev.item(xv(y(k)) & "," & xv(y(k + 1)) & "," & 2)
              ei(11) = mev.item(xv(y(k)) & "," & xv(y(k - 1)) & "," & 2)

              ei(12) = mev.item(xv(y(k)) + cv & "," & xv(y(k + 1)) + cv & "," & 2)
              ei(13) = mev.item(xv(y(k)) + cv & "," & xv(y(k - 1)) + cv & "," & 2)

              tpt(0) = evalP((mv(xv(y(k))) + mv(xv(y(k + 1)))) / 2, av(0), (t0(xv(y(k))) + t0(xv(y(k + 1)))) / 2)
              tcl(0) = evalC(evalC(mc(xv(y(k))), mc(xv(y(k + 1))), 0.5), ac(0), (t0(xv(y(k))) + t0(xv(y(k + 1)))) / 2)
              tpt(1) = evalP((mv(xv(y(k)) + cv) + mv(xv(y(k + 1)) + cv)) / 2, av(1), (t0(xv(y(k)) + cv) + t0(xv(y(k + 1)) + cv)) / 2)
              tcl(1) = evalC(evalC(mc(xv(y(k)) + cv), mc(xv(y(k + 1)) + cv), 0.5), ac(1), (t0(xv(y(k)) + cv) + t0(xv(y(k + 1)) + cv)) / 2)
            Else
              tpt(0) = evalP(mv(xv(y(k))), av(0), t0(xv(y(k))))
              tcl(0) = evalC(mc(xv(y(k))), ac(0), t0(xv(y(k))))
              tpt(1) = evalP(mv(xv(y(k)) + cv), av(1), t0(xv(y(k)) + cv))
              tcl(1) = evalC(mc(xv(y(k)) + cv), ac(1), t0(xv(y(k)) + cv))
            End If
            tpt(2) = evalP(tpt(0), tpt(1), t1(xv(y(k))) / 2)
            tcl(2) = evalC(tcl(0), ac(2), t1(xv(y(k))))
            tpt(3) = evalP(tpt(1), tpt(0), t1(xv(y(k)) + cv) / 2)
            tcl(3) = evalC(tcl(1), ac(2), t1(xv(y(k)) + cv))

            'Define new per face vertices
            tv.add(tpt(0))
            tc.add(tcl(0))

            tv.add(tpt(1))
            tc.add(tcl(1))

            tv.add(tpt(2))
            tc.add(tcl(2))

            tv.add(tpt(3))
            tc.add(tcl(3))

            'Define new faces
            If f Then
              tv.add((tpt(2) + ep(ei(0))) / 2)
              tc.add(evalC(tcl(2), ec(ei(0)), 0.5))

              tv.add((tpt(2) + ep(ei(1))) / 2)
              tc.add(evalC(tcl(2), ec(ei(1)), 0.5))

              tv.add((tpt(3) + ep(ei(2))) / 2)
              tc.add(evalC(tcl(3), ec(ei(2)), 0.5))

              tv.add((tpt(3) + ep(ei(3))) / 2)
              tc.add(evalC(tcl(3), ec(ei(3)), 0.5))

              xf.add(New meshface(ei(0), ei(4), ei(7), ei(6)))
              xf.add(New meshface(ei(11), ei(10), ei(6), ei(7)))
              xf.add(New meshface(ei(11), w + y(k - 1) * u + 0, w + y(k) * u + 0, ei(10)))
              xf.add(New meshface(w + y(k) * u + 4, w + y(k) * u + 2, w + y(k - 1) * u + 2, w + y(k - 1) * u + 5))
              xf.add(New meshface(ei(0), w + y(k) * u + 4, w + y(k - 1) * u + 5, ei(4)))
              xf.add(New meshface(w + y(k) * u + 4, ei(0), ei(2), w + y(k) * u + 6))
              xf.add(New meshface(w + y(k) * u + 2, w + y(k) * u + 4, w + y(k) * u + 6, w + y(k) * u + 3))
              xf.add(New meshface(w + y(k) * u + 0, w + y(k) * u + 2, w + y(k + 1) * u + 2, w + y(k + 1) * u + 0))
              xf.add(New meshface(ei(4), w + y(k - 1) * u + 5, w + y(k - 1) * u + 7, ei(5)))
              xf.add(New meshface(w + y(k - 1) * u + 2, w + y(k - 1) * u + 3, w + y(k - 1) * u + 7, w + y(k - 1) * u + 5))
              xf.add(New meshface(w + y(k) * u + 6, ei(2), ei(5), w + y(k - 1) * u + 7))
              xf.add(New meshface(w + y(k) * u + 3, w + y(k) * u + 6, w + y(k - 1) * u + 7, w + y(k - 1) * u + 3))
              xf.add(New meshface(ei(2), ei(8), ei(9), ei(5)))
              xf.add(New meshface(ei(8), ei(12), ei(13), ei(9)))
              xf.add(New meshface(ei(12), w + y(k) * u + 1, w + y(k - 1) * u + 1, ei(13)))
              xf.add(New meshface(w + y(k) * u + 1, w + y(k) * u + 3, w + y(k - 1) * u + 3, w + y(k - 1) * u + 1))

            Else
              xf.add(New meshface(ep.count() + xv(y(k + 1)) * 2, ep.count() + xv(y(k)) * 2, w + y(k) * u + 0, w + y(k + 1) * u + 0))
              xf.add(New meshface(w + y(k) * u + 0, w + y(k) * u + 2, w + y(k + 1) * u + 2, w + y(k + 1) * u + 0))
              xf.add(New meshface(w + y(k) * u + 2, ei(0), ei(1), w + y(k + 1) * u + 2))
              xf.add(New meshface(ei(0), w + y(k) * u + 2, w + y(k) * u + 3, ei(2)))
              xf.add(New meshface(w + y(k + 1) * u + 2, ei(1), ei(3), w + y(k + 1) * u + 3))
              xf.add(New meshface(ei(2), w + y(k) * u + 3, w + y(k + 1) * u + 3, ei(3)))
              xf.add(New meshface(w + y(k) * u + 3, w + y(k) * u + 1, w + y(k + 1) * u + 1, w + y(k + 1) * u + 3))
              xf.add(New meshface(ep.count() + xv(y(k)) * 2 + 1, ep.count() + xv(y(k + 1)) * 2 + 1, w + y(k + 1) * u + 1, w + y(k) * u + 1))
            End If

            If c Then
              If en.item(ei(0)) Then
                If f Then
                  ei(14) = v - ecv.count() + mev.item(xv(y(k)) & "," & xv(y(k + 1)) & "," & 3)
                  ei(15) = v - ecv.count() + mev.item(xv(y(k)) + cv & "," & xv(y(k + 1)) + cv & "," & 3)
                  ei(16) = mev.item(xv(y(k + 1)) & "," & xv(y(k)) & "," & 1)
                  ei(17) = mev.item(xv(y(k + 1)) + cv & "," & xv(y(k)) + cv & "," & 1)

                  xf.add(New meshface(ei(14), ei(0), ei(6), ei(10)))
                  xf.add(New meshface(ei(1), ei(14), ei(10), ei(16)))
                  xf.add(New meshface(ei(14), ei(1), ei(3), ei(15)))
                  xf.add(New meshface(ei(2), ei(0), ei(14), ei(15)))
                  xf.add(New meshface(ei(2), ei(15), ei(12), ei(8)))
                  xf.add(New meshface(ei(17), ei(12), ei(15), ei(3)))

                Else
                  xf.add(New meshface(ei(1), ei(0), ep.count() + xv(y(k)) * 2, ep.count() + xv(y(k + 1)) * 2))
                  xf.add(New meshface(ei(0), ei(2), ep.count() + xv(y(k)) * 2 + 1, ep.count() + xv(y(k)) * 2))
                  xf.add(New meshface(ei(2), ei(3), ep.count() + xv(y(k + 1)) * 2 + 1, ep.count() + xv(y(k)) * 2 + 1))
                  xf.add(New meshface(ei(3), ei(1), ep.count() + xv(y(k + 1)) * 2, ep.count() + xv(y(k + 1)) * 2 + 1))
                End If
              End If
            End If
          Next
          fv.add(evalP(av(2), av(0), xn(0)))
          cc.add(evalC(ac(2), ac(0), xn(0)))

          fv.add(evalP(av(2), av(1), xn(1)))
          cc.add(evalC(ac(2), ac(1), xn(1)))
        Next

        Dim om As New mesh
        om.Vertices.AddVertices(ep.toarray())
        If bmC Then om.VertexColors.AppendColors(ec.toarray())
        If (Not f) Then
          om.Vertices.AddVertices(np.toarray())
          If bmC Then om.VertexColors.AppendColors(nc.toarray())
        End If

        If (c And f) Then
          om.Vertices.AddVertices(ecv.toarray())
          If bmC Then om.VertexColors.AppendColors(ecc.toarray())
        End If

        om.Vertices.AddVertices(tv.toarray())
        If bmC Then om.VertexColors.AppendColors(tc.toarray())

        om.Faces.AddFaces(xf.toarray())


        'If i.count() > 0 Then om.Vertices.CullUnused()

        A = om
      End If
    End If
# ---------- m_box: VB additional code ----------
  Private Function appendprepend(ByVal i As Integer)
    Dim srsEnum As IEnumerable(Of Integer) = Enumerable.Range(0, i + 1)
    Dim arrVal As New list(Of Integer)
    arrVal = srsEnum.tolist()
    arrVal.add(0)
    arrVal.insert(0, i)
    Return arrVal.toarray()
  End Function

  Private Function colorCap(ByVal c As list(Of color))
    Dim i,k As Integer
    k = c.count() / 2
    Dim r(2),g(2),b(2) As Integer
    For i = 0 To k - 1 Step 1
      r(0) += c.item(i).R
      r(1) += c.item(i + k).R
      g(0) += c.item(i).g
      g(1) += c.item(i + k).g
      b(0) += c.item(i).b
      b(1) += c.item(i + k).b
    Next

    r(0) = CInt(r(0) / k)
    r(1) = CInt(r(1) / k)
    g(0) = CInt(g(0) / k)
    g(1) = CInt(g(1) / k)
    b(0) = CInt(b(0) / k)
    b(1) = CInt(b(1) / k)

    r(2) = CInt((r(0) + r(1)) / 2)
    g(2) = CInt((g(0) + g(1)) / 2)
    b(2) = CInt((b(0) + b(1)) / 2)

    If r(0) > 255 Then r(0) = 255 Else If r(0) < 0 Then r(0) = 0
    If r(1) > 255 Then r(1) = 255 Else If r(1) < 0 Then r(1) = 0
    If g(0) > 255 Then g(0) = 255 Else If g(0) < 0 Then g(0) = 0
    If g(1) > 255 Then g(1) = 255 Else If g(1) < 0 Then g(1) = 0
    If b(0) > 255 Then b(0) = 255 Else If b(0) < 0 Then b(0) = 0
    If b(1) > 255 Then b(1) = 255 Else If b(1) < 0 Then b(1) = 0

    If r(2) > 255 Then r(2) = 255 Else If r(2) < 0 Then r(2) = 0
    If g(2) > 255 Then g(2) = 255 Else If g(2) < 0 Then g(2) = 0
    If b(2) > 255 Then b(2) = 255 Else If b(2) < 0 Then b(2) = 0

    Return {color.FromArgb(r(0), G(0), b(0)),color.FromArgb(r(1), G(1), b(1)),color.FromArgb(r(2), G(2), b(2))}
  End Function

  Private Function dblCList(ByVal a As list(Of color))
    a.addrange(a)
    Return a
  End Function

  Private Function dblDList(ByVal a As list(Of Double))
    a.addrange(a)
    Return a
  End Function

  Private Function matchDbl(ByVal a As list(Of Double), ByVal t As Integer)
    Dim i,k As Integer
    k = a.count()
    For i = 0 To ((t + 1) - k) - 1 Step 1
      a.add(a.item(k - 1))
    Next
    Return a
  End Function

  Private Function matchClr(ByVal a As list(Of Color), ByVal t As Integer)
    Dim i,k As Integer
    k = a.count()
    For i = 0 To ((t + 1) - k) - 1 Step 1
      a.add(a.item(k - 1))
    Next
    Return a
  End Function

  Private Function sumC(ByVal ca As Color, ByVal cb As Color)
    Dim r,g,b As Integer

    r = CInt((CInt(ca.R) + CInt(cb.R)) / 2)
    g = CInt((CInt(ca.g) + CInt(cb.g)) / 2)
    b = CInt((CInt(ca.b) + CInt(cb.b)) / 2)

    If r > 255 Then r = 255 Else If r < 0 Then r = 0
    If G > 255 Then G = 255 Else If G < 0 Then G = 0
    If b > 255 Then b = 255 Else If b < 0 Then b = 0

    Return color.FromArgb(r, G, b)
  End Function

  Private Function avg4Clr(ByVal ca As Color, ByVal cb As Color, ByVal cc As Color, ByVal cd As Color)
    Dim r,g,b As Integer

    r = CInt((CInt(ca.R) + CInt(cb.R) + CInt(cc.R) + CInt(cd.R)) / 4)
    g = CInt((CInt(ca.g) + CInt(cb.g) + CInt(cc.g) + CInt(cd.g)) / 4)
    b = CInt((CInt(ca.b) + CInt(cb.b) + CInt(cc.b) + CInt(cd.b)) / 4)

    If r > 255 Then r = 255 Else If r < 0 Then r = 0
    If G > 255 Then G = 255 Else If G < 0 Then G = 0
    If b > 255 Then b = 255 Else If b < 0 Then b = 0

    Return color.FromArgb(r, G, b)
  End Function

  Private Function evalP(ByVal op As point3d, ByVal tp As Point3d, ByVal t As Double)
    Return New point3d(op + (tp - op) * t)
  End Function

  Private Function evalV(ByVal ov As vector3d, ByVal tv As vector3d, ByVal t As Double)
    Return New vector3d(ov + (tv - ov) * t)
  End Function

  Private Function evalN(ByVal u As Double, ByVal v As Double, ByVal t As Double)
    Return u + (v - u) * t
  End Function

  Private Function avgVec(ByVal v() As vector3f)
    Dim i As Integer
    Dim tv As Vector3d

    For i = 0 To (v.Length - 1) Step 1
      tv += v(i)
    Next
    tv /= ((v.Length - 1) + 1)
    tv.Unitize()
    Return New vector3f(tv.X, tv.Y, tv.Z)
  End Function

  Private Function roundClr(ByVal r As Integer, ByVal G As Integer, ByVal b As Integer, ByVal i As Integer)
    r = CInt(r / i)
    G = CInt(G / i)
    b = CInt(b / i)

    If r > 255 Then r = 255 Else If r < 0 Then r = 0
    If G > 255 Then G = 255 Else If G < 0 Then G = 0
    If b > 255 Then b = 255 Else If b < 0 Then b = 0

    Return color.FromArgb(r, G, b)
  End Function

  Private Function avgClr(ByVal c() As color)
    Dim r,G,b As Integer
    Dim i,k As Integer

    k = (c.Length - 1) + 1

    For i = 0 To k - 1 Step 1
      r += CInt(c(i).R)
      G += CInt(c(i).G)
      b += CInt(c(i).B)
    Next

    r = CInt(r / k)
    G = CInt(G / k)
    b = CInt(b / k)

    If r > 255 Then r = 255 Else If r < 0 Then r = 0
    If G > 255 Then G = 255 Else If G < 0 Then G = 0
    If b > 255 Then b = 255 Else If b < 0 Then b = 0

    Return color.FromArgb(r, G, b)
  End Function

  Private Function evalC(ByVal oc As color, ByVal tc As color, ByVal t As Double)
    Dim r,G,b As Integer
    r = CInt(CInt(oc.R) + (CInt(tc.R) - CInt(oc.R)) * t)
    G = CInt(CInt(oc.G) + (CInt(tc.G) - CInt(oc.G)) * t)
    b = CInt(CInt(oc.B) + (CInt(tc.B) - CInt(oc.B)) * t)

    If r > 255 Then r = 255 Else If r < 0 Then r = 0
    If G > 255 Then G = 255 Else If G < 0 Then G = 0
    If b > 255 Then b = 255 Else If b < 0 Then b = 0

    Return color.FromArgb(r, G, b)
  End Function

  ''' <summary>
  ''' This method will be called once every solution, before any calls to RunScript.
  ''' </summary>
  Public Overrides Sub BeforeRunScript()
  End Sub
  ''' <summary>
  ''' This method will be called once every solution, after any calls to RunScript.
  ''' </summary>
  Public Overrides Sub AfterRunScript()
  End Sub
# ---------- end m_box ----------
m_f_rdr = FRDr(G0=qrmesh, T0=0.5, T1=0.75, T2=0.5, T3=0.5, D=number_slider_10, C=False, R=False)  # -> out, A; inputs G0: GeometryBase, G1: GeometryBase, I: list, T0: list, T1: list, T2: list, T3: list, clr: list of Color; disabled
# ---------- m_f_rdr: VB ----------
    Component.Params.Input(0).Name = "Mesh or Curve"
    Component.Params.Input(0).Description = "Open or closed mesh or curve"
    Component.Params.Input(1).Name = "Mesh or Curve"
    Component.Params.Input(1).Description = "Optional open or closed mesh or curve whose type should correspond to G0."
    Component.Params.Input(2).Name = "Index [Face]"
    Component.Params.Input(2).Description = "An optional integer or list of integers which specify the faces to be modified if the input is a mesh. If no value is supplied then all faces will be modified"
    Component.Params.Input(3).Name = "Along Edge [Vertex]"
    Component.Params.Input(3).Description = "Evaluates a new vertex along the input geometry's edge"
    Component.Params.Input(4).Name = "Edge to Edge [Vertex]"
    Component.Params.Input(4).Description = "Evaluates a new vertex transversing the input geometry's G0 and G1 edges"
    Component.Params.Input(5).Name = "Edge to Face [Vertex]"
    Component.Params.Input(5).Description = "Evaluates a new vertex between the input geometry's edge midpoint to the face center"
    Component.Params.Input(6).Name = "Face to Vol [Vertex]"
    Component.Params.Input(6).Description = "Evaluates a new vertex between the input geometry's face center to the volumetric center"
    Component.Params.Input(7).Name = "Distance"
    Component.Params.Input(7).Description = "An optional number to add depth if no input is provided for G1"
    Component.Params.Input(8).Name = "Close"
    Component.Params.Input(8).Description = "If true then additional faces and if needed vertices will be added to the mesh, closing the solid"
    Component.Params.Input(9).Name = "Invert"
    Component.Params.Input(9).Description = "If true the faces the close the mesh are reversed, flipping the solid/ void relationship"
    Component.Params.Input(10).Name = "Color [Vertex]"
    Component.Params.Input(10).Description = "(If applied to a mesh a list of colors corresponding to each mesh face, if applied to a curve, a list of colors corresponding to each control point plus an additonal color value for the new averaged center"

    Component.Params.Output(1).Name = "Mesh"
    Component.Params.Output(1).Description = "If successful, a valid mesh"

    If G0 IsNot Nothing Then

      Dim bG,bM,bP,bmC,biC As Boolean

      bM = G0.ObjectType = ObjectType.Mesh
      bP = G0.ObjectType = ObjectType.Curve

      bG = (bM Or bP)
      If G1 IsNot Nothing Then
        If bM And G1.ObjectType <> ObjectType.Mesh Then bG = False
        If bP And G1.ObjectType <> ObjectType.Curve Then bG = False
      End If

      If bG Then
        Dim msh,msha,mshe As New mesh
        Dim crv,crva As curve
        Dim av(2) As point3d
        Dim ac(2),ax(1) As color
        Dim h,j,jj,k,u,v,vv,ua,ub,va,vb,w As Integer
        Dim cv,cf,ce,dcv As Integer
        Dim x(),y() As Integer
        Dim bnk() As Boolean = Nothing

        Dim mv,fv,ep,tv,ecv,np,cfp As New list(Of Point3d)
        Dim mev,mvv,met As New dictionary(Of String, Integer)
        Dim mf As Rhino.Geometry.Collections.MeshFaceList = Nothing
        Dim mtv As Rhino.Geometry.Collections.MeshTopologyVertexList = Nothing
        Dim mte As Rhino.Geometry.Collections.MeshTopologyEdgeList = Nothing
        Dim ev As New list(Of vector3d)
        Dim ed As New list(Of Double)
        Dim en As New list(Of Boolean)
        Dim dir As New list(Of Integer)
        Dim mc,ec,tc,cc,fc,ecc,nc,cfc As New list(Of color)
        Dim xf As New list(Of meshface)

        Dim epo(),cpo() As Point3d
        Dim eco(),cco() As color

        If clr.count() = 0 Then clr.add(color.LightGray) Else biC = True

        If bm Then
          'Start Deconstruct if Mesh
          msh = G0

          mshe = msh.Duplicate()
          mtv = mshe.TopologyVertices()
          mte = mshe.TopologyEdges()
          mf = mshe.Faces()

          bnk = mshe.GetNakedEdgePointStatus()

          If G1 IsNot Nothing Then
            msha = G1

            If msh.Vertices.Count() <> msha.vertices.count() Then Exit Sub
          Else
            msha = msh.Offset(-d)
          End If

          msh.Append(msha)

          If i.count() = 0 Then I = Enumerable.Range(0, mf.Count()).ToList()

          mv = msh.Vertices().ToPoint3dArray().tolist()

          cf = I.Count()

          'Assign Colors
          If mshe.VertexColors.Count() < 1 Then
            mshe.VertexColors.CreateMonotoneMesh(color.LightGray)
            bmC = biC
          Else
            bmC = True
          End If

          If msha.VertexColors.Count() > 0 Then bmC = True

          mc = mshe.VertexColors().ToArray().ToList()
          If msha.VertexColors.count() < 1 Then mc.addrange(mc) Else mc.addrange(msha.VertexColors().ToArray().ToList())
        Else
          'Start Deconstruct if Curve
          crv = G0

          I.clear()
          I.add(0)
          Dim nbc As nurbscurve
          Dim pc As polyline
          Dim nps As Rhino.Geometry.Collections.NurbsCurvePointList

          nbc = crv.ToNurbsCurve()
          nps = nbc.Points
          pc = nbc.Points.ControlPolygon
          If (Not pc.IsClosed) Then pc.add(pc(0))
          av(0) = pc.CenterPoint

          msh.Vertices.AddVertices(pc.ToArray())
          msh.faces.addfaces(pc.TriangulateClosedPolyline())
          msh.Vertices.Remove(pc.count() - 1, True)

          mv = msh.Vertices.ToPoint3dArray().tolist()
          mte = msh.TopologyEdges()
          mtv = msh.TopologyVertices()

          ReDim bnk(mv.count() - 1)
          For j = 0 To mv.count() - 1 Step 1
            bnk(j) = True
          Next

          'Assign Colors
          If bic Then bmC = True

          If G1 IsNot Nothing Then
            crva = G1
            nbc = crva.ToNurbsCurve()
            nps = nbc.Points
            pc = nbc.Points.ControlPolygon
            If (Not pc.IsClosed) Then pc.add(pc(0))
            av(1) = pc.CenterPoint
            pc.RemoveAt(pc.count() - 1)

            If pc.count() <> mv.count() Then Exit Sub

            cf = 1
            mv.addrange(pc)
          Else
            Dim tcpt As point3d
            msh.Normals.ComputeNormals()
            msh.Normals.UnitizeNormals()
            k = mv.count()
            For j = 0 To k - 1 Step 1
              mv.add(mv.item(j) + msh.Normals(j) * d)
              tcpt += mv.item(j) + msh.Normals(j) * d
            Next

            cf = 1
            av(1) = tcpt / k
          End If

        End If
        ce = mte.count()
        cv = mv.count() / 2
        dcv = mv.count()

        x = appendprepend(cv - 1)
        'Match variables and colors to vertex count
        If (T0.count()) < cv Then T0 = dblDList(matchDbl(T0, cv)) Else If (T0.count()) = cv Then T0.addrange(T0) Else If (T0.count()) < dcv Then T0 = matchDbl(T0, dcv)
        If (T1.count()) < cv Then T1 = dblDList(matchDbl(T1, cv)) Else If (T1.count()) = cv Then T1.addrange(T1) Else If (T1.count()) < dcv Then T1 = matchDbl(T1, dcv)
        If (T2.count()) < cv Then T2 = dblDList(matchDbl(T2, cv)) Else If (T2.count()) = cv Then T2.addrange(T2) Else If (T2.count()) < dcv Then T2 = matchDbl(T2, dcv)
        If (T3.count()) < cv Then T3 = dblDList(matchDbl(T3, cv)) Else If (T3.count()) = cv Then T3.addrange(T3) Else If (T3.count()) < dcv Then T3 = matchDbl(T3, dcv)
        If (clr.count()) < cv Then clr = dblCList(matchClr(clr, cv)) Else If (clr.count()) = cv Then clr.addrange(clr)Else If (clr.count()) < dcv Then clr = matchClr(clr, dcv)

        If bp Then
          mc = clr
          ac = colorCap(mc)
        End If

        'Edge based vertices
        k = 0
        Dim cpt As point3d
        Dim ccl As color
        Dim bce As Boolean

        jj = 0
        For j = 0 To ce - 1 Step 1
          If (bm Or (bp And (mte.GetConnectedFaces(j).Count() < 2))) Then
            ua = mtv.MeshVertexIndices(mte.GetTopologyVertices(j).I)(0)
            va = mtv.MeshVertexIndices(mte.GetTopologyVertices(j).J)(0)

            ub = ua + cv
            vb = va + cv

            cpt = (mv(ua) + mv(va) + mv(ub) + mv(vb)) / 4
            ccl = avg4Clr(mc(ua), mc(va), mc(ub), mc(vb))
            bce = mte.GetConnectedFaces(j).count() <> 2

            ep.add(evalP((mv(ub) + mv(vb)) / 2, (mv(ua) + mv(va)) / 2, (t1(ub) + t1(vb)) / 2))
            ec.add(evalC(evalC(mc(ub), mc(vb), 0.5), evalC(mc(ua), mc(va), 0.5), (t1(ub) + t1(vb)) / 2))
            en.add(bce)
            dir.add(-1)
            mev.add(ua & "," & va & "," & 0, k)
            mev.add(va & "," & ua & "," & 0, k)
            met.add(ua & "," & va & "," & 0, jj)
            met.add(va & "," & ua & "," & 0, jj)

            ep.add(evalP(mv(ua), mv(va), t0(ua) / 2))
            ec.add(evalC(mc(ua), mc(va), t0(ua) / 2))
            en.add(bce)
            dir.add(-1)
            mev.add(ua & "," & va & "," & 1, k + 1)
            met.add(ua & "," & va & "," & 1, jj + 1)

            ep.add(evalP(mv(va), mv(ua), t0(va) / 2))
            ec.add(evalC(mc(va), mc(ua), t0(va) / 2))
            en.add(bce)
            dir.add(-1)
            mev.add(va & "," & ua & "," & 1, k + 2)
            met.add(va & "," & ua & "," & 1, jj + 2)

            ep.add(evalP((mv(ua) + mv(va)) / 2, (mv(ub) + mv(vb)) / 2, (t1(ua) + t1(va)) / 2))
            ec.add(evalC(evalC(mc(ua), mc(va), 0.5), evalC(mc(ub), mc(vb), 0.5), (t1(ua) + t1(va)) / 2))
            en.add(bce)
            dir.add(-1)
            mev.add(ub & "," & vb & "," & 0, k + 3)
            mev.add(vb & "," & ub & "," & 0, k + 3)
            met.add(ub & "," & vb & "," & 0, jj)
            met.add(vb & "," & ub & "," & 0, jj)

            ep.add(evalP(mv(ub), mv(vb), t0(ub) / 2))
            ec.add(evalC(mc(ub), mc(vb), t0(ub) / 2))
            en.add(bce)
            dir.add(-1)
            mev.add(ub & "," & vb & "," & 1, k + 4)
            met.add(ub & "," & vb & "," & 1, jj + 1)

            ep.add(evalP(mv(vb), mv(ub), t0(vb) / 2))
            ec.add(evalC(mc(vb), mc(ub), t0(vb) / 2))
            en.add(bce)
            dir.add(-1)
            mev.add(vb & "," & ub & "," & 1, k + 5)
            met.add(vb & "," & ub & "," & 1, jj + 2)


            ep.add((mv(ua) + mv(va)) / 2)
            ec.add(evalC(mc(ua), mc(va), 0.5))
            en.add(bce)
            dir.add(-1)
            mev.add(ua & "," & va & "," & 2, k + 6)
            mev.add(va & "," & ua & "," & 2, k + 6)
            met.add(ua & "," & va & "," & 2, jj)
            met.add(va & "," & ua & "," & 2, jj)

            ep.add((mv(ub) + mv(vb)) / 2)
            ec.add(evalC(mc(ub), mc(vb), 0.5))
            en.add(bce)
            dir.add(-1)
            mev.add(ub & "," & vb & "," & 2, k + 7)
            mev.add(vb & "," & ub & "," & 2, k + 7)
            met.add(ub & "," & vb & "," & 2, jj)
            met.add(vb & "," & ub & "," & 2, jj)

            k += 8
            jj += 3
          End If
        Next

        If bp Then ce = cv
        ReDim epo(ce * 3 - 1)
        ReDim eco(ce * 3 - 1)
        ReDim cpo(ce * 3 - 1)
        ReDim cco(ce * 3 - 1)

        'Face based vertices
        Dim xv(),mt(),ei(),ej(),xi() As Integer
        Dim xca(),xcb(),xta(),xtb() As color
        Dim xn(1) As Double
        ReDim ei(8)
        ReDim ej(8)
        ReDim xi(1)
        u = 1
        v = (epo.Length - 1) + 1 + cf * 2
        If (c And r) Then
          vv = mv.count() + (cpo.Length - 1) + 1 + cf * 2
          v += vv
        End If

        For jj = 0 To I.count() - 1 Step 1
          Dim tcv As New point3d
          Dim bmf As Boolean
          j = I(jj)
          w = v + tv.count()
          xn(0) = 0
          xn(1) = 0
          If bm Then
            If mf(j).isquad() Then h = 4 Else h = 3
            ReDim xv(h - 1)
            ReDim xca(h - 1)
            ReDim xcb(h - 1)
            ReDim xta(h - 1)
            ReDim xtb(h - 1)
            mt = mf.GetTopologicalVertices(j)
            For k = 0 To h - 1 Step 1
              xv(k) = mtv.MeshVertexIndices(mt(k))(0)
              xca(k) = mc(xv(k))
              xcb(k) = mc(xv(k) + cv)
              xta(k) = clr(xv(k))
              xtb(k) = clr(xv(k) + cv)
            Next
            av(0) = mf.GetFaceCenter(j)
            av(1) = msh.faces.GetFaceCenter(j + cf)
            ac(0) = avgClr(xca)
            ac(1) = avgClr(xcb)
            ax(0) = avgClr(xta)
            ax(1) = avgClr(xtb)
            If biC Then ac(2) = sumC(ax(0), ax(1)) Else ac(2) = sumC(ac(0), ac(1))
            bmf = mf(j).isquad()
          Else
            If ((cv + 1) Mod 2) Then bmf = True
            h = cv
            xv = Enumerable.Range(0, h).ToArray()
          End If
          For k = 0 To h - 1 Step 1
            xn(0) += T3(xv(k))
            xn(1) += T3(xv(k) + cv)
          Next
          xn(0) /= h
          xn(1) /= h
          av(2) = (av(0) + av(1)) / 2
          y = appendprepend(h - 1)

          For k = 1 To h Step 1
            ei(0) = mev.item(xv(y(k)) & "," & xv(y(k + 1)) & "," & 0)

            ei(1) = met.item(xv(y(k)) & "," & xv(y(k - 1)) & "," & 0)
            ei(2) = met.item(xv(y(k)) & "," & xv(y(k - 1)) & "," & 1)
            ei(3) = met.item(xv(y(k)) & "," & xv(y(k + 1)) & "," & 0)
            ei(4) = met.item(xv(y(k)) & "," & xv(y(k + 1)) & "," & 1)
            ei(5) = met.item(xv(y(k + 1)) & "," & xv(y(k)) & "," & 0)
            ei(6) = met.item(xv(y(k + 1)) & "," & xv(y(k)) & "," & 1)

            If dir(ei(0)) < 0 Then
              If k Mod 2 Then
                dir(ei(0)) = 0
              Else
                dir(ei(0)) = 1
              End If

              ej(0) = mev.item(xv(y(k)) + dir(ei(0)) * cv & "," & xv(y(k + 1)) + dir(ei(0)) * cv & "," & 0)
              ej(1) = mev.item(xv(y(k)) + dir(ei(0)) * cv & "," & xv(y(k + 1)) + dir(ei(0)) * cv & "," & 1)
              ej(2) = mev.item(xv(y(k + 1)) + dir(ei(0)) * cv & "," & xv(y(k)) + dir(ei(0)) * cv & "," & 1)
              ej(3) = met.item(xv(y(k)) & "," & xv(y(k + 1)) & "," & 0)
              ej(4) = met.item(xv(y(k)) & "," & xv(y(k + 1)) & "," & 1)
              ej(5) = met.item(xv(y(k + 1)) & "," & xv(y(k)) & "," & 1)

              epo(ej(3)) = (ep(ej(0)))
              eco(ej(3)) = (ec(ej(0)))

              epo(ej(4)) = (ep(ej(1)))
              eco(ej(4)) = (ec(ej(1)))

              epo(ej(5)) = (ep(ej(2)))
              eco(ej(5)) = (ec(ej(2)))

              ej(0) = mev.item(xv(y(k)) + (1 - dir(ei(0))) * cv & "," & xv(y(k + 1)) + (1 - dir(ei(0))) * cv & "," & 0)
              ej(1) = mev.item(xv(y(k)) + (1 - dir(ei(0))) * cv & "," & xv(y(k + 1)) + (1 - dir(ei(0))) * cv & "," & 1)
              ej(2) = mev.item(xv(y(k + 1)) + (1 - dir(ei(0))) * cv & "," & xv(y(k)) + (1 - dir(ei(0))) * cv & "," & 1)
              ej(3) = met.item(xv(y(k)) & "," & xv(y(k + 1)) & "," & 0)
              ej(4) = met.item(xv(y(k)) & "," & xv(y(k + 1)) & "," & 1)
              ej(5) = met.item(xv(y(k + 1)) & "," & xv(y(k)) & "," & 1)
              ej(6) = mev.item(xv(y(k)) + (1 - dir(ei(0))) * cv & "," & xv(y(k + 1)) + (1 - dir(ei(0))) * cv & "," & 2)

              cpo(ej(3)) = (ep(ej(6)))
              cco(ej(3)) = (ec(ej(6)))

              cpo(ej(4)) = (ep(ej(1)))
              cco(ej(4)) = (ec(ej(1)))

              cpo(ej(5)) = (ep(ej(2)))
              cco(ej(5)) = (ec(ej(2)))
            End If

            'Define new per face vertices
            tv.add(evalP(av(((k + 1) Mod 2)), (mv(xv(y(k)) + dir(ei(0)) * cv) + mv(xv(y(k + 1)) + dir(ei(0)) * cv)) / 2, (t2(xv(y(k)) + dir(ei(0)) * cv) + t2(xv(y(k + 1)) + dir(ei(0)) * cv)) / 2))
            tc.add(evalC(ac(((k + 1) Mod 2)), evalC(mc(xv(y(k)) + dir(ei(0)) * cv), mc(xv(y(k + 1)) + dir(ei(0)) * cv), 0.5), (t2(xv(y(k)) + dir(ei(0)) * cv) + t2(xv(y(k + 1)) + dir(ei(0)) * cv)) / 2))

            If bmf Then
              'Define new faces
              xf.add(New meshface(ei(1), ei(2), ei(3), ei(4)))
              xf.add(New meshface(ei(4), ei(1), v + jj * 2 - cf * 2 + ((k + 1) Mod 2), w + y(k) * u))
              xf.add(New meshface(ei(3), ei(2), w + y(k - 1) * u, v + jj * 2 - cf * 2 + (k Mod 2)))

              If c Then
                If r Then
                  xf.add(New meshface(ei(4), w + y(k) * u, v - cf * 2 - vv + ei(2), v - cv * 2 - cf * 4 + xv(y(k)) + (1 - (k Mod 2)) * cv))
                  xf.add(New meshface(w + y(k) * u, v - cf * 2 - vv + ei(2), v - cf * 2 - vv + ei(1), v - cf * 4 + j * 2 + (1 - (k Mod 2))))

                  xf.add(New meshface(v - cf * 2 - vv + ei(3), v - cf * 2 - vv + ei(4), w + y(k - 1) * u, v - cf * 4 + j * 2 + (k Mod 2)))
                  xf.add(New meshface(ei(2), v - cv * 2 - cf * 4 + xv(y(k)) + (k Mod 2) * cv, v - cf * 2 - vv + ei(4), w + y(k - 1) * u))

                  If mte.GetConnectedFaces(mte.GetEdgeIndex(mtv.TopologyVertexIndex(xv(y(k))), mtv.TopologyVertexIndex(xv(y(k + 1))))).count() <> 2 Then
                    xf.add(New meshface(v - cv * 2 - cf * 4 + xv(y(k)) + (1 - (k Mod 2)) * cv, v - cv * 2 - cf * 4 + xv(y(k)) + (k Mod 2) * cv, v - cf * 2 - vv + ei(4), ei(4)))
                    xf.add(New meshface(v - cf * 2 - vv + ei(3), v - cf * 2 - vv + ei(4), ei(4), ei(5)))
                  End If
                  If mte.GetConnectedFaces(mte.GetEdgeIndex(mtv.TopologyVertexIndex(xv(y(k))), mtv.TopologyVertexIndex(xv(y(k - 1))))).count() <> 2 Then
                    xf.add(New meshface(ei(2), v - cf * 2 - vv + ei(2), v - cf * 2 - vv + ei(1), ei(1)))
                    xf.add(New meshface(v - cv * 2 - cf * 4 + xv(y(k)) + (k Mod 2) * cv, ei(2), v - cf * 2 - vv + ei(2), v - cv * 2 - cf * 4 + xv(y(k)) + (1 - (k Mod 2)) * cv))
                  End If

                Else
                  xf.add(New meshface(ei(6), w + y(k), ei(4)))
                  If en.item(ei(0)) Then
                    xf.add(New meshface(ei(3), ei(6), ei(4)))
                  End If
                End If
              End If
            End If
          Next
          fv.add(evalP(av(0), av(2), xn(0)))
          cc.add(evalC(ac(0), ac(2), xn(0)))

          fv.add(evalP(av(1), av(2), xn(1)))
          cc.add(evalC(ac(1), ac(2), xn(1)))

          If (c And r) Then
            cfp.add(av(0))
            cfc.add(ac(0))

            cfp.add(av(1))
            cfc.add(ac(1))
          End If

        Next

        Dim om As New mesh
        om.Vertices.AddVertices(epo)
        If bmC Then om.VertexColors.AppendColors(eco)

        If (c And r) Then
          om.Vertices.AddVertices(cpo)
          If bmC Then om.VertexColors.AppendColors(cco.toarray())
          om.Vertices.AddVertices(mv)
          If bmC Then om.VertexColors.AppendColors(mc.toarray())
          om.Vertices.AddVertices(cfp)
          If bmC Then om.VertexColors.AppendColors(cfc.toarray())
        End If

        om.Vertices.AddVertices(fv)
        If bmC Then om.VertexColors.AppendColors(cc.toarray())

        om.Vertices.AddVertices(tv.toarray())
        If bmC Then om.VertexColors.AppendColors(tc.toarray())

        om.Faces.AddFaces(xf.toarray())
        om.UnifyNormals()

        'If (c And r) Then om.Flip(True, True, True)

        'If i.count() > 0 Then om.Vertices.CullUnused()

        A = om
      End If
    End If
# ---------- m_f_rdr: VB additional code ----------
  Private Function appendprepend(ByVal i As Integer)
    Dim srsEnum As IEnumerable(Of Integer) = Enumerable.Range(0, i + 1)
    Dim arrVal As New list(Of Integer)
    arrVal = srsEnum.tolist()
    arrVal.add(0)
    arrVal.insert(0, i)
    Return arrVal.toarray()
  End Function

  Private Function colorCap(ByVal c As list(Of color))
    Dim i,k As Integer
    k = c.count() / 2
    Dim r(2),g(2),b(2) As Integer
    For i = 0 To k - 1 Step 1
      r(0) += c.item(i).R
      r(1) += c.item(i + k).R
      g(0) += c.item(i).g
      g(1) += c.item(i + k).g
      b(0) += c.item(i).b
      b(1) += c.item(i + k).b
    Next

    r(0) = CInt(r(0) / k)
    r(1) = CInt(r(1) / k)
    g(0) = CInt(g(0) / k)
    g(1) = CInt(g(1) / k)
    b(0) = CInt(b(0) / k)
    b(1) = CInt(b(1) / k)

    r(2) = CInt((r(0) + r(1)) / 2)
    g(2) = CInt((g(0) + g(1)) / 2)
    b(2) = CInt((b(0) + b(1)) / 2)

    If r(0) > 255 Then r(0) = 255 Else If r(0) < 0 Then r(0) = 0
    If r(1) > 255 Then r(1) = 255 Else If r(1) < 0 Then r(1) = 0
    If g(0) > 255 Then g(0) = 255 Else If g(0) < 0 Then g(0) = 0
    If g(1) > 255 Then g(1) = 255 Else If g(1) < 0 Then g(1) = 0
    If b(0) > 255 Then b(0) = 255 Else If b(0) < 0 Then b(0) = 0
    If b(1) > 255 Then b(1) = 255 Else If b(1) < 0 Then b(1) = 0

    If r(2) > 255 Then r(2) = 255 Else If r(2) < 0 Then r(2) = 0
    If g(2) > 255 Then g(2) = 255 Else If g(2) < 0 Then g(2) = 0
    If b(2) > 255 Then b(2) = 255 Else If b(2) < 0 Then b(2) = 0

    Return {color.FromArgb(r(0), G(0), b(0)),color.FromArgb(r(1), G(1), b(1)),color.FromArgb(r(2), G(2), b(2))}
  End Function

  Private Function dblCList(ByVal a As list(Of color))
    a.addrange(a)
    Return a
  End Function

  Private Function dblDList(ByVal a As list(Of Double))
    a.addrange(a)
    Return a
  End Function

  Private Function matchDbl(ByVal a As list(Of Double), ByVal t As Integer)
    Dim i,k As Integer
    k = a.count()
    For i = 0 To ((t + 1) - k) - 1 Step 1
      a.add(a.item(k - 1))
    Next
    Return a
  End Function

  Private Function matchClr(ByVal a As list(Of Color), ByVal t As Integer)
    Dim i,k As Integer
    k = a.count()
    For i = 0 To ((t + 1) - k) - 1 Step 1
      a.add(a.item(k - 1))
    Next
    Return a
  End Function

  Private Function sumC(ByVal ca As Color, ByVal cb As Color)
    Dim r,g,b As Integer

    r = CInt((CInt(ca.R) + CInt(cb.R)) / 2)
    g = CInt((CInt(ca.g) + CInt(cb.g)) / 2)
    b = CInt((CInt(ca.b) + CInt(cb.b)) / 2)

    If r > 255 Then r = 255 Else If r < 0 Then r = 0
    If G > 255 Then G = 255 Else If G < 0 Then G = 0
    If b > 255 Then b = 255 Else If b < 0 Then b = 0

    Return color.FromArgb(r, G, b)
  End Function

  Private Function avg4Clr(ByVal ca As Color, ByVal cb As Color, ByVal cc As Color, ByVal cd As Color)
    Dim r,g,b As Integer

    r = CInt((CInt(ca.R) + CInt(cb.R) + CInt(cc.R) + CInt(cd.R)) / 4)
    g = CInt((CInt(ca.g) + CInt(cb.g) + CInt(cc.g) + CInt(cd.g)) / 4)
    b = CInt((CInt(ca.b) + CInt(cb.b) + CInt(cc.b) + CInt(cd.b)) / 4)

    If r > 255 Then r = 255 Else If r < 0 Then r = 0
    If G > 255 Then G = 255 Else If G < 0 Then G = 0
    If b > 255 Then b = 255 Else If b < 0 Then b = 0

    Return color.FromArgb(r, G, b)
  End Function

  Private Function evalP(ByVal op As point3d, ByVal tp As Point3d, ByVal t As Double)
    Return New point3d(op + (tp - op) * t)
  End Function

  Private Function evalV(ByVal ov As vector3d, ByVal tv As vector3d, ByVal t As Double)
    Return New vector3d(ov + (tv - ov) * t)
  End Function

  Private Function evalN(ByVal u As Double, ByVal v As Double, ByVal t As Double)
    Return u + (v - u) * t
  End Function

  Private Function avgVec(ByVal v() As vector3f)
    Dim i As Integer
    Dim tv As Vector3d

    For i = 0 To (v.Length - 1) Step 1
      tv += v(i)
    Next
    tv /= ((v.Length - 1) + 1)
    tv.Unitize()
    Return New vector3f(tv.X, tv.Y, tv.Z)
  End Function

  Private Function roundClr(ByVal r As Integer, ByVal G As Integer, ByVal b As Integer, ByVal i As Integer)
    r = CInt(r / i)
    G = CInt(G / i)
    b = CInt(b / i)

    If r > 255 Then r = 255 Else If r < 0 Then r = 0
    If G > 255 Then G = 255 Else If G < 0 Then G = 0
    If b > 255 Then b = 255 Else If b < 0 Then b = 0

    Return color.FromArgb(r, G, b)
  End Function

  Private Function avgClr(ByVal c() As color)
    Dim r,G,b As Integer
    Dim i,k As Integer

    k = (c.Length - 1) + 1

    For i = 0 To k - 1 Step 1
      r += CInt(c(i).R)
      G += CInt(c(i).G)
      b += CInt(c(i).B)
    Next

    r = CInt(r / k)
    G = CInt(G / k)
    b = CInt(b / k)

    If r > 255 Then r = 255 Else If r < 0 Then r = 0
    If G > 255 Then G = 255 Else If G < 0 Then G = 0
    If b > 255 Then b = 255 Else If b < 0 Then b = 0

    Return color.FromArgb(r, G, b)
  End Function

  Private Function evalC(ByVal oc As color, ByVal tc As color, ByVal t As Double)
    Dim r,G,b As Integer
    r = CInt(CInt(oc.R) + (CInt(tc.R) - CInt(oc.R)) * t)
    G = CInt(CInt(oc.G) + (CInt(tc.G) - CInt(oc.G)) * t)
    b = CInt(CInt(oc.B) + (CInt(tc.B) - CInt(oc.B)) * t)

    If r > 255 Then r = 255 Else If r < 0 Then r = 0
    If G > 255 Then G = 255 Else If G < 0 Then G = 0
    If b > 255 Then b = 255 Else If b < 0 Then b = 0

    Return color.FromArgb(r, G, b)
  End Function

  ''' <summary>
  ''' This method will be called once every solution, before any calls to RunScript.
  ''' </summary>
  Public Overrides Sub BeforeRunScript()
  End Sub
  ''' <summary>
  ''' This method will be called once every solution, after any calls to RunScript.
  ''' </summary>
  Public Overrides Sub AfterRunScript()
  End Sub
# ---------- end m_f_rdr ----------
m_i_wp = IWP(G0=qrmesh, T0=0.5, T1=0.5, D=number_slider_10, C=False, R=False)  # -> out, A; inputs G0: GeometryBase, G1: GeometryBase, I: list, T0: list, T1: list, clr: list of Color; disabled
# ---------- m_i_wp: VB ----------
    Component.Params.Input(0).Name = "Mesh or Curve"
    Component.Params.Input(0).Description = "Open or closed mesh or curve"
    Component.Params.Input(1).Name = "Mesh or Curve"
    Component.Params.Input(1).Description = "Optional open or closed mesh or curve whose type should correspond to G0."
    Component.Params.Input(2).Name = "Index [Face]"
    Component.Params.Input(2).Description = "An optional integer or list of integers which specify the faces to be modified if the input is a mesh. If no value is supplied then all faces will be modified"
    Component.Params.Input(3).Name = "To Volume [Vertex]"
    Component.Params.Input(3).Description = "Evaluates a new vertex between the input geometry's vertex and edge midpoint to the face center"
    Component.Params.Input(4).Name = "To Face [Vertex]"
    Component.Params.Input(4).Description = "Evaluates a new vertex between the input geometry's vertex and edge midpoint to the volumetric center"
    Component.Params.Input(5).Name = "Distance"
    Component.Params.Input(5).Description = "An optional number to add depth if no input is provided for G1"
    Component.Params.Input(6).Name = "Close"
    Component.Params.Input(6).Description = "If true then additional faces and if needed vertices will be added to the mesh, closing the solid"
    Component.Params.Input(7).Name = "Invert"
    Component.Params.Input(7).Description = "If true the faces the close the mesh are reversed, flipping the solid/ void relationship"
    Component.Params.Input(8).Name = "Color [Vertex]"
    Component.Params.Input(8).Description = "(If applied to a mesh a list of colors corresponding to each mesh face, if applied to a curve, a list of colors corresponding to each control point plus an additonal color value for the new averaged center"

    Component.Params.Output(1).Name = "Mesh"
    Component.Params.Output(1).Description = "If successful, a valid mesh"

    If G0 IsNot Nothing Then

      Dim bG,bM, bP,bmC,biC As Boolean

      bM = G0.ObjectType = ObjectType.Mesh
      bP = G0.ObjectType = ObjectType.Curve

      bG = (bM Or bP)
      If G1 IsNot Nothing Then
        If bM And G1.ObjectType <> ObjectType.Mesh Then bG = False
        If bP And G1.ObjectType <> ObjectType.Curve Then bG = False
      End If

      If bG Then
        Dim msh,msha,mshe As New mesh
        Dim crv,crva As curve
        Dim av(2) As point3d
        Dim ac(2),ax(1) As color
        Dim h,j,jj,k,u,v,ua,ub,va,vb,w As Integer
        Dim cv,cf,ce,dcv As Integer
        Dim x(),y() As Integer
        Dim bnk() As Boolean = Nothing

        Dim mv,fv,cfv,ep,tv,ecv,np As New list(Of Point3d)
        Dim mev,mvv As New dictionary(Of String, Integer)
        Dim mf As Rhino.Geometry.Collections.MeshFaceList = Nothing
        Dim mtv As Rhino.Geometry.Collections.MeshTopologyVertexList = Nothing
        Dim mte As Rhino.Geometry.Collections.MeshTopologyEdgeList = Nothing
        Dim ev As New list(Of vector3d)
        Dim ed As New list(Of Double)
        Dim en As New list(Of Boolean)
        Dim mc,ec,tc,cc,ccc,fc,ecc,nc As New list(Of color)
        Dim xf As New list(Of meshface)
        Dim o As Boolean = True

        If clr.count() = 0 Then clr.add(color.LightGray) Else biC = True

        If bm Then
          'Start Deconstruct if Mesh
          msh = G0

          mshe = msh.Duplicate()
          mte = mshe.TopologyEdges()
          mtv = mshe.TopologyVertices()
          mf = mshe.Faces()

          bnk = mshe.GetNakedEdgePointStatus()

          If G1 IsNot Nothing Then
            msha = G1
            If msh.Vertices.Count() <> msha.vertices.count() Then Exit Sub
          Else
            msha = msh.Offset(-d)
          End If

          msh.Append(msha)

          If i.count() = 0 Then I = Enumerable.Range(0, mf.Count()).ToList()
          mv = msh.Vertices().ToPoint3dArray().tolist()
          cf = I.Count()

          'Assign Colors
          If mshe.VertexColors.Count() < 1 Then
            mshe.VertexColors.CreateMonotoneMesh(color.LightGray)
            bmC = biC
          Else
            bmC = True
          End If

          If msha.VertexColors.Count() > 0 Then bmC = True
          mc = mshe.VertexColors().ToArray().ToList()
          If msha.VertexColors.count() < 1 Then mc.addrange(mc) Else mc.addrange(msha.VertexColors().ToArray().ToList())
        Else
          'Start Deconstruct if Curve
          crv = G0

          I.clear()
          I.add(0)
          Dim nbc As nurbscurve
          Dim pc As polyline
          Dim nps As Rhino.Geometry.Collections.NurbsCurvePointList

          nbc = crv.ToNurbsCurve()
          nps = nbc.Points
          pc = nbc.Points.ControlPolygon
          If (Not pc.IsClosed) Then pc.add(pc(0))
          av(0) = pc.CenterPoint

          msh.Vertices.AddVertices(pc.ToArray())
          msh.faces.addfaces(pc.TriangulateClosedPolyline())
          msh.Vertices.Remove(pc.count() - 1, True)

          mv = msh.Vertices.ToPoint3dArray().tolist()
          mte = msh.TopologyEdges()
          mtv = msh.TopologyVertices()

          ReDim bnk(mv.count() - 1)
          For j = 0 To mv.count() - 1 Step 1
            bnk(j) = True
          Next

          'Assign Colors
          If bic Then bmC = True

          If G1 IsNot Nothing Then
            crva = G1
            nbc = crva.ToNurbsCurve()
            nps = nbc.Points
            pc = nbc.Points.ControlPolygon
            If (Not pc.IsClosed) Then pc.add(pc(0))
            av(1) = pc.CenterPoint
            pc.RemoveAt(pc.count() - 1)

            If pc.count() <> mv.count() Then Exit Sub

            cf = 1
            mv.addrange(pc)
          Else
            Dim tcpt As point3d
            msh.Normals.ComputeNormals()
            msh.Normals.UnitizeNormals()
            k = mv.count()
            For j = 0 To k - 1 Step 1
              mv.add(mv.item(j) + msh.Normals(j) * d)
              tcpt += mv.item(j) + msh.Normals(j) * d
            Next

            If cv > 4 Then o = False
            cf = 1
            av(1) = tcpt / k
          End If

        End If
        ce = mte.count()
        cv = mv.count() / 2
        dcv = mv.count()

        x = appendprepend(cv - 1)
        'Match variables and colors to vertex count
        If (T0.count()) < cv Then T0 = dblDList(matchDbl(T0, cv)) Else If (T0.count()) = cv Then T0.addrange(T0) Else If (T0.count()) < dcv Then T0 = matchDbl(T0, dcv)
        If (T1.count()) < cv Then T1 = dblDList(matchDbl(T1, cv)) Else If (T1.count()) = cv Then T1.addrange(T1) Else If (T1.count()) < dcv Then T1 = matchDbl(T1, dcv)
        If (clr.count()) < cv Then clr = dblCList(matchClr(clr, cv)) Else If (clr.count()) = cv Then clr.addrange(clr)Else If (clr.count()) < dcv Then clr = matchClr(clr, dcv)

        If bp Then
          mc = clr
          ac = colorCap(mc)
        End If

        'Edge based vertices
        k = 0
        Dim cpt As point3d
        Dim ccl As color
        Dim bce As Boolean

        jj = 0
        For j = 0 To ce - 1 Step 1
          If (bm Or (bp And (mte.GetConnectedFaces(j).Count() < 2))) Then
            ua = mtv.MeshVertexIndices(mte.GetTopologyVertices(j).I)(0)
            va = mtv.MeshVertexIndices(mte.GetTopologyVertices(j).J)(0)

            ub = ua + cv
            vb = va + cv

            cpt = (mv(ua) + mv(va) + mv(ub) + mv(vb)) / 4
            ccl = avg4Clr(mc(ua), mc(va), mc(ub), mc(vb))
            bce = mte.GetConnectedFaces(j).count() <> 2

            If c Then
              If r Then
                ecv.add(evalP(mv(ua), mv(va), 0.5))
                ecc.add(evalC(mc(ua), mc(va), 0.5))
                mev.add(ua & "," & va & "," & 3, jj)
                mev.add(va & "," & ua & "," & 3, jj)

                ecv.add(evalP(mv(ub), mv(vb), 0.5))
                ecc.add(evalC(mc(ub), mc(vb), 0.5))
                mev.add(ub & "," & vb & "," & 3, jj + 1)
                mev.add(vb & "," & ub & "," & 3, jj + 1)
                jj += 2
              Else
                If bce Then
                  ecv.add(cpt)
                  ecc.add(ccl)
                  mev.add(ua & "," & va & "," & 3, jj)
                  mev.add(va & "," & ua & "," & 3, jj)
                  jj += 1
                End If
              End If
            End If

            'To the Face Center
            ep.add(evalP(mv(ua), cpt, t0(ua)))
            ec.add(evalC(mc(ua), ccl, t0(ua)))
            en.add(bce)
            mev.add(ua & "," & va & "," & 0, k)

            ep.add(evalP(mv(va), cpt, t0(va)))
            ec.add(evalC(mc(va), ccl, t0(va)))
            en.add(bce)
            mev.add(va & "," & ua & "," & 0, k + 1)

            ep.add(evalP(mv(ub), cpt, t0(ub)))
            ec.add(evalC(mc(ub), ccl, t0(ub)))
            en.add(bce)
            mev.add(ub & "," & vb & "," & 0, k + 2)

            ep.add(evalP(mv(vb), cpt, t0(vb)))
            ec.add(evalC(mc(vb), ccl, t0(vb)))
            en.add(bce)
            mev.add(vb & "," & ub & "," & 0, k + 3)

            'To the Edge Midpoint
            ep.add(evalP(mv(ua), mv(va), t0(ua) / 2))
            ec.add(evalC(mc(ua), mc(va), t0(ua) / 2))
            en.add(bce)
            mev.add(ua & "," & va & "," & 1, k + 4)

            ep.add(evalP(mv(va), mv(ua), t0(va) / 2))
            ec.add(evalC(mc(va), mc(ua), t0(va) / 2))
            en.add(bce)
            mev.add(va & "," & ua & "," & 1, k + 5)

            ep.add(evalP(mv(ub), mv(vb), t0(ub) / 2))
            ec.add(evalC(mc(ub), mc(vb), t0(ub) / 2))
            en.add(bce)
            mev.add(ub & "," & vb & "," & 1, k + 6)

            ep.add(evalP(mv(vb), mv(ub), t0(vb) / 2))
            ec.add(evalC(mc(vb), mc(ub), t0(vb) / 2))
            en.add(bce)
            mev.add(vb & "," & ub & "," & 1, k + 7)

            k += 8
          End If
        Next

        k = 0
        For j = 0 To (bnk.Length - 1) Step 1
          np.add(evalP(mv(j), mv(j + cv), t0(j) / 2))
          nc.add(evalC(mc(j), mc(j + cv), t0(j) / 2))
          mvv.add(j & "," & j + cv & "," & 0, k)

          np.add(evalP(mv(j + cv), mv(j), t0(j + cv) / 2))
          nc.add(evalC(mc(j + cv), mc(j), t0(j + cv) / 2))
          mvv.add(j + cv & "," & j & "," & 0, k + 1)

          k += 2
        Next

        'Face based vertices
        Dim xv(),mt(),ei(),xi() As Integer
        Dim xca(),xcb(),xta(),xtb() As color
        Dim xn(1) As Double
        ReDim ei(9)
        ReDim xi(1)
        u = 6
        v = ep.count() + np.count() + cf * 2

        If c Then
          If r Then
            If (Not o) Then v += cf * 2
          Else
            v += mv.count()
          End If
        End If

        For jj = 0 To I.count() - 1 Step 1
          Dim tcv As New point3d
          j = I(jj)
          w = v + tv.count()
          xn(0) = 0
          xn(1) = 0
          If bm Then
            If mf(j).isquad() Then h = 4 Else h = 3
            ReDim xv(h - 1)
            ReDim xca(h - 1)
            ReDim xcb(h - 1)
            ReDim xta(h - 1)
            ReDim xtb(h - 1)
            mt = mf.GetTopologicalVertices(j)
            For k = 0 To h - 1 Step 1
              xv(k) = mtv.MeshVertexIndices(mt(k))(0)
              xca(k) = mc(xv(k))
              xcb(k) = mc(xv(k) + cv)
              xta(k) = clr(xv(k))
              xtb(k) = clr(xv(k) + cv)
            Next
            av(0) = mf.GetFaceCenter(j)
            av(1) = msh.faces.GetFaceCenter(j + cf)
            ac(0) = avgClr(xca)
            ac(1) = avgClr(xcb)
            ax(0) = avgClr(xta)
            ax(1) = avgClr(xtb)
            If biC Then ac(2) = sumC(ax(0), ax(1)) Else ac(2) = sumC(ac(0), ac(1))
          Else
            h = cv
            xv = Enumerable.Range(0, h).ToArray()
          End If
          For k = 0 To h - 1 Step 1
            xn(0) += T1(xv(k))
            xn(1) += T1(xv(k) + cv)
          Next
          xn(0) /= h
          xn(1) /= h
          av(2) = (av(0) + av(1)) / 2
          y = appendprepend(h - 1)

          For k = 1 To h Step 1
            ei(0) = mev.item(xv(y(k)) & "," & xv(y(k + 1)) & "," & 0)
            ei(1) = mev.item(xv(y(k)) + cv & "," & xv(y(k + 1)) + cv & "," & 0)
            ei(2) = mev.item(xv(y(k + 1)) & "," & xv(y(k)) & "," & 0)
            ei(3) = mev.item(xv(y(k + 1)) + cv & "," & xv(y(k)) + cv & "," & 0)

            ei(4) = mev.item(xv(y(k)) & "," & xv(y(k + 1)) & "," & 1)
            ei(5) = mev.item(xv(y(k)) + cv & "," & xv(y(k + 1)) + cv & "," & 1)
            ei(6) = mev.item(xv(y(k + 1)) & "," & xv(y(k)) & "," & 1)
            ei(7) = mev.item(xv(y(k + 1)) + cv & "," & xv(y(k)) + cv & "," & 1)

            'Define new per face vertices
            tv.add(evalP(mv(xv(y(k))), av(0), t0(xv(y(k)))))
            tc.add(evalC(mc(xv(y(k))), ac(0), t0(xv(y(k)))))

            tv.add(evalP(mv(xv(y(k)) + cv), av(1), t0(xv(y(k)) + cv)))
            tc.add(evalC(mc(xv(y(k)) + cv), ac(1), t0(xv(y(k)) + cv)))

            tv.add(evalP(av(2), (mv(xv(y(k))) + mv(xv(y(k)) + cv)) / 2, (t1(xv(y(k))) + t1(xv(y(k)) + cv)) / 2))
            tc.add(evalC(ac(2), evalC(mc(xv(y(k))), mc(xv(y(k)) + cv), 0.5), (t1(xv(y(k))) + t1(xv(y(k)) + cv)) / 2))

            tv.add(evalP(av(2), (mv(xv(y(k))) + mv(xv(y(k + 1)))) / 2, (t1(xv(y(k))) + t1(xv(y(k + 1)))) / 2))
            tc.add(evalC(ac(2), evalC(mc(xv(y(k))), mc(xv(y(k + 1))), 0.5), (t1(xv(y(k))) + t1(xv(y(k + 1)))) / 2))

            tv.add(evalP(av(2), (mv(xv(y(k)) + cv) + mv(xv(y(k + 1)) + cv)) / 2, (t1(xv(y(k)) + cv) + t1(xv(y(k + 1)) + cv)) / 2))
            tc.add(evalC(ac(2), evalC(mc(xv(y(k)) + cv), mc(xv(y(k + 1)) + cv), 0.5), (t1(xv(y(k)) + cv) + t1(xv(y(k + 1)) + cv)) / 2))

            tv.add(evalP(av(2), (mv(xv(y(k)) + cv) + mv(xv(y(k + 1)) + cv) + mv(xv(y(k))) + mv(xv(y(k + 1)))) / 4, (t1(xv(y(k)) + cv) + t1(xv(y(k + 1)) + cv) + t1(xv(y(k))) + t1(xv(y(k + 1)))) / 4))
            tc.add(evalC(ac(2), avg4Clr(mc(xv(y(k))), mc(xv(y(k + 1))), mc(xv(y(k)) + cv), mc(xv(y(k + 1)) + cv)), (t1(xv(y(k)) + cv) + t1(xv(y(k + 1)) + cv) + t1(xv(y(k))) + t1(xv(y(k + 1)))) / 4))

            'Define new faces
            xf.add(New meshface(ei(0), ei(4), w + y(k) * u + 3, w + y(k) * u + 5))
            xf.add(New meshface(ei(6), ei(2), w + y(k) * u + 5, w + y(k) * u + 3))

            xf.add(New meshface(ei(4), w + y(k) * u + 0, ep.count() + np.count() + j * 2, w + y(k) * u + 3))
            xf.add(New meshface(w + y(k + 1) * u + 0, ei(6), w + y(k) * u + 3, ep.count() + np.count() + j * 2))

            xf.add(New meshface(ep.count() + xv(y(k)) * 2, ei(0), w + y(k) * u + 5, w + y(k) * u + 2))
            xf.add(New meshface(ei(2), ep.count() + xv(y(k + 1)) * 2, w + y(k + 1) * u + 2, w + y(k) * u + 5))

            xf.add(New meshface(ei(1), ep.count() + xv(y(k)) * 2 + 1, w + y(k) * u + 2, w + y(k) * u + 5))
            xf.add(New meshface(ep.count() + xv(y(k + 1)) * 2 + 1, ei(3), w + y(k) * u + 5, w + y(k + 1) * u + 2))

            xf.add(New meshface(ei(5), ei(1), w + y(k) * u + 5, w + y(k) * u + 4))
            xf.add(New meshface(ei(3), ei(7), w + y(k) * u + 4, w + y(k) * u + 5))

            xf.add(New meshface(ep.count() + np.count() + j * 2 + 1, w + y(k) * u + 1, ei(5), w + y(k) * u + 4))
            xf.add(New meshface(w + y(k + 1) * u + 1, ep.count() + np.count() + j * 2 + 1, w + y(k) * u + 4, ei(7)))

            If c Then
              If r Then
                xf.add(New meshface(ei(7), ei(5), w + y(k) * u + 1, w + y(k + 1) * u + 1))
                xf.add(New meshface(ei(4), ei(6), w + y(k + 1) * u, w + y(k) * u))

                If (Not o) Then
                  xf.add(New meshface(w + y(k) * u, w + y(k + 1) * u, v - cf * 2 + j * 2))
                  xf.add(New meshface(w + y(k + 1) * u + 1, w + y(k) * u + 1, v - cf * 2 + j * 2 + 1))
                End If

                If en.item(ei(0)) Then
                  xf.add(New meshface(ei(4), ei(0), ei(2), ei(6)))
                  xf.add(New meshface(ei(1), ei(5), ei(7), ei(3)))

                  xf.add(New meshface(ei(0), ei(1), ei(3), ei(2)))

                  xf.add(New meshface(ei(1), ei(0), ep.count() + xv(y(k)) * 2, ep.count() + xv(y(k)) * 2 + 1))
                  xf.add(New meshface(ei(2), ei(3), ep.count() + xv(y(k + 1)) * 2 + 1, ep.count() + xv(y(k + 1)) * 2))
                End If
              Else

                ei(8) = mev.item(xv(y(k)) & "," & xv(y(k - 1)) & "," & 1)
                ei(9) = mev.item(xv(y(k)) + cv & "," & xv(y(k - 1)) + cv & "," & 1)

                xf.add(New meshface(ei(8), w + y(k) * u + 0, ei(4), v - mv.count() + xv(y(k))))
                xf.add(New meshface(w + y(k) * u + 1, ei(9), v - mv.count() + xv(y(k)) + cv, ei(5)))

                If en.item(ei(0)) Then
                  xf.add(New meshface(ei(4), ei(0), ep.count() + xv(y(k)) * 2, v - mv.count() + xv(y(k))))
                  xf.add(New meshface(ei(2), ei(6), v - mv.count() + xv(y(k + 1)), ep.count() + xv(y(k + 1)) * 2))

                  xf.add(New meshface(ei(1), ei(5), v - mv.count() + xv(y(k)) + cv, ep.count() + xv(y(k)) * 2 + 1))
                  xf.add(New meshface(ep.count() + xv(y(k + 1)) * 2 + 1, v - mv.count() + xv(y(k + 1)) + cv, ei(7), ei(3)))
                End If
              End If
            End If
          Next
          fv.add(evalP(av(2), av(0), xn(0)))
          cc.add(evalC(ac(2), ac(0), xn(0)))

          fv.add(evalP(av(2), av(1), xn(1)))
          cc.add(evalC(ac(2), ac(1), xn(1)))

          If (c And r) Then

            If (Not o) Then
              cfv.add(av(0))
              ccc.add(ac(0))

              cfv.add(av(1))
              ccc.add(ac(1))
            Else
              If h = 3 Then
                xf.add(New meshface(w + 0 * u, w + 1 * u, w + 2 * u))
                xf.add(New meshface(w + 1 * u + 1, w + 0 * u + 1, w + 2 * u + 1))
              ElseIf h = 4 Then
                xf.add(New meshface(w + 0 * u, w + 1 * u, w + 2 * u, w + 3 * u))
                xf.add(New meshface(w + 1 * u + 1, w + 0 * u + 1, w + 3 * u + 1, w + 2 * u + 1))
              End If

            End If
          End If

        Next

        Dim om As New mesh
        om.Vertices.AddVertices(ep.toarray())
        If bmC Then om.VertexColors.AppendColors(ec.toarray())
        om.Vertices.AddVertices(np)
        If bmC Then om.VertexColors.AppendColors(nc.toarray())
        om.Vertices.AddVertices(fv)
        If bmC Then om.VertexColors.AppendColors(cc.toarray())

        If c Then
          If r Then
            om.Vertices.AddVertices(cfv)
            If bmC Then om.VertexColors.AppendColors(ccc.toarray())
          Else
            om.Vertices.AddVertices(mv)
            If bmC Then om.VertexColors.AppendColors(mc.toarray())
          End If
        End If

        om.Vertices.AddVertices(tv.toarray())
        If bmC Then om.VertexColors.AppendColors(tc.toarray())

        om.Faces.AddFaces(xf.toarray())

        If (c And r) Then om.Flip(True, True, True)

        'If i.count() > 0 Then om.Vertices.CullUnused()

        A = om
      End If
    End If
# ---------- m_i_wp: VB additional code ----------
  Private Function appendprepend(ByVal i As Integer)
    Dim srsEnum As IEnumerable(Of Integer) = Enumerable.Range(0, i + 1)
    Dim arrVal As New list(Of Integer)
    arrVal = srsEnum.tolist()
    arrVal.add(0)
    arrVal.insert(0, i)
    Return arrVal.toarray()
  End Function


  Private Function colorCap(ByVal c As list(Of color))
    Dim i,k As Integer
    k = c.count() / 2
    Dim r(2),g(2),b(2) As Integer
    For i = 0 To k - 1 Step 1
      r(0) += c.item(i).R
      r(1) += c.item(i + k).R
      g(0) += c.item(i).g
      g(1) += c.item(i + k).g
      b(0) += c.item(i).b
      b(1) += c.item(i + k).b
    Next

    r(0) = CInt(r(0) / k)
    r(1) = CInt(r(1) / k)
    g(0) = CInt(g(0) / k)
    g(1) = CInt(g(1) / k)
    b(0) = CInt(b(0) / k)
    b(1) = CInt(b(1) / k)

    r(2) = CInt((r(0) + r(1)) / 2)
    g(2) = CInt((g(0) + g(1)) / 2)
    b(2) = CInt((b(0) + b(1)) / 2)

    If r(0) > 255 Then r(0) = 255 Else If r(0) < 0 Then r(0) = 0
    If r(1) > 255 Then r(1) = 255 Else If r(1) < 0 Then r(1) = 0
    If g(0) > 255 Then g(0) = 255 Else If g(0) < 0 Then g(0) = 0
    If g(1) > 255 Then g(1) = 255 Else If g(1) < 0 Then g(1) = 0
    If b(0) > 255 Then b(0) = 255 Else If b(0) < 0 Then b(0) = 0
    If b(1) > 255 Then b(1) = 255 Else If b(1) < 0 Then b(1) = 0

    If r(2) > 255 Then r(2) = 255 Else If r(2) < 0 Then r(2) = 0
    If g(2) > 255 Then g(2) = 255 Else If g(2) < 0 Then g(2) = 0
    If b(2) > 255 Then b(2) = 255 Else If b(2) < 0 Then b(2) = 0

    Return {color.FromArgb(r(0), G(0), b(0)),color.FromArgb(r(1), G(1), b(1)),color.FromArgb(r(2), G(2), b(2))}
  End Function

  Private Function dblCList(ByVal a As list(Of color))
    a.addrange(a)
    Return a
  End Function

  Private Function dblDList(ByVal a As list(Of Double))
    a.addrange(a)
    Return a
  End Function

  Private Function matchDbl(ByVal a As list(Of Double), ByVal t As Integer)
    Dim i,k As Integer
    k = a.count()
    For i = 0 To ((t + 1) - k) - 1 Step 1
      a.add(a.item(k - 1))
    Next
    Return a
  End Function

  Private Function matchClr(ByVal a As list(Of Color), ByVal t As Integer)
    Dim i,k As Integer
    k = a.count()
    For i = 0 To ((t + 1) - k) - 1 Step 1
      a.add(a.item(k - 1))
    Next
    Return a
  End Function

  Private Function sumC(ByVal ca As Color, ByVal cb As Color)
    Dim r,g,b As Integer

    r = CInt((CInt(ca.R) + CInt(cb.R)) / 2)
    g = CInt((CInt(ca.g) + CInt(cb.g)) / 2)
    b = CInt((CInt(ca.b) + CInt(cb.b)) / 2)

    If r > 255 Then r = 255 Else If r < 0 Then r = 0
    If G > 255 Then G = 255 Else If G < 0 Then G = 0
    If b > 255 Then b = 255 Else If b < 0 Then b = 0

    Return color.FromArgb(r, G, b)
  End Function

  Private Function avg4Clr(ByVal ca As Color, ByVal cb As Color, ByVal cc As Color, ByVal cd As Color)
    Dim r,g,b As Integer

    r = CInt((CInt(ca.R) + CInt(cb.R) + CInt(cc.R) + CInt(cd.R)) / 4)
    g = CInt((CInt(ca.g) + CInt(cb.g) + CInt(cc.g) + CInt(cd.g)) / 4)
    b = CInt((CInt(ca.b) + CInt(cb.b) + CInt(cc.b) + CInt(cd.b)) / 4)

    If r > 255 Then r = 255 Else If r < 0 Then r = 0
    If G > 255 Then G = 255 Else If G < 0 Then G = 0
    If b > 255 Then b = 255 Else If b < 0 Then b = 0

    Return color.FromArgb(r, G, b)
  End Function

  Private Function evalP(ByVal op As point3d, ByVal tp As Point3d, ByVal t As Double)
    Return New point3d(op + (tp - op) * t)
  End Function

  Private Function evalV(ByVal ov As vector3d, ByVal tv As vector3d, ByVal t As Double)
    Return New vector3d(ov + (tv - ov) * t)
  End Function

  Private Function evalN(ByVal u As Double, ByVal v As Double, ByVal t As Double)
    Return u + (v - u) * t
  End Function

  Private Function avgVec(ByVal v() As vector3f)
    Dim i As Integer
    Dim tv As Vector3d

    For i = 0 To (v.Length - 1) Step 1
      tv += v(i)
    Next
    tv /= ((v.Length - 1) + 1)
    tv.Unitize()
    Return New vector3f(tv.X, tv.Y, tv.Z)
  End Function

  Private Function roundClr(ByVal r As Integer, ByVal G As Integer, ByVal b As Integer, ByVal i As Integer)
    r = CInt(r / i)
    G = CInt(G / i)
    b = CInt(b / i)

    If r > 255 Then r = 255 Else If r < 0 Then r = 0
    If G > 255 Then G = 255 Else If G < 0 Then G = 0
    If b > 255 Then b = 255 Else If b < 0 Then b = 0

    Return color.FromArgb(r, G, b)
  End Function

  Private Function avgClr(ByVal c() As color)
    Dim r,G,b As Integer
    Dim i,k As Integer

    k = (c.Length - 1) + 1

    For i = 0 To k - 1 Step 1
      r += CInt(c(i).R)
      G += CInt(c(i).G)
      b += CInt(c(i).B)
    Next

    r = CInt(r / k)
    G = CInt(G / k)
    b = CInt(b / k)

    If r > 255 Then r = 255 Else If r < 0 Then r = 0
    If G > 255 Then G = 255 Else If G < 0 Then G = 0
    If b > 255 Then b = 255 Else If b < 0 Then b = 0

    Return color.FromArgb(r, G, b)
  End Function

  Private Function evalC(ByVal oc As color, ByVal tc As color, ByVal t As Double)
    Dim r,G,b As Integer
    r = CInt(CInt(oc.R) + (CInt(tc.R) - CInt(oc.R)) * t)
    G = CInt(CInt(oc.G) + (CInt(tc.G) - CInt(oc.G)) * t)
    b = CInt(CInt(oc.B) + (CInt(tc.B) - CInt(oc.B)) * t)

    If r > 255 Then r = 255 Else If r < 0 Then r = 0
    If G > 255 Then G = 255 Else If G < 0 Then G = 0
    If b > 255 Then b = 255 Else If b < 0 Then b = 0

    Return color.FromArgb(r, G, b)
  End Function

  ''' <summary>
  ''' This method will be called once every solution, before any calls to RunScript.
  ''' </summary>
  Public Overrides Sub BeforeRunScript()
  End Sub
  ''' <summary>
  ''' This method will be called once every solution, after any calls to RunScript.
  ''' </summary>
  Public Overrides Sub AfterRunScript()
  End Sub
# ---------- end m_i_wp ----------
m_aperture_0 = Aperture0(G=qrmesh, T0=0.5, D=0, N=1, S=1)  # -> out, A; inputs G: GeometryBase, I: list, T0: list, D: list, N: list, S: list, clr: list of Color; disabled
# ---------- m_aperture_0: VB ----------
    Component.Params.Input(0).Name = "Mesh or Curve"
    Component.Params.Input(0).Description = "Open or closed mesh or curve"
    Component.Params.Input(1).Name = "Index [Face]"
    Component.Params.Input(1).Description = "An optional integer or list of integers which specify the faces to be modified if the input is a mesh. If no value is supplied then all faces will be modified"
    Component.Params.Input(2).Name = "Edge to Face"
    Component.Params.Input(2).Description = "Evaluates a new vertex between an offset from the vertex along the edge of input geometry to the face center"
    Component.Params.Input(3).Name = "Distance"
    Component.Params.Input(3).Description = "Sets the depth for the center point offset of each face"
    Component.Params.Input(4).Name = "Normalize"
    Component.Params.Input(4).Description = "If true averages the vertex values per face, if false each new vertices parameters are associated to its origin vertex"
    Component.Params.Input(5).Name = "Stellate"
    Component.Params.Input(5).Description = "A unitized per vertex number which shifts the offset vector from vertex = 0 to face = 1 normal"
    Component.Params.Input(6).Name = "Close"
    Component.Params.Input(6).Description = "If true then additional faces and if needed vertices will be added to the mesh, covering the complete areas of the existing mesh"
    Component.Params.Input(7).Name = "Color [Vertex]"
    Component.Params.Input(7).Description = "(If applied to a mesh a list of colors corresponding to each mesh face, if applied to a curve, a list of colors corresponding to each control point plus an additonal color value for the new averaged center"

    Component.Params.Output(1).Name = "Mesh"
    Component.Params.Output(1).Description = "If successful, a valid mesh"

    If G IsNot Nothing Then

      Dim bM, bP,bmC,biC As Boolean

      bM = g.ObjectType = ObjectType.Mesh
      bP = g.ObjectType = ObjectType.Curve

      If (bM Or bP) Then
        Dim msh As New mesh
        Dim crv As curve
        Dim av As point3d
        Dim ac As color
        Dim h,j,jj,k,u,v,w As Integer
        Dim cv,cf,ce As Integer
        Dim x(),y() As Integer

        Dim mv,fv,ep,tv As New list(Of Point3d)
        Dim mev As New dictionary(Of String, Integer)
        Dim mf As Rhino.Geometry.Collections.MeshFaceList = Nothing
        Dim mtv As Rhino.Geometry.Collections.MeshTopologyVertexList = Nothing
        Dim mte As Rhino.Geometry.Collections.MeshTopologyEdgeList = Nothing
        Dim mn As Rhino.Geometry.Collections.MeshVertexNormalList = Nothing
        Dim mfn As Rhino.Geometry.Collections.MeshFaceNormalList = Nothing
        Dim ev As New list(Of vector3d)
        Dim ed,en As New list(Of Double)
        Dim mc,ec,tc,cc,fc As New list(Of color)
        Dim xf As New list(Of meshface)

        If clr.count() = 0 Then clr.add(color.LightGray) Else biC = True

        If bm Then
          'Start Deconstruct if Mesh
          msh = g

          If msh.Normals.Count() = 0 Then msh.Normals.ComputeNormals()
          If msh.FaceNormals.Count() = 0 Then msh.FaceNormals.ComputeFaceNormals()

          If i.count() = 0 Then I = Enumerable.Range(0, msh.Faces.Count()).ToList()

          mv = msh.Vertices().ToPoint3dArray().tolist()
          mte = msh.TopologyEdges()
          mtv = msh.TopologyVertices()
          mf = msh.Faces()

          mn = msh.Normals()
          mn.UnitizeNormals()
          mfn = msh.FaceNormals()
          mfn.UnitizeFaceNormals()

          cf = I.Count() - 1
          ce = mte.count() - 1

          'Assign Colors
          If msh.VertexColors.Count() < 1 Then
            msh.VertexColors.CreateMonotoneMesh(color.LightGray)
            bmC = biC
          Else
            bmC = True
          End If
          'Assign fake edges
          mc = msh.VertexColors().ToArray().ToList()
        Else
          'Start Deconstruct if Curve
          crv = g

          I.clear()
          I.add(0)
          Dim nc As nurbscurve
          Dim pc As polyline
          Dim nps As Rhino.Geometry.Collections.NurbsCurvePointList

          nc = crv.ToNurbsCurve()
          nps = nc.Points
          pc = nc.Points.ControlPolygon
          If (Not pc.IsClosed) Then pc.add(pc(0))
          av = pc.CenterPoint

          msh.Vertices.AddVertices(pc.ToArray())
          msh.faces.addfaces(pc.TriangulateClosedPolyline())
          msh.Vertices.Remove(pc.count() - 1, True)
          msh.FaceNormals.ComputeFaceNormals()
          msh.Normals.ComputeNormals()
          msh.Normals.UnitizeNormals()

          mv = msh.Vertices.ToPoint3dArray().tolist()
          mte = msh.TopologyEdges()
          mtv = msh.TopologyVertices()
          mn = msh.Normals()
          mfn = msh.FaceNormals()

          mfn(0) = avgVec(mn.toarray())

          'Assign Colors
          If bic Then bmC = True
          mc = clr
          If (clr.count() - 1) < (mv.count() - 1) Then mc = matchClr(mc, mv.count() - 1)


          ac = avgClr(mc.toarray())
          cf = 0
        End If
        cv = mv.count() - 1
        ce = mte.count() - 1

        x = appendprepend(cv)
        'Match variables and colors to vertex count
        If (T0.count() - 1) < cv Then T0 = matchDbl(T0, cv)
        If (D.count() - 1) < cv Then D = matchDbl(D, cv)
        If (N.count() - 1) < cv Then N = matchDbl(N, cv)
        If (S.count() - 1) < cv Then S = matchDbl(S, cv)
        If (clr.count() - 1) < cv Then clr = matchClr(clr, cv)
        If biC Then fc = clr Else fc = mc

        'Edge based vertices
        k = 0
        For j = 0 To mte.count() - 1 Step 1
          If (bm Or (bp And (mte.GetConnectedFaces(j).Count() < 2))) Then
            u = mtv.MeshVertexIndices(mte.GetTopologyVertices(j).I)(0)
            v = mtv.MeshVertexIndices(mte.GetTopologyVertices(j).J)(0)

            ep.add(evalP(mv(u), mv(v), T0(u) / 2))
            ev.add(evalV(mn(u), mn(v), T0(u) / 2))
            ed.add(evalN(d(u), d(v), T0(u) / 2))
            en.add(evalN(N(u), N(v), T0(u) / 2))
            ec.add(evalC(mc(u), mc(v), T0(u) / 2))
            mev.add(u & "," & v & "," & 0, k)

            ep.add(evalP(mv(v), mv(u), T0(v) / 2))
            ev.add(evalV(mn(v), mn(u), T0(v) / 2))
            ed.add(evalN(d(v), d(u), T0(v) / 2))
            en.add(evalN(N(v), N(u), T0(v) / 2))
            ec.add(evalC(mc(v), mc(u), T0(v) / 2))
            mev.add(v & "," & u & "," & 0, k + 1)
            k += 2
          End If
        Next

        'Face based vertices
        Dim xv(),mt(),ei() As Integer
        Dim xc() As color
        Dim xd,xn As Double
        Dim txv(1) As vector3d
        ReDim ei(1)
        u = 2
        v = mv.count()
        If c Then v += cf + 1

        For jj = 0 To I.count() - 1 Step 1
          Dim tcv As New point3d
          j = I(jj)
          w = v + tv.count()
          xd = 0
          xn = 0
          If bm Then
            If mf(j).isquad() Then h = 4 Else h = 3
            ReDim xv(h - 1)
            ReDim xc(h - 1)
            mt = mf.GetTopologicalVertices(j)
            For k = 0 To h - 1 Step 1
              xv(k) = mtv.MeshVertexIndices(mt(k))(0)
              xc(k) = fc(xv(k))
            Next
            av = mf.GetFaceCenter(j)
            ac = avgClr(xc)
          Else
            h = mv.count()
            xv = Enumerable.Range(0, h).ToArray()
          End If
          For k = 0 To h - 1 Step 1
            xd += D(xv(k))
            xn += T0(xv(k))
          Next
          xd /= h
          xn /= h
          mfn(j) *= xd
          y = appendprepend(h - 1)

          For k = 1 To h Step 1
            ei(0) = mev.item(xv(y(k)) & "," & xv(y(k + 1)) & "," & 0)
            ei(1) = mev.item(xv(y(k + 1)) & "," & xv(y(k)) & "," & 0)

            txv(0) = ev(ei(0)) * evalN(eD(ei(0)) * t0(xv(y(k))), xd * xn, eN(ei(0)))
            txv(1) = ev(ei(1)) * evalN(eD(ei(1)) * t0(xv(y(k + 1))), xd * xn, eN(ei(1)))

            'Define new per face vertices
            tv.add(evalP(ep(ei(0)) + txv(0), evalP(ep(ei(0)), av + evalV(txv(0), mfn(j), t0(xv(y(k)))), t0(xv(y(k)))), S(xv(y(k)))))
            tc.add(evalC(ec(ei(0)), ac, t0(xv(y(k)))))

            tv.add(evalP(ep(ei(1)) + txv(1), evalP(ep(ei(1)), av + evalV(txv(1), mfn(j), t0(xv(y(k + 1)))), t0(xv(y(k + 1)))), S(xv(y(k + 1)))))
            tc.add(evalC(ec(ei(1)), ac, t0(xv(y(k + 1)))))

            tcv += (tv.item(tv.count() - 1) + tv.item(tv.count() - 2)) / 2

            'Define new faces
            xf.add(New meshface(xv(y(k)), xv(y(k + 1)), w + y(k) * u + 1, w + y(k) * u))
            xf.add(New meshface(xv(y(k)), w + y(k) * u, w + y(k - 1) * u + 1))

            If c Then
              xf.add(New meshface(w + y(k) * u, w + y(k) * u + 1, v + jj - cf - 1))
              xf.add(New meshface(w + y(k - 1) * u + 1, w + y(k) * u, v + jj - cf - 1))
            End If
          Next
          If c Then
            tcv /= h
            fv.add(tcv)
            cc.add(ac)
          End If
        Next

        Dim om As New mesh
        om.Vertices.AddVertices(mv)
        If bmC Then om.VertexColors.AppendColors(mc.toarray())

        If c Then
          om.Vertices.AddVertices(fv)
          If bmC Then om.VertexColors.AppendColors(cc.toarray())
        End If

        om.Vertices.AddVertices(tv.toarray())
        If bmC Then om.VertexColors.AppendColors(tc.toarray())

        om.Faces.AddFaces(xf.toarray())
        If i.count() > 0 Then om.Vertices.CullUnused()

        If i.count() > 1 Then om.Vertices.CullUnused()

        A = om
      End If
    End If
# ---------- m_aperture_0: VB additional code ----------
  Private Function appendprepend(ByVal i As Integer)
    Dim srsEnum As IEnumerable(Of Integer) = Enumerable.Range(0, i + 1)
    Dim arrVal As New list(Of Integer)
    arrVal = srsEnum.tolist()
    arrVal.add(0)
    arrVal.insert(0, i)
    Return arrVal.toarray()
  End Function

  Private Function matchDbl(ByVal a As list(Of Double), ByVal t As Integer)
    Dim i,k As Integer
    k = a.count()
    For i = 0 To ((t + 1) - k) - 1 Step 1
      a.add(a.item(k - 1))
    Next
    Return a
  End Function

  Private Function matchClr(ByVal a As list(Of Color), ByVal t As Integer)
    Dim i,k As Integer
    k = a.count()
    For i = 0 To ((t + 1) - k) - 1 Step 1
      a.add(a.item(k - 1))
    Next
    Return a
  End Function

  Private Function evalP(ByVal op As point3d, ByVal tp As Point3d, ByVal t As Double)
    Return New point3d(op + (tp - op) * t)
  End Function

  Private Function evalV(ByVal ov As vector3d, ByVal tv As vector3d, ByVal t As Double)
    Return New vector3d(ov + (tv - ov) * t)
  End Function

  Private Function evalN(ByVal u As Double, ByVal v As Double, ByVal t As Double)
    Return u + (v - u) * t
  End Function

  Private Function avgVec(ByVal v() As vector3f)
    Dim i As Integer
    Dim tv As Vector3d

    For i = 0 To (v.Length - 1) Step 1
      tv += v(i)
    Next
    tv /= ((v.Length - 1) + 1)
    tv.Unitize()
    Return New vector3f(tv.X, tv.Y, tv.Z)
  End Function

  Private Function roundClr(ByVal r As Integer, ByVal g As Integer, ByVal b As Integer, ByVal i As Integer)
    r = CInt(r / i)
    g = CInt(g / i)
    b = CInt(b / i)

    If r > 255 Then r = 255 Else If r < 0 Then r = 0
    If g > 255 Then g = 255 Else If g < 0 Then g = 0
    If b > 255 Then b = 255 Else If b < 0 Then b = 0

    Return color.FromArgb(r, g, b)
  End Function

  Private Function avgClr(ByVal c() As color)
    Dim r,g,b As Integer
    Dim i,k As Integer

    k = (c.Length - 1) + 1

    For i = 0 To k - 1 Step 1
      r += CInt(c(i).R)
      g += CInt(c(i).G)
      b += CInt(c(i).B)
    Next

    r = CInt(r / k)
    g = CInt(g / k)
    b = CInt(b / k)

    If r > 255 Then r = 255 Else If r < 0 Then r = 0
    If g > 255 Then g = 255 Else If g < 0 Then g = 0
    If b > 255 Then b = 255 Else If b < 0 Then b = 0

    Return color.FromArgb(r, g, b)
  End Function

  Private Function evalC(ByVal oc As color, ByVal tc As color, ByVal t As Double)
    Dim r,g,b As Integer
    r = CInt(CInt(oc.R) + (CInt(tc.R) - CInt(oc.R)) * t)
    g = CInt(CInt(oc.G) + (CInt(tc.G) - CInt(oc.G)) * t)
    b = CInt(CInt(oc.B) + (CInt(tc.B) - CInt(oc.B)) * t)

    If r > 255 Then r = 255 Else If r < 0 Then r = 0
    If g > 255 Then g = 255 Else If g < 0 Then g = 0
    If b > 255 Then b = 255 Else If b < 0 Then b = 0

    Return color.FromArgb(r, g, b)
  End Function
# ---------- end m_aperture_0 ----------
m_frame_0 = Frame0(G=qrmesh, T0=0.5, D=0, N=1, S=1, O=True)  # -> out, A; inputs G: GeometryBase, I: list, T0: list, D: list, N: list, S: list, clr: list of Color; disabled
# ---------- m_frame_0: VB ----------
    Component.Params.Input(0).Name = "Mesh or Curve"
    Component.Params.Input(0).Description = "Open or closed mesh or curve"
    Component.Params.Input(1).Name = "Index [Face]"
    Component.Params.Input(1).Description = "An optional integer or list of integers which specify the faces to be modified if the input is a mesh. If no value is supplied then all faces will be modified"
    Component.Params.Input(2).Name = "Vert to Face"
    Component.Params.Input(2).Description = "Evaluates a new vertex between the input geometry's vertex to the face center"
    Component.Params.Input(3).Name = "Distance"
    Component.Params.Input(3).Description = "Sets the depth for the center point offset of each face"
    Component.Params.Input(4).Name = "Normalize"
    Component.Params.Input(4).Description = "If true averages the vertex values per face, if false each new vertices parameters are associated to its origin vertex"
    Component.Params.Input(5).Name = "Stellate"
    Component.Params.Input(5).Description = "A unitized per vertex number which shifts the offset vector from vertex = 0 to face = 1 normal"
    Component.Params.Input(6).Name = "Close"
    Component.Params.Input(6).Description = "If true then additional faces and if needed vertices will be added to the mesh, covering the complete areas of the existing mesh"
    Component.Params.Input(7).Name = "Optimize"
    Component.Params.Input(7).Description = "If true, when faces are quad or tri based, a single face will be used about the face center, if false or per face vertex count is greater than 4 then a new offset vertex is added"
    Component.Params.Input(8).Name = "Color [Vertex]"
    Component.Params.Input(8).Description = "(If applied to a mesh a list of colors corresponding to each mesh face, if applied to a curve, a list of colors corresponding to each control point plus an additonal color value for the new averaged center"

    Component.Params.Output(1).Name = "Mesh"
    Component.Params.Output(1).Description = "If successful, a valid mesh"

    If G IsNot Nothing Then

      Dim bM, bP,bmC,biC As Boolean

      bM = g.ObjectType = ObjectType.Mesh
      bP = g.ObjectType = ObjectType.Curve

      If (bM Or bP) Then
        Dim msh As New mesh
        Dim crv As curve
        Dim av As point3d
        Dim ac As color
        Dim h,j,jj,k,u,v,w As Integer
        Dim cv,cf As Integer
        Dim x(),y() As Integer

        Dim mv,fv,ev,tv As New list(Of Point3d)
        Dim mf As Rhino.Geometry.Collections.MeshFaceList = Nothing
        Dim mtv As Rhino.Geometry.Collections.MeshTopologyVertexList = Nothing
        Dim mte As Rhino.Geometry.Collections.MeshTopologyEdgeList = Nothing
        Dim mn As Rhino.Geometry.Collections.MeshVertexNormalList = Nothing
        Dim mfn As Rhino.Geometry.Collections.MeshFaceNormalList = Nothing
        Dim mc,tc,cc,fc As New list(Of color)
        Dim xf As New list(Of meshface)

        If clr.count() = 0 Then clr.add(color.LightGray) Else biC = True

        If bm Then
          'Start Deconstruct if Mesh
          msh = g

          If msh.Normals.Count() = 0 Then msh.Normals.ComputeNormals()
          If msh.FaceNormals.Count() = 0 Then msh.FaceNormals.ComputeFaceNormals()

          If i.count() = 0 Then I = Enumerable.Range(0, msh.Faces.Count()).ToList()

          mv = msh.Vertices().ToPoint3dArray().tolist()
          mtv = msh.TopologyVertices()
          mf = msh.Faces()

          mn = msh.Normals()
          mn.UnitizeNormals()
          mfn = msh.FaceNormals()
          mfn.UnitizeFaceNormals()

          cf = I.Count() - 1

          'Assign Colors
          If msh.VertexColors.Count() = 0 Then
            msh.VertexColors.CreateMonotoneMesh(color.LightGray)
            bmC = biC
          Else
            bmC = True
          End If
          'Assign fake edges
          mc = msh.VertexColors().ToArray().ToList()
        Else
          'Start Deconstruct if Curve
          crv = g

          I.clear()
          I.add(0)
          Dim nc As nurbscurve
          Dim pc As polyline
          Dim nps As Rhino.Geometry.Collections.NurbsCurvePointList

          nc = crv.ToNurbsCurve()
          nps = nc.Points
          pc = nc.Points.ControlPolygon
          If (Not pc.IsClosed) Then pc.add(pc(0))
          av = pc.CenterPoint

          msh.Vertices.AddVertices(pc.ToArray())
          msh.faces.addfaces(pc.TriangulateClosedPolyline())
          msh.Vertices.Remove(pc.count() - 1, True)
          msh.FaceNormals.ComputeFaceNormals()
          msh.Normals.ComputeNormals()
          msh.Normals.UnitizeNormals()

          mv = msh.Vertices.ToPoint3dArray().tolist()
          mtv = msh.TopologyVertices()
          mn = msh.Normals()
          mfn = msh.FaceNormals()

          mfn(0) = avgVec(mn.toarray())

          'Assign Colors
          If bic Then bmC = True
          mc = clr
          If (clr.count() - 1) < (mv.count() - 1) Then mc = matchClr(mc, mv.count() - 1)


          ac = avgClr(mc.toarray())
          If (mv.count() - 1) > 3 Then o = False
          cf = 0
        End If
        cv = mv.count() - 1

        x = appendprepend(cv)
        'Match variables and colors to vertex count
        If (T0.count() - 1) < cv Then T0 = matchDbl(T0, cv)
        If (D.count() - 1) < cv Then D = matchDbl(D, cv)
        If (N.count() - 1) < cv Then N = matchDbl(N, cv)
        If (S.count() - 1) < cv Then S = matchDbl(S, cv)
        If (clr.count() - 1) < cv Then clr = matchClr(clr, cv)
        If biC Then fc = clr Else fc = mc

        'Face based vertices
        Dim xv(),mt() As Integer
        Dim xc() As color
        Dim xd,xn As Double
        Dim txv(0) As vector3d
        u = 1
        v = mv.count()
        If (c And (o = False)) Then v += cf + 1

        For jj = 0 To I.count() - 1 Step 1
          Dim tcv As New point3d
          j = I(jj)
          w = v + tv.count()
          xd = 0
          xn = 0
          If bm Then
            If mf(j).isquad() Then h = 4 Else h = 3
            ReDim xv(h - 1)
            ReDim xc(h - 1)
            mt = mf.GetTopologicalVertices(j)
            For k = 0 To h - 1 Step 1
              xv(k) = mtv.MeshVertexIndices(mt(k))(0)
              xc(k) = fc(xv(k))
            Next
            av = mf.GetFaceCenter(j)
            ac = avgClr(xc)
          Else
            h = mv.count()
            xv = Enumerable.Range(0, h).ToArray()
          End If
          For k = 0 To h - 1 Step 1
            xd += D(xv(k))
            xn += T0(xv(k))
          Next
          xd /= h
          xn /= h
          mfn(j) *= xd
          y = appendprepend(h - 1)

          For k = 1 To h Step 1
            Dim td As Double = (evalN(D(xv(y(k))) * t0(xv(y(k))), xd * xn, N(xv(y(k)))))
            txv(0) = mN(xv(y(k))) * td
            'Define new per face vertices
            tv.add(evalP(mv(xv(y(k))) + txv(0), evalP(mv(xv(y(k))), av + evalV(txv(0), mfn(j), t0(xv(y(k)))), t0(xv(y(k)))), S(xv(y(k)))))
            tc.add(evalC(mc(xv(y(k))), ac, t0(xv(y(k)))))
            tcv += tv.item(tv.count() - 1)

            'Define new faces
            xf.add(New meshface(xv(y(k)), xv(y(k + 1)), w + y(k + 1) * u, w + y(k) * u))

            If (c And (o = False))Then
              xf.add(New meshface(w + y(k + 1) * u, v + jj - cf - 1, w + y(k) * u))
            End If
          Next
          If (c And o)Then
            If h = 3 Then
              xf.add(New meshface(w + 0 * u, w + 1 * u, w + 2 * u))
            ElseIf h = 4 Then
              xf.add(New meshface(w + 0 * u, w + 1 * u, w + 2 * u, w + 3 * u))
            End If
          Else
            tcv /= h
            fv.add(tcv)
            cc.add(ac)
          End If
        Next

        Dim om As New mesh
        om.Vertices.AddVertices(mv)
        If bmC Then om.VertexColors.AppendColors(mc.toarray())

        If c Then
          om.Vertices.AddVertices(fv)
          If bmC Then om.VertexColors.AppendColors(cc.toarray())
        End If

        om.Vertices.AddVertices(tv.toarray())
        If bmC Then om.VertexColors.AppendColors(tc.toarray())

        om.Faces.AddFaces(xf.toarray())
        If i.count() > 0 Then om.Vertices.CullUnused()

        If i.count() > 1 Then om.Vertices.CullUnused()

        A = om
      End If
    End If
# ---------- m_frame_0: VB additional code ----------
  Private Function appendprepend(ByVal i As Integer)
    Dim srsEnum As IEnumerable(Of Integer) = Enumerable.Range(0, i + 1)
    Dim arrVal As New list(Of Integer)
    arrVal = srsEnum.tolist()
    arrVal.add(0)
    arrVal.insert(0, i)
    Return arrVal.toarray()
  End Function

  Private Function matchDbl(ByVal a As list(Of Double), ByVal t As Integer)
    Dim i,k As Integer
    k = a.count()
    For i = 0 To ((t + 1) - k) - 1 Step 1
      a.add(a.item(k - 1))
    Next
    Return a
  End Function

  Private Function matchClr(ByVal a As list(Of Color), ByVal t As Integer)
    Dim i,k As Integer
    k = a.count()
    For i = 0 To ((t + 1) - k) - 1 Step 1
      a.add(a.item(k - 1))
    Next
    Return a
  End Function

  Private Function evalP(ByVal op As point3d, ByVal tp As Point3d, ByVal t As Double)
    Return New point3d(op + (tp - op) * t)
  End Function

  Private Function evalV(ByVal ov As vector3d, ByVal tv As vector3d, ByVal t As Double)
    Return New vector3d(ov + (tv - ov) * t)
  End Function

  Private Function evalN(ByVal u As Double, ByVal v As Double, ByVal t As Double)
    Return u + (v - u) * t
  End Function

  Private Function avgVec(ByVal v() As vector3f)
    Dim i As Integer
    Dim tv As Vector3d

    For i = 0 To (v.Length - 1) Step 1
      tv += v(i)
    Next
    tv /= ((v.Length - 1) + 1)
    tv.Unitize()
    Return New vector3f(tv.X, tv.Y, tv.Z)
  End Function

  Private Function roundClr(ByVal r As Integer, ByVal g As Integer, ByVal b As Integer, ByVal i As Integer)
    r = CInt(r / i)
    g = CInt(g / i)
    b = CInt(b / i)

    If r > 255 Then r = 255 Else If r < 0 Then r = 0
    If g > 255 Then g = 255 Else If g < 0 Then g = 0
    If b > 255 Then b = 255 Else If b < 0 Then b = 0

    Return color.FromArgb(r, g, b)
  End Function

  Private Function avgClr(ByVal c() As color)
    Dim r,g,b As Integer
    Dim i,k As Integer

    k = (c.Length - 1) + 1

    For i = 0 To k - 1 Step 1
      r += CInt(c(i).R)
      g += CInt(c(i).G)
      b += CInt(c(i).B)
    Next

    r = CInt(r / k)
    g = CInt(g / k)
    b = CInt(b / k)

    If r > 255 Then r = 255 Else If r < 0 Then r = 0
    If g > 255 Then g = 255 Else If g < 0 Then g = 0
    If b > 255 Then b = 255 Else If b < 0 Then b = 0

    Return color.FromArgb(r, g, b)
  End Function

  Private Function evalC(ByVal oc As color, ByVal tc As color, ByVal t As Double)
    Dim r,g,b As Integer
    r = CInt(CInt(oc.R) + (CInt(tc.R) - CInt(oc.R)) * t)
    g = CInt(CInt(oc.G) + (CInt(tc.G) - CInt(oc.G)) * t)
    b = CInt(CInt(oc.B) + (CInt(tc.B) - CInt(oc.B)) * t)

    If r > 255 Then r = 255 Else If r < 0 Then r = 0
    If g > 255 Then g = 255 Else If g < 0 Then g = 0
    If b > 255 Then b = 255 Else If b < 0 Then b = 0

    Return color.FromArgb(r, g, b)
  End Function
# ---------- end m_frame_0 ----------

# ----
# Can make 3D objects as meshes but need to somehow make seams between them
facen = FaceNormals(Mesh=qrmesh)  # -> Centers, Normals; disabled

meshcp = MeshClosestPoint(Point=facen.Centers, Mesh=qrmesh)  # -> Point, Index, Parameter; disabled
# Order is all over the place
# Impossible to do assembly
meval = MeshEval(Mesh=qrmesh, Parameter=meshcp.Parameter)  # -> Point, Normal, Colour; disabled
points = PointList(Points=meval.Point)  # disabled

item_13 = ListItem(List=loft_2, Index="0", Wrap=True)  # -> simplify(Item)
# Surface experiments
sunion = SolidUnion(Breps=item_13)
number_slider_15 = Slider(0, range=0..100)
number_slider_16 = Slider(4, range=0..10)
md_slider = MDSlider(SliderMode=0, slider_value=Point(0.5, 0.5, 0.5), x_domain=Domain(0, 1), y_domain=Domain(0, 1), z_domain=Domain(0, 1))

bbox = BoundingBox(Content=item_13, Plane=PlaneXY(0, 0, 0))  # -> Box, Box_2
debox = DeconstructBox(Box=bbox.Box)  # -> Plane, X, Y, Z
dedomain = DeconstructDomain(Domain=debox.Z)  # -> Start, End
rebuildsrf = RebuildSurface(Surface=item_13, UDegree=3, VDegree=3, UNumber=10, VNumber=number_slider_16)
dom = ConstructDomain(DomainStart=dedomain.Start, DomainEnd=dedomain.End)
range = Range(Domain=dom, Steps=Slider(5, range=0..10))

# ---- group: additional plane on top
item_14 = ListItem(List=range, Index=0, Wrap=True)  # -> Item2, Item1, Item
subtraction = Subtraction(A=item_14.Item1, B=item_14.Item2)
division_2 = Division(A=subtraction, B=Slider(1.5, range=0..10))
addition = Addition(A=item_14.Item2, B=division_2)
merge_2 = Merge(Data1=range, Data2=addition)
sort = SortList(Keys=merge_2, ValuesA=merge_2)  # -> Keys, ValuesA

# ----
pt_2 = ConstructPoint(XCoordinate=0, YCoordinate=0, ZCoordinate=sort.ValuesA)
xy = XYPlane(Origin=pt_2)
sec = BrepPlane(Brep=item_13, Plane=xy)  # -> flatten(Curves), Points
srfsplit = SurfaceSplit(Surface=item_13, Curves=flatten(sec.Curves))  # -> reparameterize(Fragments)
shrinktrimsrf = ShrinkTrimmedSurface(Surface=srfsplit)  # -> Shrunken, reparameterize(Underlying), R
evalsrf = EvaluateSurface(Surface=simplify(shrinktrimsrf.Underlying), Point=md_slider)  # -> Point, Normal, UDirection, VDirection, Frame
pdecon = Deconstruct(Point=evalsrf.Point)  # -> XComponent, YComponent, ZComponent
sort_2 = SortList(Keys=flatten(pdecon.ZComponent), ValuesA=flatten(shrinktrimsrf.Shrunken))  # -> Keys, ValuesA

divide = DivideDomain²(Domain=sort_2.ValuesA, UCount=Slider(3, range=0..10), VCount=number_slider_16)  # -> simplify(Segments)
subsrf = Isotrim(Surface=simplify(graft(sort_2.ValuesA)), Domain=divide)  # -> reparameterize(Surface)
evalsrf_2 = EvaluateSurface(Surface=simplify(subsrf), Point=md_slider)  # -> Point, Normal, UDirection, VDirection, Frame

# ----
# Nice order, we can work with it
points_2 = PointList(Points=evalsrf_2.Point)

item_15 = ListItem(List=loft, Index="2", Wrap=True)  # -> simplify(Item)
sunion_2 = SolidUnion(Breps=item_15)
number_slider_17 = Slider(0, range=0..100)
number_slider_18 = Slider(4, range=0..10)
md_slider_2 = MDSlider(SliderMode=0, slider_value=Point(0.5, 0.5, 0.5), x_domain=Domain(0, 1), y_domain=Domain(0, 1), z_domain=Domain(0, 1))

bbox_2 = BoundingBox(Content=item_15, Plane=PlaneXY(0, 0, 0))  # -> Box, Box_2
debox_2 = DeconstructBox(Box=bbox_2.Box)  # -> Plane, X, Y, Z
dedomain_2 = DeconstructDomain(Domain=debox_2.Z)  # -> Start, End
rebuildsrf_2 = RebuildSurface(Surface=item_15, UDegree=3, VDegree=3, UNumber=10, VNumber=number_slider_18)
dom_2 = ConstructDomain(DomainStart=dedomain_2.Start, DomainEnd=dedomain_2.End)
range_2 = Range(Domain=dom_2, Steps=Slider(5, range=0..10))

# ---- group: additional plane on top
item_16 = ListItem(List=range_2, Index=0, Wrap=True)  # -> Item2, Item1, Item
subtraction_2 = Subtraction(A=item_16.Item1, B=item_16.Item2)
division_3 = Division(A=subtraction_2, B=Slider(1.5, range=0..10))
addition_2 = Addition(A=item_16.Item2, B=division_3)
merge_3 = Merge(Data1=range_2, Data2=addition_2)
sort_3 = SortList(Keys=merge_3, ValuesA=merge_3)  # -> Keys, ValuesA

# ----
pt_3 = ConstructPoint(XCoordinate=0, YCoordinate=0, ZCoordinate=sort_3.ValuesA)
xy_2 = XYPlane(Origin=pt_3)
sec_2 = BrepPlane(Brep=item_15, Plane=xy_2)  # -> flatten(Curves), Points
srfsplit_2 = SurfaceSplit(Surface=item_15, Curves=flatten(sec_2.Curves))  # -> reparameterize(Fragments)
shrinktrimsrf_2 = ShrinkTrimmedSurface(Surface=srfsplit_2)  # -> Shrunken, reparameterize(Underlying), R
evalsrf_3 = EvaluateSurface(Surface=simplify(shrinktrimsrf_2.Underlying), Point=md_slider_2)  # -> Point, Normal, UDirection, VDirection, Frame
pdecon_2 = Deconstruct(Point=evalsrf_3.Point)  # -> XComponent, YComponent, ZComponent
sort_4 = SortList(Keys=flatten(pdecon_2.ZComponent), ValuesA=flatten(shrinktrimsrf_2.Shrunken))  # -> Keys, ValuesA

divide_2 = DivideDomain²(Domain=sort_4.ValuesA, UCount=Slider(3, range=0..10), VCount=number_slider_18)  # -> simplify(Segments)
subsrf_2 = Isotrim(Surface=simplify(graft(sort_4.ValuesA)), Domain=divide_2)  # -> reparameterize(Surface)
evalsrf_4 = EvaluateSurface(Surface=simplify(subsrf_2), Point=md_slider_2)  # -> Point, Normal, UDirection, VDirection, Frame

# ----
# Nice order, we can work with it
points_3 = PointList(Points=evalsrf_4.Point)

item_17 = ListItem(List=loft, Index="1", Wrap=True)  # -> simplify(Item)
sunion_3 = SolidUnion(Breps=item_17)
number_slider_19 = Slider(0, range=0..100)
number_slider_20 = Slider(4, range=0..10)
md_slider_3 = MDSlider(SliderMode=0, slider_value=Point(0.5, 0.5, 0.5), x_domain=Domain(0, 1), y_domain=Domain(0, 1), z_domain=Domain(0, 1))

bbox_3 = BoundingBox(Content=item_17, Plane=PlaneXY(0, 0, 0))  # -> Box, Box_2
debox_3 = DeconstructBox(Box=bbox_3.Box)  # -> Plane, X, Y, Z
dedomain_3 = DeconstructDomain(Domain=debox_3.Z)  # -> Start, End
rebuildsrf_3 = RebuildSurface(Surface=item_17, UDegree=3, VDegree=3, UNumber=10, VNumber=number_slider_20)
dom_3 = ConstructDomain(DomainStart=dedomain_3.Start, DomainEnd=dedomain_3.End)
range_3 = Range(Domain=dom_3, Steps=Slider(5, range=0..10))

# ---- group: additional plane on top
item_18 = ListItem(List=range_3, Index=0, Wrap=True)  # -> Item2, Item1, Item
subtraction_3 = Subtraction(A=item_18.Item1, B=item_18.Item2)
division_4 = Division(A=subtraction_3, B=Slider(1.5, range=0..10))
addition_3 = Addition(A=item_18.Item2, B=division_4)
merge_4 = Merge(Data1=range_3, Data2=addition_3)
sort_5 = SortList(Keys=merge_4, ValuesA=merge_4)  # -> Keys, ValuesA

# ----
pt_4 = ConstructPoint(XCoordinate=0, YCoordinate=0, ZCoordinate=sort_5.ValuesA)
xy_3 = XYPlane(Origin=pt_4)
sec_3 = BrepPlane(Brep=item_17, Plane=xy_3)  # -> flatten(Curves), Points
srfsplit_3 = SurfaceSplit(Surface=item_17, Curves=flatten(sec_3.Curves))  # -> reparameterize(Fragments)
shrinktrimsrf_3 = ShrinkTrimmedSurface(Surface=srfsplit_3)  # -> Shrunken, reparameterize(Underlying), R
evalsrf_5 = EvaluateSurface(Surface=simplify(shrinktrimsrf_3.Underlying), Point=md_slider_3)  # -> Point, Normal, UDirection, VDirection, Frame
pdecon_3 = Deconstruct(Point=evalsrf_5.Point)  # -> XComponent, YComponent, ZComponent
sort_6 = SortList(Keys=flatten(pdecon_3.ZComponent), ValuesA=flatten(shrinktrimsrf_3.Shrunken))  # -> Keys, ValuesA

divide_3 = DivideDomain²(Domain=sort_6.ValuesA, UCount=Slider(3, range=0..10), VCount=number_slider_20)  # -> simplify(Segments)
subsrf_3 = Isotrim(Surface=simplify(graft(sort_6.ValuesA)), Domain=divide_3)  # -> reparameterize(Surface)
evalsrf_6 = EvaluateSurface(Surface=simplify(subsrf_3), Point=md_slider_3)  # -> Point, Normal, UDirection, VDirection, Frame

# ----
# Nice order, we can work with it
points_4 = PointList(Points=evalsrf_6.Point)

item_19 = ListItem(List=dome_srf_2, Index="0", Wrap=True)  # -> simplify(Item)
sunion_4 = SolidUnion(Breps=item_19)
number_slider_21 = Slider(0, range=0..100)
number_slider_22 = Slider(4, range=0..10)
md_slider_4 = MDSlider(SliderMode=0, slider_value=Point(0.5, 0.5, 0.5), x_domain=Domain(0, 1), y_domain=Domain(0, 1), z_domain=Domain(0, 1))

item_20 = ListItem(List=loft, Index="0", Wrap=True)  # -> simplify(Item)
sunion_5 = SolidUnion(Breps=item_20)
# for strange faces
number_slider_23 = Slider(0, range=0..100)
number_slider_24 = Slider(4, range=0..10)
md_slider_5 = MDSlider(SliderMode=0, slider_value=Point(0.5, 0.5, 0.5), x_domain=Domain(0, 1), y_domain=Domain(0, 1), z_domain=Domain(0, 1))

item_21 = ListItem(List=loft_2, Index="2", Wrap=True)  # -> simplify(Item)
sunion_6 = SolidUnion(Breps=item_21)
number_slider_25 = Slider(0, range=0..100)
number_slider_26 = Slider(4, range=0..10)
md_slider_6 = MDSlider(SliderMode=0, slider_value=Point(0.5, 0.5, 0.5), x_domain=Domain(0, 1), y_domain=Domain(0, 1), z_domain=Domain(0, 1))

item_22 = ListItem(List=loft_2, Index="1", Wrap=True)  # -> simplify(Item)
number_slider_27 = Slider(4, range=0..10)
md_slider_7 = MDSlider(SliderMode=0, slider_value=Point(0.5, 0.5, 0.5), x_domain=Domain(0, 1), y_domain=Domain(0, 1), z_domain=Domain(0, 1))

item_23 = ListItem(List=dome_srf_2, Index="1", Wrap=True)  # -> simplify(Item)
sunion_7 = SolidUnion(Breps=item_23)
number_slider_28 = Slider(0, range=0..100)
number_slider_29 = Slider(4, range=0..10)
md_slider_8 = MDSlider(SliderMode=0, slider_value=Point(0.5, 0.5, 0.5), x_domain=Domain(0, 1), y_domain=Domain(0, 1), z_domain=Domain(0, 1))

item_24 = ListItem(List=dome_srf_2, Index="2", Wrap=True)  # -> simplify(Item)
sunion_8 = SolidUnion(Breps=item_24)
number_slider_30 = Slider(0, range=0..100)
number_slider_31 = Slider(4, range=0..10)
md_slider_9 = MDSlider(SliderMode=0, slider_value=Point(0.5, 0.5, 0.5), x_domain=Domain(0, 1), y_domain=Domain(0, 1), z_domain=Domain(0, 1))

bbox_4 = BoundingBox(Content=item_24, Plane=PlaneXY(0, 0, 0))  # -> Box, Box_2
debox_4 = DeconstructBox(Box=bbox_4.Box)  # -> Plane, X, Y, Z
dedomain_4 = DeconstructDomain(Domain=debox_4.Z)  # -> Start, End
rebuildsrf_4 = RebuildSurface(Surface=item_24, UDegree=3, VDegree=3, UNumber=10, VNumber=number_slider_31)
dom_4 = ConstructDomain(DomainStart=dedomain_4.Start, DomainEnd=dedomain_4.End)
range_4 = Range(Domain=dom_4, Steps=Slider(5, range=0..10))

# ---- group: additional plane on top
item_25 = ListItem(List=range_4, Index=0, Wrap=True)  # -> Item2, Item1, Item
subtraction_4 = Subtraction(A=item_25.Item1, B=item_25.Item2)
division_5 = Division(A=subtraction_4, B=Slider(1.5, range=0..10))
addition_4 = Addition(A=item_25.Item2, B=division_5)
merge_5 = Merge(Data1=range_4, Data2=addition_4)
sort_7 = SortList(Keys=merge_5, ValuesA=merge_5)  # -> Keys, ValuesA

# ----
pt_5 = ConstructPoint(XCoordinate=0, YCoordinate=0, ZCoordinate=sort_7.ValuesA)
xy_4 = XYPlane(Origin=pt_5)
sec_4 = BrepPlane(Brep=item_24, Plane=xy_4)  # -> flatten(Curves), Points
srfsplit_4 = SurfaceSplit(Surface=item_24, Curves=flatten(sec_4.Curves))  # -> reparameterize(Fragments)
shrinktrimsrf_4 = ShrinkTrimmedSurface(Surface=srfsplit_4)  # -> Shrunken, reparameterize(Underlying), R
evalsrf_7 = EvaluateSurface(Surface=simplify(shrinktrimsrf_4.Underlying), Point=md_slider_9)  # -> Point, Normal, UDirection, VDirection, Frame
pdecon_4 = Deconstruct(Point=evalsrf_7.Point)  # -> XComponent, YComponent, ZComponent
sort_8 = SortList(Keys=flatten(pdecon_4.ZComponent), ValuesA=flatten(shrinktrimsrf_4.Shrunken))  # -> Keys, ValuesA

divide_4 = DivideDomain²(Domain=sort_8.ValuesA, UCount=Slider(1, range=0..10), VCount=number_slider_31)  # -> simplify(Segments)
subsrf_4 = Isotrim(Surface=simplify(graft(sort_8.ValuesA)), Domain=divide_4)  # -> reparameterize(Surface)
evalsrf_8 = EvaluateSurface(Surface=simplify(subsrf_4), Point=md_slider_9)  # -> Point, Normal, UDirection, VDirection, Frame

# ----
# Nice order, we can work with it
points_5 = PointList(Points=evalsrf_8.Point)

# ----
# Surface experiments
bbox_5 = BoundingBox(Content=item_22, Plane=PlaneXY(0, 0, 0))  # -> Box, Box_2
debox_5 = DeconstructBox(Box=bbox_5.Box)  # -> Plane, X, Y, Z
dedomain_5 = DeconstructDomain(Domain=debox_5.Z)  # -> Start, End
rebuildsrf_5 = RebuildSurface(Surface=item_22, UDegree=3, VDegree=3, UNumber=10, VNumber=number_slider_27)
dom_5 = ConstructDomain(DomainStart=dedomain_5.Start, DomainEnd=dedomain_5.End)
range_5 = Range(Domain=dom_5, Steps=Slider(5, range=0..10))

# ---- group: additional plane on top
item_26 = ListItem(List=range_5, Index=0, Wrap=True)  # -> Item2, Item1, Item
subtraction_5 = Subtraction(A=item_26.Item1, B=item_26.Item2)
division_6 = Division(A=subtraction_5, B=Slider(1.5, range=0..10))
addition_5 = Addition(A=item_26.Item2, B=division_6)
merge_6 = Merge(Data1=range_5, Data2=addition_5)
sort_9 = SortList(Keys=merge_6, ValuesA=merge_6)  # -> Keys, ValuesA

# ----
pt_6 = ConstructPoint(XCoordinate=0, YCoordinate=0, ZCoordinate=sort_9.ValuesA)
xy_5 = XYPlane(Origin=pt_6)
sec_5 = BrepPlane(Brep=item_22, Plane=xy_5)  # -> flatten(Curves), Points
srfsplit_5 = SurfaceSplit(Surface=item_22, Curves=flatten(sec_5.Curves))  # -> reparameterize(Fragments)
shrinktrimsrf_5 = ShrinkTrimmedSurface(Surface=srfsplit_5)  # -> Shrunken, reparameterize(Underlying), R
evalsrf_9 = EvaluateSurface(Surface=simplify(shrinktrimsrf_5.Underlying), Point=md_slider_7)  # -> Point, Normal, UDirection, VDirection, Frame
pdecon_5 = Deconstruct(Point=evalsrf_9.Point)  # -> XComponent, YComponent, ZComponent
sort_10 = SortList(Keys=flatten(pdecon_5.ZComponent), ValuesA=flatten(shrinktrimsrf_5.Shrunken))  # -> Keys, ValuesA

divide_5 = DivideDomain²(Domain=sort_10.ValuesA, UCount=Slider(3, range=0..10), VCount=number_slider_27)  # -> simplify(Segments)
subsrf_5 = Isotrim(Surface=simplify(graft(sort_10.ValuesA)), Domain=divide_5)  # -> reparameterize(Surface)
evalsrf_10 = EvaluateSurface(Surface=simplify(subsrf_5), Point=md_slider_7)  # -> Point, Normal, UDirection, VDirection, Frame

# ----
# Nice order, we can work with it
points_6 = PointList(Points=evalsrf_10.Point)

# ----
# Surface experiments
bbox_6 = BoundingBox(Content=item_20, Plane=PlaneXY(0, 0, 0))  # -> Box, Box_2
debox_6 = DeconstructBox(Box=bbox_6.Box)  # -> Plane, X, Y, Z
dedomain_6 = DeconstructDomain(Domain=debox_6.Z)  # -> Start, End
rebuildsrf_6 = RebuildSurface(Surface=item_20, UDegree=3, VDegree=3, UNumber=10, VNumber=number_slider_24)
dom_6 = ConstructDomain(DomainStart=dedomain_6.Start, DomainEnd=dedomain_6.End)
range_6 = Range(Domain=dom_6, Steps=Slider(5, range=0..10))

# ---- group: additional plane on top
item_27 = ListItem(List=range_6, Index=0, Wrap=True)  # -> Item2, Item1, Item
subtraction_6 = Subtraction(A=item_27.Item1, B=item_27.Item2)
division_7 = Division(A=subtraction_6, B=Slider(1.5, range=0..10))
addition_6 = Addition(A=item_27.Item2, B=division_7)
merge_7 = Merge(Data1=range_6, Data2=addition_6)
sort_11 = SortList(Keys=merge_7, ValuesA=merge_7)  # -> Keys, ValuesA

# ----
pt_7 = ConstructPoint(XCoordinate=0, YCoordinate=0, ZCoordinate=sort_11.ValuesA)
xy_6 = XYPlane(Origin=pt_7)
sec_6 = BrepPlane(Brep=item_20, Plane=xy_6)  # -> flatten(Curves), Points
srfsplit_6 = SurfaceSplit(Surface=item_20, Curves=flatten(sec_6.Curves))  # -> reparameterize(Fragments)
shrinktrimsrf_6 = ShrinkTrimmedSurface(Surface=srfsplit_6)  # -> Shrunken, reparameterize(Underlying), R
evalsrf_11 = EvaluateSurface(Surface=simplify(shrinktrimsrf_6.Underlying), Point=md_slider_5)  # -> Point, Normal, UDirection, VDirection, Frame
pdecon_6 = Deconstruct(Point=evalsrf_11.Point)  # -> XComponent, YComponent, ZComponent
sort_12 = SortList(Keys=flatten(pdecon_6.ZComponent), ValuesA=flatten(shrinktrimsrf_6.Shrunken))  # -> Keys, ValuesA

divide_6 = DivideDomain²(Domain=sort_12.ValuesA, UCount=Slider(3, range=0..10), VCount=number_slider_24)  # -> simplify(Segments)
subsrf_6 = Isotrim(Surface=simplify(graft(sort_12.ValuesA)), Domain=divide_6)  # -> reparameterize(Surface)
evalsrf_12 = EvaluateSurface(Surface=simplify(subsrf_6), Point=md_slider_5)  # -> Point, Normal, UDirection, VDirection, Frame

# ----
# Nice order, we can work with it
points_7 = PointList(Points=evalsrf_12.Point)

# ----
# Surface experiments
bbox_7 = BoundingBox(Content=item_19, Plane=PlaneXY(0, 0, 0))  # -> Box, Box_2
debox_7 = DeconstructBox(Box=bbox_7.Box)  # -> Plane, X, Y, Z
dedomain_7 = DeconstructDomain(Domain=debox_7.Z)  # -> Start, End
rebuildsrf_7 = RebuildSurface(Surface=item_19, UDegree=3, VDegree=3, UNumber=10, VNumber=number_slider_22)
dom_7 = ConstructDomain(DomainStart=dedomain_7.Start, DomainEnd=dedomain_7.End)
range_7 = Range(Domain=dom_7, Steps=Slider(5, range=0..10))

# ---- group: additional plane on top
item_28 = ListItem(List=range_7, Index=0, Wrap=True)  # -> Item2, Item1, Item
subtraction_7 = Subtraction(A=item_28.Item1, B=item_28.Item2)
division_8 = Division(A=subtraction_7, B=Slider(1.5, range=0..10))
addition_7 = Addition(A=item_28.Item2, B=division_8)
merge_8 = Merge(Data1=range_7, Data2=addition_7)
sort_13 = SortList(Keys=merge_8, ValuesA=merge_8)  # -> Keys, ValuesA

# ----
pt_8 = ConstructPoint(XCoordinate=0, YCoordinate=0, ZCoordinate=sort_13.ValuesA)
xy_7 = XYPlane(Origin=pt_8)
sec_7 = BrepPlane(Brep=item_19, Plane=xy_7)  # -> flatten(Curves), Points
srfsplit_7 = SurfaceSplit(Surface=item_19, Curves=flatten(sec_7.Curves))  # -> reparameterize(Fragments)
shrinktrimsrf_7 = ShrinkTrimmedSurface(Surface=srfsplit_7)  # -> Shrunken, reparameterize(Underlying), R
evalsrf_13 = EvaluateSurface(Surface=simplify(shrinktrimsrf_7.Underlying), Point=md_slider_4)  # -> Point, Normal, UDirection, VDirection, Frame
pdecon_7 = Deconstruct(Point=evalsrf_13.Point)  # -> XComponent, YComponent, ZComponent
sort_14 = SortList(Keys=flatten(pdecon_7.ZComponent), ValuesA=flatten(shrinktrimsrf_7.Shrunken))  # -> Keys, ValuesA

divide_7 = DivideDomain²(Domain=sort_14.ValuesA, UCount=Slider(1, range=0..10), VCount=number_slider_22)  # -> simplify(Segments)
subsrf_7 = Isotrim(Surface=simplify(graft(sort_14.ValuesA)), Domain=divide_7)  # -> reparameterize(Surface)
evalsrf_14 = EvaluateSurface(Surface=simplify(subsrf_7), Point=md_slider_4)  # -> Point, Normal, UDirection, VDirection, Frame

# ----
# Nice order, we can work with it
points_8 = PointList(Points=evalsrf_14.Point)

# ----
# Surface experiments
bbox_8 = BoundingBox(Content=item_21, Plane=PlaneXY(0, 0, 0))  # -> Box, Box_2
debox_8 = DeconstructBox(Box=bbox_8.Box)  # -> Plane, X, Y, Z
dedomain_8 = DeconstructDomain(Domain=debox_8.Z)  # -> Start, End
# for strange faces
rebuildsrf_8 = RebuildSurface(Surface=item_21, UDegree=3, VDegree=3, UNumber=10, VNumber=number_slider_26)
dom_8 = ConstructDomain(DomainStart=dedomain_8.Start, DomainEnd=dedomain_8.End)
range_8 = Range(Domain=dom_8, Steps=Slider(5, range=0..10))

# ---- group: additional plane on top
item_29 = ListItem(List=range_8, Index=0, Wrap=True)  # -> Item2, Item1, Item
subtraction_8 = Subtraction(A=item_29.Item1, B=item_29.Item2)
division_9 = Division(A=subtraction_8, B=Slider(1.5, range=0..10))
addition_8 = Addition(A=item_29.Item2, B=division_9)
merge_9 = Merge(Data1=range_8, Data2=addition_8)
sort_15 = SortList(Keys=merge_9, ValuesA=merge_9)  # -> Keys, ValuesA

# ----
pt_9 = ConstructPoint(XCoordinate=0, YCoordinate=0, ZCoordinate=sort_15.ValuesA)
xy_8 = XYPlane(Origin=pt_9)
sec_8 = BrepPlane(Brep=item_21, Plane=xy_8)  # -> flatten(Curves), Points
srfsplit_8 = SurfaceSplit(Surface=item_21, Curves=flatten(sec_8.Curves))  # -> reparameterize(Fragments)
shrinktrimsrf_8 = ShrinkTrimmedSurface(Surface=srfsplit_8)  # -> Shrunken, reparameterize(Underlying), R
evalsrf_15 = EvaluateSurface(Surface=simplify(shrinktrimsrf_8.Underlying), Point=md_slider_6)  # -> Point, Normal, UDirection, VDirection, Frame
pdecon_8 = Deconstruct(Point=evalsrf_15.Point)  # -> XComponent, YComponent, ZComponent
sort_16 = SortList(Keys=flatten(pdecon_8.ZComponent), ValuesA=flatten(shrinktrimsrf_8.Shrunken))  # -> Keys, ValuesA

divide_8 = DivideDomain²(Domain=sort_16.ValuesA, UCount=Slider(3, range=0..10), VCount=number_slider_26)  # -> simplify(Segments)
subsrf_8 = Isotrim(Surface=simplify(graft(sort_16.ValuesA)), Domain=divide_8)  # -> reparameterize(Surface)
evalsrf_16 = EvaluateSurface(Surface=simplify(subsrf_8), Point=md_slider_6)  # -> Point, Normal, UDirection, VDirection, Frame

# ----
# Nice order, we can work with it
points_9 = PointList(Points=evalsrf_16.Point)

# ----
# Surface experiments
bbox_9 = BoundingBox(Content=item_23, Plane=PlaneXY(0, 0, 0))  # -> Box, Box_2
debox_9 = DeconstructBox(Box=bbox_9.Box)  # -> Plane, X, Y, Z
dedomain_9 = DeconstructDomain(Domain=debox_9.Z)  # -> Start, End
rebuildsrf_9 = RebuildSurface(Surface=item_23, UDegree=3, VDegree=3, UNumber=10, VNumber=number_slider_29)
dom_9 = ConstructDomain(DomainStart=dedomain_9.Start, DomainEnd=dedomain_9.End)
range_9 = Range(Domain=dom_9, Steps=Slider(5, range=0..10))

# ---- group: additional plane on top
item_30 = ListItem(List=range_9, Index=0, Wrap=True)  # -> Item2, Item1, Item
subtraction_9 = Subtraction(A=item_30.Item1, B=item_30.Item2)
division_10 = Division(A=subtraction_9, B=Slider(1.5, range=0..10))
addition_9 = Addition(A=item_30.Item2, B=division_10)
merge_10 = Merge(Data1=range_9, Data2=addition_9)
sort_17 = SortList(Keys=merge_10, ValuesA=merge_10)  # -> Keys, ValuesA

# ----
pt_10 = ConstructPoint(XCoordinate=0, YCoordinate=0, ZCoordinate=sort_17.ValuesA)
xy_9 = XYPlane(Origin=pt_10)
sec_9 = BrepPlane(Brep=item_23, Plane=xy_9)  # -> flatten(Curves), Points
srfsplit_9 = SurfaceSplit(Surface=item_23, Curves=flatten(sec_9.Curves))  # -> reparameterize(Fragments)
shrinktrimsrf_9 = ShrinkTrimmedSurface(Surface=srfsplit_9)  # -> Shrunken, reparameterize(Underlying), R
evalsrf_17 = EvaluateSurface(Surface=simplify(shrinktrimsrf_9.Underlying), Point=md_slider_8)  # -> Point, Normal, UDirection, VDirection, Frame
pdecon_9 = Deconstruct(Point=evalsrf_17.Point)  # -> XComponent, YComponent, ZComponent
sort_18 = SortList(Keys=flatten(pdecon_9.ZComponent), ValuesA=flatten(shrinktrimsrf_9.Shrunken))  # -> Keys, ValuesA

divide_9 = DivideDomain²(Domain=sort_18.ValuesA, UCount=Slider(1, range=0..10), VCount=number_slider_29)  # -> simplify(Segments)
subsrf_9 = Isotrim(Surface=simplify(graft(sort_18.ValuesA)), Domain=divide_9)  # -> reparameterize(Surface)
evalsrf_18 = EvaluateSurface(Surface=simplify(subsrf_9), Point=md_slider_8)  # -> Point, Normal, UDirection, VDirection, Frame

# ----
# Nice order, we can work with it
points_10 = PointList(Points=evalsrf_18.Point)

merge_11 = Merge(
    Data1=subsrf,
    Data2=subsrf_5,
    Data3=subsrf_8,
    Data4=subsrf_6,
    Data5=subsrf_3,
    Data6=subsrf_2,
    Data7=subsrf_7,
    Data8=subsrf_9,
    Data9=subsrf_4)

smesh = SimpleMesh(Brep=merge_11)

# ---- group: join the top mesh into two
tstat = TreeStatistics(Tree=smesh)  # -> Paths, Length, Count
lng = ListLength(List=tstat.Paths)  # -> expr("x-1", Length)
item_31 = ListItem(List=tstat.Paths, Index=0, Wrap=True)  # -> Item1, Item
split = SplitList(List=tstat.Paths, Index=lng)  # -> ListA, ListB
branch = TreeBranch(Tree=smesh, Path=item_31.Item1, MaintainPaths=True)
branch_2 = TreeBranch(Tree=smesh, Path=split.ListA, MaintainPaths=True)
mjoin = MeshJoin(Meshes=branch)
alignvert = AlignVertices(Mesh=mjoin, Tolerance=Slider(0.4, range=0..1))  # -> Result, Count

# ----
merge_12 = Merge(Data1=branch_2, Data2=alignvert.Result)
m_i_wp_2 = IWP(G0=merge_12, T0=0.5, T1=0.5, D=Slider(0.1, range=0..0.1), C=True, R=False)  # -> out, A; inputs G0: GeometryBase, G1: GeometryBase, I: list, T0: list, T1: list, clr: list of Color; same code as m_i_wp
m_pinch = Pinch(G=merge_12, T0=0.25, T1=0.5, T2=1, T3=1, T4=0, D=Slider(0.2, range=0..1))  # -> out, A; inputs G: GeometryBase, I: list, T0: list, T1: list, T2: list, T3: list, T4: list, D: list, clr: list of Color
# ---------- m_pinch: VB ----------
    Component.Params.Input(0).Name = "Mesh or Curve"
    Component.Params.Input(0).Description = "Open or closed mesh or curve"
    Component.Params.Input(1).Name = "Index [Face]"
    Component.Params.Input(1).Description = "An optional integer or list of integers which specify the faces to be modified if the input is a mesh. If no value is supplied then all faces will be modified"
    Component.Params.Input(2).Name = "Vert to Face [Vertex]"
    Component.Params.Input(2).Description = "A unitized value which sets the evaluation distance from the vertex to the face center"
    Component.Params.Input(3).Name = "Edge to Face [Vertex]"
    Component.Params.Input(3).Description = "A unitized value which sets the evaluation distance from the edge midpoint to the face center"
    Component.Params.Input(4).Name = "Edge Depth [Vertex]"
    Component.Params.Input(4).Description = "A unitized value which sets the evaluation distance of the edge midpoint based depth"
    Component.Params.Input(5).Name = "Vert Depth [Vertex]"
    Component.Params.Input(5).Description = "A unitized value which sets the evaluation distance of the vertex based depth"
    Component.Params.Input(6).Name = "Closed Depth [Vertex]"
    Component.Params.Input(6).Description = "If C is true, then this unitized value will set the offset depth of the new center point relative to the face's relief depth"
    Component.Params.Input(7).Name = "Distance [Vertex]"
    Component.Params.Input(7).Description = "An optional number or list of numbers which specifies the depth of the relief from the mesh face"
    Component.Params.Input(8).Name = "Close"
    Component.Params.Input(8).Description = "If true, the relief will be closed with a new offset center vertex"
    Component.Params.Input(9).Name = "Color [Vertex]"
    Component.Params.Input(9).Description = "(If applied to a mesh a list of colors corresponding to each mesh face, if applied to a curve, a list of colors corresponding to each control point plus an additonal color value for the new averaged center"

    Component.Params.Output(1).Name = "Mesh"
    Component.Params.Output(1).Description = "If successful, a valid mesh"

    If G IsNot Nothing Then

      Dim bM, bP,bmC,biC As Boolean

      bM = g.ObjectType = ObjectType.Mesh
      bP = g.ObjectType = ObjectType.Curve

      If (bM Or bP) Then
        Dim msh As New mesh
        Dim crv As curve
        Dim av As point3d
        Dim ac As color
        Dim h,j,jj,k,u,v,w As Integer
        Dim cv,cf,ce As Integer
        Dim x(),y() As Integer

        Dim mv,fv,ep,tv As New list(Of Point3d)
        Dim mev As New dictionary(Of String, Integer)
        Dim mf As Rhino.Geometry.Collections.MeshFaceList = Nothing
        Dim mtv As Rhino.Geometry.Collections.MeshTopologyVertexList = Nothing
        Dim mte As Rhino.Geometry.Collections.MeshTopologyEdgeList = Nothing
        Dim mn As Rhino.Geometry.Collections.MeshVertexNormalList = Nothing
        Dim mfn As Rhino.Geometry.Collections.MeshFaceNormalList = Nothing
        Dim ev As New list(Of vector3d)
        Dim ed As New list(Of Double)
        Dim mc,ec,tc,cc,fc As New list(Of color)
        Dim xf As New list(Of meshface)

        If clr.count() = 0 Then clr.add(color.LightGray) Else biC = True

        If bm Then
          'Start Deconstruct if Mesh
          msh = g

          If msh.Normals.Count() = 0 Then msh.Normals.ComputeNormals()
          If msh.FaceNormals.Count() = 0 Then msh.FaceNormals.ComputeFaceNormals()

          If i.count() = 0 Then I = Enumerable.Range(0, msh.Faces.Count()).ToList()

          mv = msh.Vertices().ToPoint3dArray().tolist()
          mte = msh.TopologyEdges()
          mtv = msh.TopologyVertices()
          mf = msh.Faces()

          mn = msh.Normals()
          mn.UnitizeNormals()
          mfn = msh.FaceNormals()
          mfn.UnitizeFaceNormals()

          cf = I.Count() - 1
          ce = mte.count() - 1

          'Assign Colors
          If msh.VertexColors.Count() < 1 Then
            msh.VertexColors.CreateMonotoneMesh(color.LightGray)
            bmC = biC
          Else
            bmC = True
          End If
          'Assign fake edges
          mc = msh.VertexColors().ToArray().ToList()
        Else
          'Start Deconstruct if Curve
          crv = g

          I.clear()
          I.add(0)
          Dim nc As nurbscurve
          Dim pc As polyline
          Dim nps As Rhino.Geometry.Collections.NurbsCurvePointList

          nc = crv.ToNurbsCurve()
          nps = nc.Points
          pc = nc.Points.ControlPolygon
          If (Not pc.IsClosed) Then pc.add(pc(0))
          av = pc.CenterPoint

          msh.Vertices.AddVertices(pc.ToArray())
          msh.faces.addfaces(pc.TriangulateClosedPolyline())
          msh.Vertices.Remove(pc.count() - 1, True)
          msh.FaceNormals.ComputeFaceNormals()
          msh.Normals.ComputeNormals()
          msh.Normals.UnitizeNormals()

          mv = msh.Vertices.ToPoint3dArray().tolist()
          mte = msh.TopologyEdges()
          mtv = msh.TopologyVertices()
          mn = msh.Normals()
          mfn = msh.FaceNormals()

          mfn(0) = avgVec(mn.toarray())

          'Assign Colors
          If bic Then bmC = True
          mc = clr
          If (clr.count() - 1) < (mv.count() - 1) Then mc = matchClr(mc, mv.count() - 1)


          ac = avgClr(mc.toarray())
          cf = 0
        End If
        cv = mv.count() - 1
        ce = mte.count() - 1

        x = appendprepend(cv)
        'Match variables and colors to vertex count
        If (T0.count() - 1) < cv Then T0 = matchDbl(T0, cv)
        If (T1.count() - 1) < cv Then T1 = matchDbl(T1, cv)
        If (T2.count() - 1) < cv Then T2 = matchDbl(T2, cv)
        If (T3.count() - 1) < cv Then T3 = matchDbl(T3, cv)
        If (T4.count() - 1) < cv Then T4 = matchDbl(T4, cv)
        If (D.count() - 1) < cv Then D = matchDbl(D, cv)
        If (clr.count() - 1) < cv Then clr = matchClr(clr, cv)
        If biC Then fc = clr Else fc = mc

        'Edge based vertices
        k = 0
        For j = 0 To mte.count() - 1 Step 1
          If (bm Or (bp And (mte.GetConnectedFaces(j).Count() < 2))) Then
            u = mtv.MeshVertexIndices(mte.GetTopologyVertices(j).I)(0)
            v = mtv.MeshVertexIndices(mte.GetTopologyVertices(j).J)(0)

            ep.add(evalP(mv(u), mv(v), 0.5))
            ev.add(evalV(mn(u), mn(v), 0.5))
            ed.add(evalN(d(u), d(v), 0.5))
            ec.add(evalC(mc(u), mc(v), 0.5))
            mev.add(u & "," & v & "," & 0, k)
            mev.add(v & "," & u & "," & 0, k)

            k += 1
          End If
        Next

        'Face based vertices
        Dim xv(),mt(),ei() As Integer
        Dim xc() As color
        Dim xd,xn As Double
        ReDim ei(0)
        u = 2
        v = mv.count()
        If c Then v += cf + 1

        For jj = 0 To I.count() - 1 Step 1
          Dim tcv As New point3d
          j = I(jj)
          w = v + tv.count()
          xd = 0
          xn = 0
          If bm Then
            If mf(j).isquad() Then h = 4 Else h = 3
            ReDim xv(h - 1)
            ReDim xc(h - 1)
            mt = mf.GetTopologicalVertices(j)
            For k = 0 To h - 1 Step 1
              xv(k) = mtv.MeshVertexIndices(mt(k))(0)
              xc(k) = fc(xv(k))
            Next
            av = mf.GetFaceCenter(j)
            ac = avgClr(xc)
          Else
            h = mv.count()
            xv = Enumerable.Range(0, h).ToArray()
          End If
          For k = 0 To h - 1 Step 1
            xd += D(xv(k))
            xn += T4(xv(k))
          Next
          xd /= h
          xn /= h
          mfn(j) *= xd
          y = appendprepend(h - 1)

          For k = 1 To h Step 1
            ei(0) = mev.item(xv(y(k)) & "," & xv(y(k + 1)) & "," & 0)

            'Define new per face vertices
            tv.add(evalP(mv(xv(y(k))) + mN(xv(y(k))) * D(xv(y(k))) * t3(xv(y(k))), av + New vector3d(mfn(j)) * t3(xv(y(k))), t0(xv(y(k)))))
            tc.add(evalC(mc(xv(y(k))), ac, t0(xv(y(k)))))

            tv.add(evalP(ep(ei(0)) + ev(ei(0)) * eD(ei(0)) * (t2(xv(y(k))) + t2(xv(y(k + 1)))) / 2, av + New vector3d(mfn(j)) * (t2(xv(y(k))) + t2(xv(y(k + 1)))) / 2, (t1(xv(y(k))) + t1(xv(y(k + 1)))) / 2))
            tc.add(evalC(ec(ei(0)), ac, (t1(xv(y(k))) + t1(xv(y(k + 1)))) / 2))

            tcv += (tv.item(tv.count() - 1) + tv.item(tv.count() - 2)) / 2
            'Define new faces
            xf.add(New meshface(xv(y(k)), xv(y(k + 1)), w + y(k) * u + 1))
            xf.add(New meshface(w + y(k) * u, xv(y(k)), w + y(k) * u + 1))
            xf.add(New meshface(w + y(k) * u + 1, xv(y(k + 1)), w + y(k + 1) * u))

            If c Then
              xf.add(New meshface(w + y(k) * u, w + y(k) * u + 1, v + jj - cf - 1))
              xf.add(New meshface(w + y(k) * u + 1, w + y(k + 1) * u, v + jj - cf - 1))
            End If
          Next
          If c Then
            tcv /= h
            fv.add(evalP(tcv, av, xn))
            cc.add(ac)
          End If
        Next

        Dim om As New mesh
        om.Vertices.AddVertices(mv)
        If bmC Then om.VertexColors.AppendColors(mc.toarray())

        If c Then
          om.Vertices.AddVertices(fv)
          If bmC Then om.VertexColors.AppendColors(cc.toarray())
        End If

        om.Vertices.AddVertices(tv.toarray())
        If bmC Then om.VertexColors.AppendColors(tc.toarray())

        om.Faces.AddFaces(xf.toarray())

        If i.count() > 1 Then om.Vertices.CullUnused()

        A = om
      End If
    End If
# ---------- m_pinch: VB additional code ----------
  Private Function appendprepend(ByVal i As Integer)
    Dim srsEnum As IEnumerable(Of Integer) = Enumerable.Range(0, i + 1)
    Dim arrVal As New list(Of Integer)
    arrVal = srsEnum.tolist()
    arrVal.add(0)
    arrVal.insert(0, i)
    Return arrVal.toarray()
  End Function

  Private Function matchDbl(ByVal a As list(Of Double), ByVal t As Integer)
    Dim i,k As Integer
    k = a.count()
    For i = 0 To ((t + 1) - k) - 1 Step 1
      a.add(a.item(k - 1))
    Next
    Return a
  End Function

  Private Function matchClr(ByVal a As list(Of Color), ByVal t As Integer)
    Dim i,k As Integer
    k = a.count()
    For i = 0 To ((t + 1) - k) - 1 Step 1
      a.add(a.item(k - 1))
    Next
    Return a
  End Function

  Private Function evalP(ByVal op As point3d, ByVal tp As Point3d, ByVal t As Double)
    Return New point3d(op + (tp - op) * t)
  End Function

  Private Function evalV(ByVal ov As vector3d, ByVal tv As vector3d, ByVal t As Double)
    Return New vector3d(ov + (tv - ov) * t)
  End Function

  Private Function evalN(ByVal u As Double, ByVal v As Double, ByVal t As Double)
    Return u + (v - u) * t
  End Function

  Private Function avgVec(ByVal v() As vector3f)
    Dim i As Integer
    Dim tv As Vector3d

    For i = 0 To (v.Length - 1) Step 1
      tv += v(i)
    Next
    tv /= ((v.Length - 1) + 1)
    tv.Unitize()
    Return New vector3f(tv.X, tv.Y, tv.Z)
  End Function

  Private Function roundClr(ByVal r As Integer, ByVal g As Integer, ByVal b As Integer, ByVal i As Integer)
    r = CInt(r / i)
    g = CInt(g / i)
    b = CInt(b / i)

    If r > 255 Then r = 255 Else If r < 0 Then r = 0
    If g > 255 Then g = 255 Else If g < 0 Then g = 0
    If b > 255 Then b = 255 Else If b < 0 Then b = 0

    Return color.FromArgb(r, g, b)
  End Function

  Private Function avgClr(ByVal c() As color)
    Dim r,g,b As Integer
    Dim i,k As Integer

    k = (c.Length - 1) + 1

    For i = 0 To k - 1 Step 1
      r += CInt(c(i).R)
      g += CInt(c(i).G)
      b += CInt(c(i).B)
    Next

    r = CInt(r / k)
    g = CInt(g / k)
    b = CInt(b / k)

    If r > 255 Then r = 255 Else If r < 0 Then r = 0
    If g > 255 Then g = 255 Else If g < 0 Then g = 0
    If b > 255 Then b = 255 Else If b < 0 Then b = 0

    Return color.FromArgb(r, g, b)
  End Function

  Private Function evalC(ByVal oc As color, ByVal tc As color, ByVal t As Double)
    Dim r,g,b As Integer
    r = CInt(CInt(oc.R) + (CInt(tc.R) - CInt(oc.R)) * t)
    g = CInt(CInt(oc.G) + (CInt(tc.G) - CInt(oc.G)) * t)
    b = CInt(CInt(oc.B) + (CInt(tc.B) - CInt(oc.B)) * t)

    If r > 255 Then r = 255 Else If r < 0 Then r = 0
    If g > 255 Then g = 255 Else If g < 0 Then g = 0
    If b > 255 Then b = 255 Else If b < 0 Then b = 0

    Return color.FromArgb(r, g, b)
  End Function
# ---------- end m_pinch ----------
m_frame_0_2 = Frame0(G=merge_12, T0=0.5, D=0, N=1, S=1, O=True)  # -> out, A; inputs G: GeometryBase, I: list, T0: list, D: list, N: list, S: list, clr: list of Color; same code as m_frame_0
item_32 = ListItem(List=m_i_wp_2.A, Index=0, Wrap=True)
flip = FlipMatrix(Data=item_32)
item_33 = ListItem(List=flip, Index=0, Wrap=True)

wbthicken = WeaverbirdsMeshThicken(MeshCurves=m_frame_0_2.A, Distance=Slider(0.1, range=0..1), OffsetType=0)
mesh = Mesh(wbthicken)
