# Grasshopper definition dome_sharp.gh (Grasshopper 1.0.8)
# plug-ins: Kangaroo2 Components

number_slider = Slider(5, range=0..10)
number_slider_2 = Slider(5, range=0..5)
polygon = Polygon(Plane=PlaneXY(0, 0, 0), Radius=Slider(5, range=0..15), Segments=number_slider, FilletRadius=0)  # -> Polygon, Length
Z = UnitZ(Factor=number_slider_2)
extr = Extrude(Base=polygon.Polygon, Direction=Z)
move = Move(Geometry=polygon.Polygon, Motion=Z)  # -> Geometry, Transform

explode = Explode(Curve=move.Geometry, Recursive=True)  # -> graft(Segments), Vertices
number_slider_3 = Slider(4.3, range=0..5)
eval = EvaluateCurve(Curve=reparameterize(explode.Segments), Parameter=".5")  # -> Point, Tangent, Angle
len = Length(Curve=explode.Segments)
Z_2 = UnitZ(Factor=number_slider_2)
pl = ConstructPlane(Origin=eval.Point, XAxis=explode.Segments, YAxis=Z_2)
division = Division(A=len, B="2")
arc = Arc(Plane=pl, Radius=division, Angle=Domain(0, 3.141592654))  # -> Arc, Length
pln = Plane(pl)
neg = Negative(Value=number_slider_3)
merge = Merge(Data1=arc.Arc, Data2=explode.Segments)
line = LineSDL(Start=pln, Direction=pln, Length=number_slider_3)
line_2 = LineSDL(Start=pln, Direction=pln, Length=neg)
merge_2 = Merge(Data1=line, Data2=line_2)
boundary = BoundarySurfaces(Edges=merge)
extr_2 = Extrude(Base=boundary, Direction=merge_2)  # -> flatten(Extrusion)

offset = OffsetCurve(Curve=move.Geometry, Thinkness=Slider(0.4, range=0..2), Corners=1)
explode_2 = Explode(Curve=offset, Recursive=True)  # -> Segments, Vertices
division_2 = Division(A="360", B=number_slider)
area = Area(Geometry=move.Geometry)  # -> Area, Centroid
merge_3 = Merge(Data1=explode.Vertices, Data2=explode_2.Vertices)
duppt = RemoveDuplicatePts(Points=merge_3, Tolerance=0.01)
dist = Distance(PointA=area.Centroid, PointB=duppt)
vec2pt = Vector2Pt(PointA=area.Centroid, PointB=duppt, Unitize=False)  # -> Vector, Length
rad = Radians(Degrees="90")
pl_2 = ConstructPlane(Origin=area.Centroid, XAxis=vec2pt.Vector, YAxis=Z_2)
arc_2 = Arc(Plane=pl_2, Radius=dist, Angle=rad)  # -> Arc, Length
rotate = Rotate(Geometry=arc_2.Arc, Angle=degrees(division_2), Plane=PlaneXY(0, 0, 0))  # -> Geometry, Transform
cp = ControlPoints(Curve=arc_2.Arc)  # -> Points, Weights, Knots
rulesrf = RuledSurface(CurveA=arc_2.Arc, CurveB=rotate.Geometry)
join = BrepJoin(Breps=flatten(rulesrf))  # -> Breps, Closed
cap = CapHoles(Brep=join.Breps)
dispatch = Dispatch(List=cap, DispatchPattern=[True, False])  # -> ListA, ListB
sdiff = SolidDifference(BrepsA=dispatch.ListB, BrepsB=dispatch.ListA)
sdiff_2 = SolidDifference(BrepsA=sdiff, BrepsB=extr_2)
toggle = BooleanToggle(True)
outer_srf = ListItem(List=join.Breps, Index="0", Wrap=True)  # -> Item, Item1
