# Grasshopper definition selfdevelopingvault.gh (Grasshopper 0.9.76)
# plug-ins: Kangaroo Components, HDTReference, LunchBox

# ----
# pdf input
toggle = BooleanToggle(True)
rotation = Number(0)
path_to_pdf = FilePath("C:\Users\Witali\Dropbox\erasmus_Gdansk 2015\parametric architecture\22.05.2015_definition developing\self developing vault pdf.pdf")
insertionpt = Point(Point(0, 0, 0))
scale = Number(1)
pdfinsert = CSharpScript(insPt=insertionpt, paths=path_to_pdf, scale=scale, rotation=rotation, run=toggle)  # -> out, A; inputs insPt: Point3d, paths: list of String, scale: Double, rotation: Double, run: Boolean
# ---------- pdfinsert: C# ----------
    foreach(string path in paths){
      var name = System.IO.Path.GetFileName(path);
      string notYetInCmd = String.Format(@"-Insert File=Yes Linkmode=Link ""{0} "" Block Enter {1} {2} {3}", path, insPt, scale, rotation);
      string alreadyInCmd = String.Format(@"-Insert File=No ""{0}"" Block {1} {2} {3}", name, insPt, scale, rotation);

      if(run){
        bool alreadyIn = false;
        InstanceDefinition[] instances = RhinoDocument.InstanceDefinitions.GetList(true);
        foreach(InstanceDefinition inst in instances){
          if((name.Contains(inst.Name))){
            alreadyIn = true;
          }
        }
        Print(alreadyIn ? "it's in" : System.IO.Path.GetFileName(path));
        if(alreadyIn){
          Rhino.RhinoApp.RunScript(alreadyInCmd, true);
        } else {
          Rhino.RhinoApp.RunScript(notYetInCmd, true);
        }
      }
    }

    //FUTURE
    //if block is already placed in the document, only perform transform on object. Right now duplicate blocks are placed
# ---------- end pdfinsert ----------

# ----
# START
an_aus = BooleanToggle(False)
timer = Timer(TimerInterval=20, Target=kangaroo)

# ----
# explode blocks
panel = Panel("default")
update = BooleanToggle(True)
objects_by_layer = ObjectsByLayer(Layer=panel, RefreshWithPipeline=update)  # -> RhinoObjects, ObjectAttributes
sort_objects_by_type = SortObjectsByType(RhinoObjects=objects_by_layer.RhinoObjects)  # -> Points, Curves, Surfaces, Breps, Meshes, TextObjects, HatchObjects, LightObjects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
explode_blocks = ExplodeBlocks(BlockObjects=sort_objects_by_type.Blocks, explodeGeom=True)  # -> Geometry, Attributes, BlockName, BoundingBox, BlockTransform
curve = Curve(explode_blocks.Geometry)
fixing_point_4 = ItemSelector(
    curve,
    {"Planar Curve", "Closed Planar Curve", "Closed Planar Curve", "Closed Planar Curve", "Closed Planar Curve", "Closed Planar Curve", "Closed Planar Curve"}, selected="Closed Planar Curve")
fixing_point_5 = ItemSelector(
    curve,
    {"Planar Curve", "Closed Planar Curve", "Closed Planar Curve", "Closed Planar Curve", "Closed Planar Curve", "Closed Planar Curve", "Closed Planar Curve"}, selected="Closed Planar Curve")
fixing_point_3 = ItemSelector(
    curve,
    {"Planar Curve", "Closed Planar Curve", "Closed Planar Curve", "Closed Planar Curve", "Closed Planar Curve", "Closed Planar Curve", "Closed Planar Curve"}, selected="Closed Planar Curve")
fixing_point_2 = ItemSelector(
    curve,
    {"Planar Curve", "Closed Planar Curve", "Closed Planar Curve", "Closed Planar Curve", "Closed Planar Curve", "Closed Planar Curve", "Closed Planar Curve"}, selected="Closed Planar Curve")
fixing_point_6 = ItemSelector(
    curve,
    {"Planar Curve", "Closed Planar Curve", "Closed Planar Curve", "Closed Planar Curve", "Closed Planar Curve", "Closed Planar Curve", "Closed Planar Curve"}, selected="Closed Planar Curve")
fixing_point = ItemSelector(
    curve,
    {"Planar Curve", "Closed Planar Curve", "Closed Planar Curve", "Closed Planar Curve", "Closed Planar Curve", "Closed Planar Curve", "Closed Planar Curve"}, selected="Closed Planar Curve")
outline = ItemSelector(
    curve,
    {"Planar Curve", "Closed Planar Curve", "Closed Planar Curve", "Closed Planar Curve", "Closed Planar Curve", "Closed Planar Curve", "Closed Planar Curve"}, selected="Planar Curve")
divide_curve = DivideCurve(Curve=outline, Count=100, Kinks=False)  # -> Points, Tangents, Parameters
divide_curve_2 = DivideCurve(Curve=fixing_point, Count=100, Kinks=False)  # -> Points, Tangents, Parameters
divide_curve_3 = DivideCurve(Curve=fixing_point_2, Count=100, Kinks=False)  # -> Points, Tangents, Parameters
divide_curve_4 = DivideCurve(Curve=fixing_point_3, Count=100, Kinks=False)  # -> Points, Tangents, Parameters
divide_curve_5 = DivideCurve(Curve=fixing_point_4, Count=100, Kinks=False)  # -> Points, Tangents, Parameters
divide_curve_6 = DivideCurve(Curve=fixing_point_5, Count=100, Kinks=False)  # -> Points, Tangents, Parameters
divide_curve_7 = DivideCurve(Curve=fixing_point_6, Count=100, Kinks=False)  # -> Points, Tangents, Parameters
polyline = PolyLine(Vertices=divide_curve_2.Points, Closed=True)
polyline_2 = PolyLine(Vertices=divide_curve_3.Points, Closed=True)
polyline_3 = PolyLine(Vertices=divide_curve.Points, Closed=True)
polyline_4 = PolyLine(Vertices=divide_curve_4.Points, Closed=True)
polyline_5 = PolyLine(Vertices=divide_curve_5.Points, Closed=True)
polyline_6 = PolyLine(Vertices=divide_curve_6.Points, Closed=True)
polyline_7 = PolyLine(Vertices=divide_curve_7.Points, Closed=True)

# ----
# outline/ fixpoints
panel_2 = Panel("fixing points")
outline_2 = Curve(polyline_3)
update_2 = BooleanToggle(False)
objects_by_layer_2 = ObjectsByLayer(Layer=panel_2, RefreshWithPipeline=update_2)  # -> RhinoObjects, ObjectAttributes
sort_objects_by_type_2 = SortObjectsByType(RhinoObjects=objects_by_layer_2.RhinoObjects)  # -> Points, Curves, Surfaces, Breps, Meshes, TextObjects, HatchObjects, LightObjects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

gravity = ControlKnob(Decimals=2, Limit=True, Maximum=300, Minimum=-300, Range=100, Value=-26.04)
fixing_points = Point(sort_objects_by_type_2.Points)

curve_2 = Curve([polyline, polyline_2, polyline_4, polyline_5, polyline_6, polyline_7])
bake = BooleanToggle(True)

# ----
# kangaroo physics
raster = ControlKnob(Decimals=0, Limit=True, Maximum=2000, Minimum=0, Range=2000, Value=1856)
boundary = BoundarySurfaces(Edges=outline_2)
custom_mesh_settings = SettingsCustom(
    StitchSeams=True,
    SimplePlanes=False,
    Refine=True,
    MinCount=raster,
    MaxCount=400,
    AspectRatio=20,
    MaxDistance=0,
    MaxAngle=20,
    MinEdge=0,
    MaxEdge=0)
Z = UnitZ(Factor=expr("-x", gravity))
mesh = MeshBrep(Brep=boundary, Settings=custom_mesh_settings)
mesh_2 = Mesh(mesh)
nv = NakedVertices(Mesh=mesh_2)  # -> ClothedIndex, NakedIndex, ClothedPts, NakedPts
point = Point(nv.NakedPts)
medges = MeshEdges(Mesh=mesh_2)  # -> NakedEdges, InteriorEdges, NonManifoldEdges
springs = SpringsFromLine(
    Connection=[medges.NakedEdges, medges.InteriorEdges],
    Stiffness="300",
    Damping=10,
    RestLength=0,
    UpperCutoff=0,
    LowerCutoff=0,
    Plasticity=0)

mesh_points = Point([nv.ClothedPts, nv.NakedPts])
con = Containment(Point=mesh_points, Curve=graft(curve_2))  # -> Relationship, Point
equals = Equality(FirstNumber=con.Relationship, SecondNumber="1")  # -> Equality, Inequality
cull = CullPattern(List=mesh_points, CullPattern=equals.Equality)
object_bake = ObjectBake(
    BakeToggle=bake,
    GeometryObjects=cull,
    Layer="fixing points",
    ObjectName="GH_Obj",
    ObjectColor=RGB(255, 255, 255),
    LayerColor=RGB(255, 255, 255))

uforce = UnaryForce(Point=mesh_points, Force=Z)
kangaroo = KangarooPhysics(
    ForceObjects=flatten([springs, uforce]),
    AnchorPoints=fixing_points,
    Settings=null,
    Geometry=mesh_2,
    SimulationReset=an_aus)  # -> Out, Iterations, ParticlesOut, GeometryOut, KE
# vault mesh/
# output
mesh_3 = Mesh(kangaroo.GeometryOut)
